# Grasshopper definition 3DEC DFN.gh (Grasshopper 1.0.7)
# plug-ins: MeshEdit Components

mesh = Mesh([<mesh referenced from the Rhino model> x18])
id = Panel("7")
mesh_2 = Mesh(graft(mesh))
facen = FaceNormals(Mesh=mesh_2)  # -> Centers, Normals
avr = Average(Input=facen.Normals)
devec = DeconstructVector(Vector=avr)  # -> XComponent, YComponent, ZComponent
asin = ArcSine(Value=devec.ZComponent)
division = Division(A=devec.XComponent, B=devec.YComponent)
deg = Degrees(Radians=asin)
atan = ArcTangent(Value=division)
expression = Expression(x=deg, Expression="If(x > 0, 0, 180)")
area = MeshArea(Mesh=mesh)  # -> Area, Centroid
deg_2 = Degrees(Radians=atan)
expression_2 = Expression(x=devec.YComponent, Expression="If(x < 0, 180, 0)")
addition = Addition(A=deg_2, B=expression)
expression_3 = Expression(x=devec.YComponent, y=addition, Expression="If(x = 0, 0, y)")
addition_2 = Addition(A=expression_3, B=expression_2)
larger = LargerThan(FirstNumber=addition_2, SecondNumber=Slider(360, range=0..1000))  # -> LargerThan, OrEqualTo
smaller = SmallerThan(FirstNumber=addition_2, SecondNumber=Slider(0, range=0..100))  # -> SmallerThan, OrEqualTo
expression_4 = Expression(x=larger.LargerThan, y=addition_2, Expression="If(x = true, y-360, 0)")
expression_5 = Expression(x=smaller.SmallerThan, y=addition_2, Expression="If(x = true, y+360, 0)")
or = GateOr(A=smaller.SmallerThan, B=larger.LargerThan)
expression_6 = Expression(x=deg, Expression="If(x > 0, 90-x, 90+x)")  # -> flatten(R)
expression_7 = Expression(x=or, y=addition_2, Expression="If(x = true, 0, y)")
addition_3 = Addition(A=expression_5, B=expression_4, C=expression_7)  # -> flatten(Result)
dip_direction = Panel(addition_3)
dip_angle = Panel(expression_6)
pdecon = Deconstruct(Point=flatten(area.Centroid))  # -> XComponent, YComponent, ZComponent
expression_8 = Expression(x=area.Area, Expression="sqrt(x/pi)*2")
num = Number(dip_direction)
num_2 = Number(dip_angle)
expression_9 = Expression(
    r=expression_8,
    x=pdecon.XComponent,
    y=pdecon.YComponent,
    z=pdecon.ZComponent,
    dip=num_2,
    dipdir=num,
    ID=id,
    Expression="Format(\"dfn addfracture position {0:0.00},{1:0.00},{2:0.00} dip {3:0.00} dipdir {4:0.00} size {5:0.00} fracid {6}\", x, y, z, dip, dipdir, r,ID)")
panel = Panel(expression_9)
