# Grasshopper definition 3DEC DFN_V7.gh (Grasshopper 1.0.7)
# plug-ins: MeshEdit Components, Human

id = Panel("'Open Joints'")
mesh = Mesh([<mesh referenced from the Rhino model> x82])
srf = Surface([<surface referenced from the Rhino model> x19])
cluster = Cluster(defects=srf)  # -> lay, R
objatts = ObjectAttributes(ObjectOrAttributes=mesh)  # -> Name, LayerName, LayerFullPath, Color, MaterialName, LinetypeName, GroupIndices, PlotWeight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
area = MeshArea(Mesh=mesh)  # -> Area, Centroid
lng = ListLength(List=cluster.R)
expression = Expression(x=area.Area, Expression="2*sqrt(x/pi)")
mesh_2 = Mesh(graft(mesh))
cluster_2 = Cluster_2(defects=mesh)  # -> dip, dip_direction_2
dup = DuplicateData(Data="cmd(\"", Number=lng, Order=True)
dup_2 = DuplicateData(Data="\")", Number=lng, Order=True)
pdecon = Deconstruct(Point=area.Centroid)  # -> XComponent, YComponent, ZComponent
facen = FaceNormals(Mesh=mesh_2)  # -> Centers, Normals
concat = Concatenate(FragmentA=dup, FragmentB=cluster.R)
expression_2 = Expression(L=objatts.LayerName, R=expression, Expression="if(L=\"Bedding Partings\",R*2,R)")
avr = Average(Input=facen.Normals)  # -> flatten(ArithmeticMean)
concat_2 = Concatenate(FragmentA=concat, FragmentB=dup_2)
panel = Panel(concat_2)
expression_3 = Expression(x=expression_2, Expression="x/2")
circle = CircleCNR(Center=area.Centroid, Normal=avr, Radius=expression_3)
python = GhPythonScript(
    size=expression_2,
    Layer=objatts.LayerName,
    x=pdecon.XComponent,
    y=pdecon.YComponent,
    z=pdecon.ZComponent,
    dip=cluster_2.dip,
    dipdir=cluster_2.dip_direction_2)  # -> out, a, b, c, d, e, f, g; inputs size: list, Layer: list, x: list, y: list, z: list, dip: list, dipdir: list
# ---------- python: Python ----------
__author__ = "Jiwoo Ahn"
__version__ = "2020.11.25"

import rhinoscriptsyntax as rs

def conv(val):
    return ','.join(val)

a = 'x = [' + conv([str(round(i,3)) for i in x]) + ']'
b = 'y = [' + conv([str(round(i,3)) for i in y]) + ']'
c = 'z = [' + conv([str(round(i,3)) for i in z]) + ']'
d = 'dip = [' + conv([str(round(i,3)) for i in dip]) + ']'
e = 'dipdir = [' + conv([str(round(i,3)) for i in dipdir]) + ']'
f = 'size = [' + conv([str(round(i,3)) for i in size]) + ']'
g = 'dfn = [' + conv([("'"+str(i)+"'") for i in Layer]) + ']'
# ---------- end python ----------
panel_2 = Panel([python.a, python.b, python.c, python.d, python.e, python.f, python.g])

# ==== cluster Cluster
defects = ClusterInput()
mesh = Mesh(defects)
mesh_2 = Mesh(graft(mesh))
facen = FaceNormals(Mesh=mesh_2)  # -> Centers, Normals
objatts = ObjectAttributes(ObjectOrAttributes=defects)  # -> Name, LayerName, LayerFullPath, Color, MaterialName, LinetypeName, GroupIndices, PlotWeight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
avr = Average(Input=facen.Centers)
avr_2 = Average(Input=facen.Normals)
lay = ClusterOutput(objatts.LayerName)
devec = DeconstructVector(Vector=avr_2)  # -> XComponent, YComponent, ZComponent
asin = ArcSine(Value=devec.ZComponent)
division = Division(A=devec.XComponent, B=devec.YComponent)
deg = Degrees(Radians=asin)
atan = ArcTangent(Value=division)
expression = Expression(x=deg, Expression="If(x > 0, 0, 180)")
deg_2 = Degrees(Radians=atan)
expression_2 = Expression(x=devec.YComponent, Expression="If(x < 0, 180, 0)")
addition = Addition(A=deg_2, B=expression)
expression_3 = Expression(x=devec.YComponent, y=addition, Expression="If(x = 0, 0, y)")
addition_2 = Addition(A=expression_3, B=expression_2)
larger = LargerThan(FirstNumber=addition_2, SecondNumber=Slider(360, range=0..1000))  # -> LargerThan, OrEqualTo
smaller = SmallerThan(FirstNumber=addition_2, SecondNumber=Slider(0, range=0..100))  # -> SmallerThan, OrEqualTo
expression_4 = Expression(x=larger.LargerThan, y=addition_2, Expression="If(x = true, y-360, 0)")
expression_5 = Expression(x=smaller.SmallerThan, y=addition_2, Expression="If(x = true, y+360, 0)")
or = GateOr(A=smaller.SmallerThan, B=larger.LargerThan)
expression_6 = Expression(x=deg, Expression="If(x > 0, 90-x, 90+x)")  # -> flatten(R)
expression_7 = Expression(x=or, y=addition_2, Expression="If(x = true, 0, y)")
addition_3 = Addition(A=expression_5, B=expression_4, C=expression_7)  # -> flatten(Result)
bbox = BoundingBox(Content=mesh, Plane=PlaneXY(0, 0, 0))  # -> Box, Box_2
dip_direction = Panel(addition_3)
dip_angle = Panel(expression_6)
debox = DeconstructBox(Box=bbox.Box)  # -> Plane, X, Y, Z
pdecon = Deconstruct(Point=flatten(avr))  # -> XComponent, YComponent, ZComponent
dedomain = DeconstructDomain(Domain=debox.Y)  # -> Start, End
dedomain_2 = DeconstructDomain(Domain=debox.Z)  # -> Start, End
dedomain_3 = DeconstructDomain(Domain=debox.X)  # -> Start, End
area = Area(Geometry=defects)  # -> Area, Centroid
expression_8 = Expression(
    x=dedomain_3.Start,
    y=dedomain.Start,
    z=dedomain_2.Start,
    u=dedomain_3.End,
    v=dedomain.End,
    w=dedomain_2.End,
    Expression="sqrt((u-x)^2+(v-y)^2+(u-x)^2)/2")
num = Number(dip_direction)
expression_9 = Expression(x=area.Area, Expression="2*sqrt(x/pi)")
num_2 = Number(dip_angle)
expression_10 = Expression(
    r=expression_9,
    x=pdecon.XComponent,
    y=pdecon.YComponent,
    z=pdecon.ZComponent,
    dip=num_2,
    dipdir=num,
    Expression="Format(\"fracture create position {0:0.00},{1:0.00},{2:0.00} dip {3:0.00} dipdir {4:0.00} size {5:0.00} DFN {6}\", x, y, z, dip, dipdir, r,ID)")
R = ClusterOutput(expression_10)

# ==== cluster Cluster_2
defects = ClusterInput()
mesh = Mesh(graft(defects))
facen = FaceNormals(Mesh=mesh)  # -> Centers, Normals
avr = Average(Input=facen.Normals)
devec = DeconstructVector(Vector=avr)  # -> XComponent, YComponent, ZComponent
asin = ArcSine(Value=devec.ZComponent)
division = Division(A=devec.XComponent, B=devec.YComponent)
deg = Degrees(Radians=asin)
atan = ArcTangent(Value=division)
expression = Expression(x=deg, Expression="If(x > 0, 0, 180)")
deg_2 = Degrees(Radians=atan)
expression_2 = Expression(x=devec.YComponent, Expression="If(x < 0, 180, 0)")
addition = Addition(A=deg_2, B=expression)
expression_3 = Expression(x=devec.YComponent, y=addition, Expression="If(x = 0, 0, y)")
addition_2 = Addition(A=expression_3, B=expression_2)
larger = LargerThan(FirstNumber=addition_2, SecondNumber=Slider(360, range=0..1000))  # -> LargerThan, OrEqualTo
smaller = SmallerThan(FirstNumber=addition_2, SecondNumber=Slider(0, range=0..100))  # -> SmallerThan, OrEqualTo
expression_4 = Expression(x=larger.LargerThan, y=addition_2, Expression="If(x = true, y-360, 0)")
expression_5 = Expression(x=smaller.SmallerThan, y=addition_2, Expression="If(x = true, y+360, 0)")
or = GateOr(A=smaller.SmallerThan, B=larger.LargerThan)
expression_6 = Expression(x=deg, Expression="If(x > 0, 90-x, 90+x)")  # -> flatten(R)
expression_7 = Expression(x=or, y=addition_2, Expression="If(x = true, 0, y)")
addition_3 = Addition(A=expression_5, B=expression_4, C=expression_7)  # -> flatten(Result)
dip_direction = Panel(addition_3)
dip_angle = Panel(expression_6)
num = Number(dip_direction)
num_2 = Number(dip_angle)
dip_direction_2 = ClusterOutput(num)
dip = ClusterOutput(num_2)
