# Grasshopper definition 3DEC Joints.gh (Grasshopper 1.0.7)

srf = Surface([<surface referenced from the Rhino model> x4])
mesh = Mesh(graft(srf))
facen = FaceNormals(Mesh=mesh)  # -> Centers, Normals
avr = Average(Input=facen.Centers)
avr_2 = Average(Input=facen.Normals)
devec = DeconstructVector(Vector=avr_2)  # -> XComponent, YComponent, ZComponent
asin = ArcSine(Value=devec.ZComponent)
division = Division(A=devec.XComponent, B=devec.YComponent)
deg = Degrees(Radians=asin)
atan = ArcTangent(Value=division)
expression = Expression(x=deg, Expression="If(x > 0, 0, 180)")
deg_2 = Degrees(Radians=atan)
expression_2 = Expression(x=devec.YComponent, Expression="If(x < 0, 180, 0)")
addition = Addition(A=deg_2, B=expression)
expression_3 = Expression(x=devec.YComponent, y=addition, Expression="If(x = 0, 0, y)")
addition_2 = Addition(A=expression_3, B=expression_2)
larger = LargerThan(FirstNumber=addition_2, SecondNumber=Slider(360, range=0..1000))  # -> LargerThan, OrEqualTo
smaller = SmallerThan(FirstNumber=addition_2, SecondNumber=Slider(0, range=0..100))  # -> SmallerThan, OrEqualTo
expression_4 = Expression(x=larger.LargerThan, y=addition_2, Expression="If(x = true, y-360, 0)")
expression_5 = Expression(x=smaller.SmallerThan, y=addition_2, Expression="If(x = true, y+360, 0)")
or = GateOr(A=smaller.SmallerThan, B=larger.LargerThan)
expression_6 = Expression(x=deg, Expression="If(x > 0, 90-x, 90+x)")  # -> flatten(R)
expression_7 = Expression(x=or, y=addition_2, Expression="If(x = true, 0, y)")
addition_3 = Addition(A=expression_5, B=expression_4, C=expression_7)  # -> flatten(Result)
dip_direction = Panel(addition_3)
dip_angle = Panel(expression_6)
pdecon = Deconstruct(Point=flatten(avr))  # -> XComponent, YComponent, ZComponent
num = Number(dip_direction)
num_2 = Number(dip_angle)
expression_8 = Expression(
    x=pdecon.XComponent,
    y=pdecon.YComponent,
    z=pdecon.ZComponent,
    Dip=num_2,
    DD=num,
    ID="2",
    Expression="Format(\"Jset origin {0:0.00},{1:0.00},{2:0.00} dip {3:0.00} dd {4:0.00} id {5}\", x, y, z, Dip, DD, ID)")
panel = Panel(expression_8)
