# Grasshopper definition 3DEC_Block_Generation.gh (Grasshopper 1.0.7)

number_slider = Slider(50, range=0..100)
crv = Curve(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)
divide = DivideCurve(Curve=crv, Count=number_slider, Kinks=False)  # -> Points, Tangents, Parameters
number_slider_2 = Slider(10, range=0..10)
Z = UnitZ(Factor=1)
neg = Negative(Value=number_slider_2)
line = LineSDL(Start=divide.Points, Direction=Z, Length=neg)
line_2 = LineSDL(Start=divide.Points, Direction=Z, Length=number_slider_2)
expression = Expression(x=number_slider, Expression="x-1")
srf = Surface(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)
pline = PolyLine(Vertices=divide.Points, Closed=False)
join = JoinCurves(Curves=[line_2, line], Preserve=False)
dom = ConstructDomain(DomainStart=Slider(1, range=0..1), DomainEnd=expression)
Y = UnitY(Factor=1)
subset = SubList(List=join, Domain=dom, Wrap=True)  # -> List, Index
Y_2 = UnitY(Factor=1)
expression_2 = Expression(x=Y, Expression="-x/2")
extr = Extrude(Base=pline, Direction=Y)
number_slider_3 = Slider(1, range=0..100)
expression_3 = Expression(x=Y_2, Expression="-x/2")
move = Move(Geometry=extr, Motion=expression_2)  # -> Geometry, Transform
extr_2 = Extrude(Base=subset.List, Direction=Y_2)
move_2 = Move(Geometry=extr_2, Motion=expression_3)  # -> Geometry, Transform
split = SplitBrep(Brep=srf, Cutter=move.Geometry)
srf_2 = Surface([<surface referenced from the Rhino model> x3])
splitmul = SplitBrepMultiple(Brep=split, Cutters=move_2.Geometry)  # -> flatten(Result)
cp = ControlPoints(Curve=srf_2)  # -> Points, Weights, Knots

surface = Surface(srf_2)
object_details = ObjectDetails(Object=surface)  # -> Referenced, Available, Name, Layer, Colour, Guid
point = Point(cp.Points)
expression_4 = Expression(x=point, Expression="Format(\"{0:0.00},{1:0.00},{2:0.00}\", x.x, x.y, x.z)")
ghpython_script = GhPythonScript(x=object_details.Name)  # -> graft(a)
# ---------- ghpython_script: Python ----------
"""Provides a scripting component.
    Inputs:
        x: The x script variable
    Output:
        a: The a output variable"""

__author__ = "Daniel.Schutt"
__version__ = "2020.07.16"

import rhinoscriptsyntax as rs
def suffix(x):
    if x:
       return "group {1} slot {0}".format(*x.split(","))
    else:
       return ''
print(x)
a = suffix(x)
# ---------- end ghpython_script ----------
panel = Panel(ghpython_script)
point_2 = Point(expression_4)
deconstruct = Deconstruct(Point=point_2)  # -> XComponent, YComponent, ZComponent
panel_2 = Panel("""polyhedron prism &
a {0} &
b {1} & 
{2}""")
text_join = TextJoin(Text=point_2, Join=" ")
construct_point = ConstructPoint(XCoordinate=deconstruct.XComponent, YCoordinate="50", ZCoordinate=deconstruct.ZComponent)
text_join_2 = TextJoin(Text=construct_point, Join=" ")
replace_text = ReplaceText(Text=text_join, Find=flatten("{"), RecursiveReplace=False)
replace_text_2 = ReplaceText(Text=text_join_2, Find=flatten("{"), RecursiveReplace=False)
replace_text_3 = ReplaceText(Text=replace_text, Find=flatten("}"), RecursiveReplace=False)
replace_text_4 = ReplaceText(Text=replace_text_2, Find=flatten("}"), RecursiveReplace=False)
format = Format(Format=panel_2, Culture=127, Data0=replace_text_3, Data1=replace_text_4, Data2=ghpython_script)  # -> flatten(Text)
panel_3 = Panel(format)

order = PointOrder(Points=cp.Points)
order_2 = PointOrder(Points=construct_point)
mesh = Mesh(<mesh referenced from the Rhino model>)
bbox = BoundingBox(Content=mesh, Plane=PlaneXY(0, 0, 0))  # -> Box, Box_2
debox = DeconstructBox(Box=bbox.Box)  # -> Plane, X, Y, Z
panel_4 = Panel(debox.X)
panel_5 = Panel(debox.Y)
panel_6 = Panel(debox.Z)
