# Grasshopper definition 3dec_tunnel.gh (Grasshopper 1.0.7)
# plug-ins: Pufferfish

number_slider = Slider(20, range=0..100)
number_slider_2 = Slider(50, range=0..100)
number_slider_3 = Slider(10, range=0..10)
crv = Curve([<curve referenced from the Rhino model> x2])
divide = DivideCurve(Curve=crv, Count=Slider(6, range=0..10), Kinks=False)  # -> Points, Tangents, Parameters
item = ListItem(List=divide.Points, Index=Slider(0, range=0..10), Wrap=Toggle(False))
number_slider_4 = Slider(5, range=0..10)
pdecon = Deconstruct(Point=divide.Points)  # -> XComponent, YComponent, ZComponent
pline = PolyLine(Vertices=divide.Points, Closed=False)
roundd = RoundToDecimalPlace(NumberX=pdecon.ZComponent, DecimalPlace=number_slider_4, RoundType=0)  # -> Rounded, Difference
roundd_2 = RoundToDecimalPlace(NumberX=pdecon.XComponent, DecimalPlace=number_slider_4, RoundType=0)  # -> Rounded, Difference
roundd_3 = RoundToDecimalPlace(NumberX=pdecon.YComponent, DecimalPlace=number_slider_4, RoundType=0)  # -> Rounded, Difference
python = GhPythonScript(x=roundd_2.Rounded, y=roundd_3.Rounded, z=roundd.Rounded)  # -> out, c; inputs x: list, y: list, z: list
# ---------- python: Python ----------
__author__ = "Jiwoo Ahn"
__version__ = "2020.09.11"

import rhinoscriptsyntax as rs

a = ""
b = ""

for i,j,k in zip(x,y,z):
    a = a + "{0},{1},{2} ".format(i,j,k)
    b = b + "{0},{1},{2} ".format(i,j,k-100)
    
c = "tunnel radial a " + a + "b " + b
# ---------- end python ----------
panel = Panel(python.c)
