# Grasshopper definition BinarySolver.gh (Grasshopper 0.9.77)

Z = Slider(2.4552, range=-10..10)
box = Box({Plane=Plane(origin=(-6, 4, 0), x=(0.6361464252, -0.7518094116, 0.1734944796), y=(0.7608765936, 0.5739621559, -0.3027115009)), X=Domain(0, 17.29161647), Y=Domain(0, 12.65043259), Z=Domain(0, 16)})
Z_2 = UnitZ(Factor=Z)
move = Move(Geometry=box, Motion=Z_2)  # -> Geometry, Transform
box_2 = Box({Plane=Plane(origin=(-10, -10, 0), x=(0, 1, 0), y=(1, 0, 0)), X=Domain(0, 30), Y=Domain(0, 30), Z=Domain(0, 40)})
target = Slider(500, range=10..2000)
sint = SolidIntersection(BrepsA=move.Geometry, BrepsB=box_2)
wires = BrepWireframe(Brep=move.Geometry, Density=3)
volume = Volume(Geometry=sint)  # -> Volume, Centroid
# double click me!
toggle = BooleanToggle(False)
volume_2 = Number(volume.Volume)
expression = Expression(x=volume.Volume, y=target, Expression="Abs(x-y)")
c_script = CSharpScript(Slider="Z", Value="Volume", Target=target, Compute=toggle)  # inputs Slider: String, Value: String, Target: Double, Compute: Boolean
# ---------- c_script: C# ----------
    if (!Compute)
      return;

    if (_solver != null)
      return;

    _solver = new BinarySolver(GrasshopperDocument, Target, Slider, Value);
    GrasshopperDocument.SolutionEnd += HandleSolutionEnd;
# ---------- c_script: C# additional code ----------
  private BinarySolver _solver;

  private void HandleSolutionEnd(object sender, GH_SolutionEventArgs e)
  {
    GrasshopperDocument.SolutionEnd -= HandleSolutionEnd;

    // Just to be nice, let's switch the toggle to false.
    if (Component.Params.Input[3].SourceCount == 1)
    {
      IGH_Param source = Component.Params.Input[3].Sources[0];
      Grasshopper.Kernel.Special.GH_BooleanToggle toggle =
        source as Grasshopper.Kernel.Special.GH_BooleanToggle;
      if (toggle != null)
      {
        if (toggle.Value)
        {
          toggle.Value = false;
          toggle.ExpireSolution(false);
        }
      }
    }

    BinarySolver solver = _solver;
    _solver = null;
    solver.Solve();
  }

  public class BinarySolver
  {
    private readonly GH_Document _doc;
    private readonly double _target;
    private readonly Grasshopper.Kernel.Special.GH_NumberSlider _slider;
    private readonly Grasshopper.Kernel.Parameters.Param_Number _param;
    private readonly int _samples = 6;
    private readonly Dictionary<int, double> _cache = new Dictionary<int, double>();

    public BinarySolver(GH_Document doc, double target, string slider, string param)
    {
      _doc = doc;
      _target = target;

      foreach (IGH_DocumentObject obj in doc.Objects)
        if (_slider == null && obj.NickName.Equals(slider, StringComparison.Ordinal))
          _slider = obj as Grasshopper.Kernel.Special.GH_NumberSlider;

      foreach (IGH_DocumentObject obj in doc.Objects)
        if (_param == null && obj.NickName.Equals(param, StringComparison.Ordinal))
          _param = obj as Grasshopper.Kernel.Parameters.Param_Number;

      if (_slider == null)
        throw new Exception("Slider " + slider + " could not be found");

      if (_param == null)
        throw new Exception("Number parameter " + param + " could not be found");
    }

    public void Solve()
    {
      Rhino.RhinoApp.WriteLine("Grasshopper binary search started.");
      _cache.Clear();

      int tick0 = 0;
      int tick1 = _slider.TickCount;
      int chicken = 0;
      while(chicken < 32)
      {
        chicken++;

        // Divide the current search domain into N subdomains.
        int[] ticks = CreateTickArray(tick0, tick1, _samples);

        // Evaluate all samples and abort if a solution is found.
        double[] values = new double[_samples];
        for (int i = 0; i < _samples; i++)
        {
          values[i] = ComputeValue(ticks[i]);
          if (IsAcceptable(values[i]))
          {
            Rhino.RhinoApp.WriteLine("Grasshopper binary search completed.");
            return;
          }
        }

        // Find the two indices that bound the promising subdomain.
        int index0, index1;
        FindRegion(values, out index0, out index1);
        if (index0 < 0)
          throw new Exception("No suitable search domain could be found.");

        tick0 = ticks[index0];
        tick1 = ticks[index1];

        if (tick0 == tick1 - 1)
        {
          Rhino.RhinoApp.WriteLine("Grasshopper binary search exhausted.");
          return;
        }
      }

      Rhino.RhinoApp.WriteLine("Grasshopper binary search chickened out.");
    }

    private static int[] CreateTickArray(int tick0, int tick1, int samples)
    {
      samples = Math.Min(samples, (tick1 - tick0) + 1);

      int[] ticks = new int[samples];

      ticks[0] = tick0;
      ticks[samples - 1] = tick1;
      for (int i = 1; i < samples - 1; i++)
      {
        double factor = (double) i / samples;
        int offset = (int) (factor * (tick1 - tick0));
        ticks[i] = tick0 + offset;
      }
      return ticks;
    }
    /// <summary>
    /// Find the two indices that bound the most interesting region for the search.
    /// </summary>
    /// <param name="values">Value array.</param>
    /// <param name="index0">Index of lower bounding tick.</param>
    /// <param name="index1">Index of upper bounding tick.</param>
    /// <returns></returns>
    private void FindRegion(double[] values, out int index0, out int index1)
    {
      // The values array may contain lots of consecutive NaNs.
      for (int i = 0; i < values.Length - 1; i++)
      {
        if (double.IsNaN(values[i]))
          continue;

        for (int j = i + 1; j < values.Length; j++)
        {
          //Rhino.RhinoApp.WriteLine(
          //  string.Format("[{0}, {1}] = [{2:0.0}, {3:0.0}]", i, j, values[i], values[j]));

          if (double.IsNaN(values[j]))
            continue;

          if (values[i] < _target && values[j] > _target)
          {
            index0 = i;
            index1 = j;
            return;
          }

          if (values[i] > _target && values[j] < _target)
          {
            index0 = i;
            index1 = j;
            return;
          }

          break;
        }
      }
      index0 = -1;
      index1 = -1;
    }
    /// <summary>
    /// Compute the value associated with a specific slider position.
    /// </summary>
    /// <param name="tick">Slider tick.</param>
    private double ComputeValue(int tick)
    {
      if (_cache.ContainsKey(tick))
        return _cache[tick];

      _slider.TickValue = tick;
      _doc.NewSolution(false);
      double val = ResolveValue();

      _cache.Add(tick, val);
      return val;
    }
    /// <summary>
    /// Resolve what number is inside the target parameter.
    /// All non-null and non-NaN values are averaged. If the
    /// parameter contains no values, NaN is returned.
    /// </summary>
    private double ResolveValue()
    {
      GH_Structure<GH_Number> data = _param.VolatileData as GH_Structure<GH_Number>;

      double number = 0.0;
      int count = 0;

      foreach (GH_Number goo in data.AllData(true))
      {
        if (!Rhino.RhinoMath.IsValidDouble(goo.Value))
          continue;

        number += goo.Value;
        count++;
      }

      // This is a problem, the algorithm actually isn't equipped to deal with NaNs yet...
      if (count == 0)
        return double.NaN;

      return number / count;
    }
    /// <summary>
    /// Tests whether a specific value is close enough.
    /// This can be made customizable.
    /// </summary>
    private bool IsAcceptable(double number)
    {
      return Math.Abs(number - _target) < 1e-2;
    }
  }
# ---------- end c_script ----------
gradient = Gradient(
    LowerLimit=0,
    UpperLimit=800,
    Parameter=expression,
    stops=[0: RGB(11, 161, 11), 0.5: RGB(255, 239, 97), 1: RGB(209, 10, 10)])
format = Format(Format="{0:0.0} m³", Culture=127, Data0=volume.Volume)
tag = TextTag3D(Location=PlaneXY(20, 4, 0), Text=format, Size=2, Colour=gradient, Justification=7)
