# Grasshopper definition Bolt Generation.gh (Grasshopper 1.0.7)

no_of_points = Slider(30, range=0..100)
bolt_spacing = Slider(2, range=0..10)
length = Slider(8, range=0..8)
inclination = Slider(45, range=0..90)
azimuth = Slider(68, range=0..360)
grid_point = Point(<point referenced from the Rhino model>)
bolted_surfaces = Surface([<surface referenced from the Rhino model> x6])
rectangle = Rectangle(Plane=PlaneXY(0, 0, 0), XSize=bolt_spacing, YSize=bolt_spacing, Radius=0)  # -> Rectangle, Length
unit_z = UnitZ(Factor=1)
rectangular_array = RectangularArray(Geometry=grid_point, Cell=rectangle.Rectangle, XCount=no_of_points, YCount=no_of_points)  # -> Geometry, Transform
project_point = ProjectPoint(Point=rectangular_array.Geometry, Direction=unit_z, Geometry=graft(bolted_surfaces))  # -> Point, Index
radians = Radians(Degrees=inclination)
deconstruct = Deconstruct(Point=project_point.Point)  # -> XComponent, YComponent, ZComponent
cosine = Cosine(Value=radians)
multiplication = Multiplication(A=length, B=cosine)
sine = Sine(Value=radians)
addition = Addition(A=deconstruct.ZComponent, B=multiplication)
multiplication_2 = Multiplication(A=length, B=sine)
radians_2 = Radians(Degrees=azimuth)
radians_3 = Radians(Degrees=azimuth)
cosine_2 = Cosine(Value=radians_2)
sine_2 = Sine(Value=radians_3)
multiplication_3 = Multiplication(A=cosine_2, B=multiplication_2)
multiplication_4 = Multiplication(A=sine_2, B=multiplication_2)
multiplication_5 = Multiplication(A=cosine_2, B=multiplication)
addition_2 = Addition(A=multiplication_3, B=deconstruct.YComponent)
addition_3 = Addition(A=multiplication_4, B=deconstruct.XComponent)
construct_point = ConstructPoint(XCoordinate=addition_3, YCoordinate=addition_2, ZCoordinate=addition)
line = Line(StartPoint=construct_point, EndPoint=project_point.Point)
