# Grasshopper definition Bolt to 3DECv7 Command 3 .gh (Grasshopper 1.0.7)
# plug-ins: Human

geo = Geometry()
number_slider = Slider(4, range=0..10)
layertable = LayerTable(Update=True, AutoUpdate=False)  # -> Layers, FullLayerPaths, LayerColors, Linetypes, MaterialNames, Visible, PrintWidth, PrintColor
id = Guid(geo)
spacing = Slider(1.5, range=0..10)
python = PythonScript(rhinoObjId=id)  # -> BoltLength, LayerName
# ---------- python: Python ----------
import Rhino

rhinoObj = Rhino.RhinoDoc.ActiveDoc.Objects.Find(rhinoObjId)
index = rhinoObj.Attributes.LayerIndex
LayerName = Rhino.RhinoDoc.ActiveDoc.Layers[index].Name

Spans = ['Span <=6','Span >6 <=9','Span >9 <=11','Span >11 <=16','Span >16 <=18','Span >18 <=22','Span >22 <=27','Span >27 <=32']
Lengths = [1.5,2.4,3,4,5,6,7,8]
BoltLength = Lengths[Spans.index(LayerName)]
# ---------- end python ----------
facen = FaceNormals(Mesh=geo)  # -> simplify(Centers), Normals
split = SplitList(List=layertable.Layers, Index=number_slider)  # -> ListA, ListB
split_2 = SplitList(List=layertable.LayerColors, Index=number_slider)  # -> ListA, ListB
cluster = Cluster_2(G=geo, L=spacing)
cp = ClosestPoint(Point=cluster, Cloud=facen.Centers)  # -> ClosestPoint, CPIndex, Distance
Z = UnitZ(Factor=1)
mindex = MemberIndex(Set=split.ListB, Member=python.LayerName)  # -> simplify(Index), Count
item = ListItem(List=facen.Normals, Index=cp.CPIndex, Wrap=True)
item_2 = ListItem(List=split_2.ListB, Index=mindex.Index, Wrap=True)
devec = DeconstructVector(Vector=item)  # -> simplify(XComponent), simplify(YComponent), simplify(ZComponent)
smaller = SmallerThan(FirstNumber=devec.ZComponent, SecondNumber=Slider(0, range=0..100))  # -> SmallerThan, OrEqualTo
sift = SiftPattern(List=item, SiftPattern=smaller.SmallerThan)  # -> Output0, Output1
neg = Negative(Value=sift.Output1)
combine = CombineData(Input0=sift.Output0, Input1=neg)  # -> simplify(Result), Index
line = LineSDL(Start=cluster, Direction=combine.Result, Length=graft(python.BoltLength))
bakeattributes = CSharpScript(objs=simplify(line), names=simplify(graft(python.LayerName)), activate=Button())  # -> out; inputs objs: list, names: list of String, layers: list of String, colors: list of Color, pWidths: list of Double, wiresEach: list of Int32, materials: list, activate: Boolean, groupListTgthr: Boolean
# ---------- bakeattributes: C# ----------
    //Inserts geometry into the Rhino document, with custom attributes
    //Written by Giulio Piacentino
    //Version written 2011 10 18 - for Grasshopper 0.8.52

    if (activate)
    {
      int groupIndex = -1;
      if(groupListTgthr)
        groupIndex = doc.Groups.Add();

      for(int i = 0; i < objs.Count; i++)
      {
        object obj = objs[i];
        if(obj == null)
        {
          Print("No object to bake");
          return;
        }

        //Make new attribute to set name
        Rhino.DocObjects.ObjectAttributes att = new Rhino.DocObjects.ObjectAttributes();

        string name = names.Count > 0 ? names[i % names.Count] : null;
        //Set object name
        if(!string.IsNullOrEmpty(name))
        {
          att.Name = name;
        }

        Color color = colors.Count > 0 ? colors[i % colors.Count] : new Color();
        //Set color
        if(!color.IsEmpty)
        {
          att.ColorSource = Rhino.DocObjects.ObjectColorSource.ColorFromObject; //Make the color type "by object"
          att.ObjectColor = color;

          att.PlotColorSource = Rhino.DocObjects.ObjectPlotColorSource.PlotColorFromObject; //Make the plot color type "by object"
          att.PlotColor = color;
        }

        string layer = layers.Count > 0 ? layers[i % layers.Count] : null;
        //Set layer
        if(!string.IsNullOrEmpty(layer) && Rhino.DocObjects.Layer.IsValidName(layer))
        {
          //Get the current layer index
          Rhino.DocObjects.Tables.LayerTable layerTable = doc.Layers;
          int layerIndex = layerTable.Find(layer, true);

          if(layerIndex < 0) //This layer does not exist, we add it
          {
            Rhino.DocObjects.Layer onlayer = new Rhino.DocObjects.Layer(); //Make a new layer
            onlayer.Name = layer;

            layerIndex = layerTable.Add(onlayer); //Add the layer to the layer table
            if (layerIndex > -1) //We manged to add layer!
            {
              att.LayerIndex = layerIndex;
              Print("Added new layer to the document at position " + layerIndex + " named " + layer + ". ");
            } else
              Print("Layer did not add. Try cleaning up your layers."); //This never happened to me.
          }
          else
            att.LayerIndex = layerIndex; //We simply add to the existing layer
        }


        double pWidth = pWidths.Count > 0 ? pWidths[i % pWidths.Count] : 0;
        //Set plotweight
        if(pWidth > 0)
        {
          att.PlotWeightSource = Rhino.DocObjects.ObjectPlotWeightSource.PlotWeightFromObject;
          att.PlotWeight = pWidth;
        }


        object material = materials.Count > 0 ? materials[i % materials.Count] : null;
        //Set material
        bool materialByName = !string.IsNullOrEmpty(material as string);
        Rhino.Display.DisplayMaterial inMaterial = material as Rhino.Display.DisplayMaterial;
        if(material is Color)
        {
          inMaterial = new Rhino.Display.DisplayMaterial((Color) material);
        }
        if(material != null && inMaterial == null && !materialByName)
        {
          if(!(material is string))
          {
            try //We also resort to try with IConvertible
            {
              inMaterial = (Rhino.Display.DisplayMaterial) Convert.ChangeType(material, typeof(Rhino.Display.DisplayMaterial));
            }
            catch(InvalidCastException)
            {
            }
          }
        }
        if(inMaterial != null || materialByName)
        {
          string matName;

          if(!materialByName)
          {
            matName = string.Format("A:{0}-D:{1}-E:{2}-S:{3},{4}-T:{5}",
              Format(inMaterial.Ambient),
              Format(inMaterial.Diffuse),
              Format(inMaterial.Emission),
              Format(inMaterial.Specular),
              inMaterial.Shine.ToString(),
              inMaterial.Transparency.ToString()
              );
          }
          else
          {
            matName = (string) material;
          }

          int materialIndex = doc.Materials.Find(matName, true);
          if(materialIndex < 0 && !materialByName) //Material does not exist and we have its specs
          {
            materialIndex = doc.Materials.Add(); //Let's add it
            if(materialIndex > -1)
            {
              Print("Added new material at position " + materialIndex + " named \"" + matName + "\". ");
              Rhino.DocObjects.Material m = doc.Materials[materialIndex];
              m.Name = matName;
              m.AmbientColor = inMaterial.Ambient;
              m.DiffuseColor = inMaterial.Diffuse;
              m.EmissionColor = inMaterial.Emission;
              //m.ReflectionColor = no equivalent
              m.SpecularColor = inMaterial.Specular;
              m.Shine = inMaterial.Shine;
              m.Transparency = inMaterial.Transparency;
              //m.TransparentColor = no equivalent
              m.CommitChanges();

              att.MaterialSource = Rhino.DocObjects.ObjectMaterialSource.MaterialFromObject;
              att.MaterialIndex = materialIndex;
            }
            else
              Print("Material did not add. Try cleaning up your materials."); //This never happened to me.
          }
          else if(materialIndex < 0 && materialByName) //Material does not exist and we do not have its specs. We do nothing
          {
            Print("Warning: material name not found. I cannot set the source to this material name. Add a material with name: " + matName);
          }
          else
          {
            //If this material exists, we do not replace it!
            att.MaterialSource = Rhino.DocObjects.ObjectMaterialSource.MaterialFromObject;
            att.MaterialIndex = materialIndex;
          }
        }


        int wires = wiresEach.Count > 0 ? wiresEach[i % wiresEach.Count] : 0;
        //Set wire density
        if(wires == -1 || wires > 0)
        {
          att.WireDensity = wires;
        }

        Bake(obj, att, groupIndex);
      }
    }
    else
    {
      Print("Inactive");
    }
# ---------- bakeattributes: C# additional code ----------
  void Bake(object obj, Rhino.DocObjects.ObjectAttributes att, int groupIndex)
  {
    if(obj == null)
      return;

    Guid id;

    //Bake to the right type of object
    if(obj is GeometryBase)
    {
      GeometryBase geomObj = obj as GeometryBase;

      switch(geomObj.ObjectType)
      {
        case Rhino.DocObjects.ObjectType.Brep:
          id = doc.Objects.AddBrep(obj as Brep, att);
          break;
        case Rhino.DocObjects.ObjectType.Curve:
          id = doc.Objects.AddCurve(obj as Curve, att);
          break;
        case Rhino.DocObjects.ObjectType.Point:
          id = doc.Objects.AddPoint((obj as Rhino.Geometry.Point).Location, att);
          break;
        case Rhino.DocObjects.ObjectType.Surface:
          id = doc.Objects.AddSurface(obj as Surface, att);
          break;
        case Rhino.DocObjects.ObjectType.Mesh:
          id = doc.Objects.AddMesh(obj as Mesh, att);
          break;
        case (Rhino.DocObjects.ObjectType) 1073741824://Rhino.DocObjects.ObjectType.Extrusion:
          id = (Guid) typeof(Rhino.DocObjects.Tables.ObjectTable).InvokeMember("AddExtrusion", BindingFlags.Instance | BindingFlags.InvokeMethod, null, doc.Objects, new object[]{obj, att});
          break;
        case Rhino.DocObjects.ObjectType.PointSet:
          id = doc.Objects.AddPointCloud(obj as Rhino.Geometry.PointCloud, att); //This is a speculative entry
          break;
        default:
          Print("The script does not know how to handle this type of geometry: " + obj.GetType().FullName);
          return;
      }
    }
    else
    {
      Type objectType = obj.GetType();

      if(objectType == typeof(Arc))
      {
        id = doc.Objects.AddArc((Arc) obj, att);
      }
      else if(objectType == typeof(Box))
      {
        id = doc.Objects.AddBrep(((Box) obj).ToBrep(), att);
      }
      else if(objectType == typeof(Circle))
      {
        id = doc.Objects.AddCircle((Circle) obj, att);
      }
      else if(objectType == typeof(Ellipse))
      {
        id = doc.Objects.AddEllipse((Ellipse) obj, att);
      }
      else if(objectType == typeof(Polyline))
      {
        id = doc.Objects.AddPolyline((Polyline) obj, att);
      }
      else if(objectType == typeof(Sphere))
      {
        id = doc.Objects.AddSphere((Sphere) obj, att);
      }
      else if(objectType == typeof(Point3d))
      {
        id = doc.Objects.AddPoint((Point3d) obj, att);
      }
      else if(objectType == typeof(Line))
      {
        id = doc.Objects.AddLine((Line) obj, att);
      }
      else if(objectType == typeof(Vector3d))
      {
        Print("Impossible to bake vectors");
        return;
      }
      else if(obj is IEnumerable)
      {
        int newGroupIndex;
        if(groupIndex == -1)
          newGroupIndex = doc.Groups.Add();
        else
          newGroupIndex = groupIndex;
        foreach(object o in obj as IEnumerable)
        {
          Bake(o, att, newGroupIndex);
        }
        return;
      }
      else
      {
        Print("Unhandled type: " + objectType.FullName);
        return;
      }
    }

    if(groupIndex != -1)
    {
      doc.Groups.AddToGroup(groupIndex, id);
      Print("Added " + obj.GetType().Name + " to group number " + groupIndex);
    }
    else
      Print("Added " + obj.GetType().Name);
  }

  static string Format(Color c)
  {
    return (new System.Text.StringBuilder("A")).Append(c.A.ToString()).Append("R").Append(c.R.ToString()).Append("G")
      .Append(c.G.ToString()).Append("B").Append(c.B.ToString()).ToString();
  }
# ---------- end bakeattributes ----------
previewlw = CustomPreviewLineweights(Geometry=line, Shader=item_2, Thickness=Slider(2, range=0..10), Absolute=False)

crv = Curve([<curve referenced from the Rhino model> x842])
group = Panel("Stage6")
cluster_2 = Cluster(group=group, segments=Slider(5, range=0..10), cables=crv)
panel = Panel(cluster_2)
group_2 = Panel("Stage1")
cluster_3 = Cluster(group=group_2, segments=Slider(5, range=0..10), cables=line)
panel_2 = Panel(cluster_3)

# ==== cluster Cluster
cables = ClusterInput()
crv = Curve(cables)
end = EndPoints(Curve=crv)  # -> Start, End
pdecon = Deconstruct(Point=end.End)  # -> XComponent, YComponent, ZComponent
pdecon_2 = Deconstruct(Point=end.Start)  # -> XComponent, YComponent, ZComponent
smaller = SmallerThan(FirstNumber=pdecon_2.ZComponent, SecondNumber=pdecon.ZComponent)  # -> SmallerThan, OrEqualTo
dispatch = Dispatch(List=crv, DispatchPattern=smaller.SmallerThan)  # -> ListA, ListB
flip = FlipCurve(Curve=dispatch.ListB)  # -> Curve, Flag
end_2 = EndPoints(Curve=[dispatch.ListA, flip.Curve])  # -> Start, End
pt = Point(end_2.Start)
pdecon_3 = Deconstruct(Point=end_2.Start)  # -> XComponent, YComponent, ZComponent
pdecon_4 = Deconstruct(Point=end_2.End)  # -> XComponent, YComponent, ZComponent
expression = Expression(
    x2=pdecon_4.XComponent,
    y2=pdecon_4.YComponent,
    z2=pdecon_4.ZComponent,
    Expression="Format(\"{0:0.000} {1:0.000} {2:0.000}\", x2, y2, z2)")
expression_2 = Expression(
    x1=pdecon_3.XComponent,
    y1=pdecon_3.YComponent,
    z1=pdecon_3.ZComponent,
    Expression="Format(\"{0:0.000} {1:0.000} {2:0.000}\", x1, y1, z1)")
group = ClusterInput()
segments = ClusterInput()
expression_3 = Expression(
    group=group,
    segments=segments,
    node1=expression_2,
    node2=expression,
    Expression="\"struct cable create by-line \" & node1 & \" \" & node2 & \" group '\" & group & \"' slot 'Cables' seg \" & segments")
result = ClusterOutput(expression_3)

# ==== cluster Cluster_2
accuracy = Panel("100")
G = ClusterInput()
range = Range(Domain="PI/2", Steps=accuracy)
xy = XYPlane(Origin=Point(0, 0, 0))
prot = RotatePlane(Plane=xy, Angle=range)
brec = BoundingRectangle(Geometry=G, Plane=prot, Axis=0, Slide=0, Union=Toggle(False))  # -> Bounding, DimensionX, DimensionY
flip = FlipMatrix(Data=brec.Bounding)
area = Area(Geometry=flip)  # -> Area, Centroid
sort = SortList(Keys=area.Area, ValuesA=flip)  # -> Keys, ValuesA
item = ListItem(List=sort.ValuesA, Index=0, Wrap=True)
minimum_2d_bounding_box = Surface(item)
cp = ControlPoints(Curve=minimum_2d_bounding_box)  # -> simplify(Points), Weights, Knots
item_2 = ListItem(List=cp.Points, Index=Slider(0, range=0..100), Wrap=True)
item_3 = ListItem(List=cp.Points, Index=Slider(1, range=0..100), Wrap=True)
item_4 = ListItem(List=cp.Points, Index=Slider(2, range=0..100), Wrap=True)
ln = Line(StartPoint=item_3, EndPoint=item_4)
ln_2 = Line(StartPoint=item_2, EndPoint=item_3)
L = ClusterInput()
unit = UnitVector(Vector=ln)
len = Length(Curve=ln)
divlength = DivideLength(Curve=ln_2, Length=L)  # -> simplify(Points), Tangents, Parameters
division = Division(A=len, B=L)
multiplication = Multiplication(A=L, B=unit)
expression = Expression(x=division, Expression="x+1")
Z = UnitZ(Factor=1)
Z_2 = UnitZ(Factor=1)
arrlinear = LinearArray(Geometry=divlength.Points, Direction=multiplication, Count=expression)  # -> Geometry, Transform
neg = Negative(Value=Z_2)
pshift = ShiftPaths(Data=arrlinear.Geometry, Offset=-1)
move = Move(Geometry=pshift, Motion=neg)  # -> Geometry, Transform
project = ProjectPoint(Point=move.Geometry, Direction=Z, Geometry=graft(G))  # -> Point, Index
null = NullItem(Item=project.Point)  # -> NullFlags, InvalidFlags, Description
dispatch = Dispatch(List=project.Point, DispatchPattern=null.NullFlags)  # -> ListA, ListB
B = ClusterOutput(dispatch.ListB)
