# Grasshopper definition Boreholes_R2.gh (Grasshopper 1.0.7)

boundary = Curve(<curve referenced from the Rhino model>)

# ---- group: Import Geology.csv
path = FilePath("C:\Users\Daniel.Schutt\Desktop\INB\GEOLOGICAL DATA\dhd_geology.csv")
file = ReadFile(File=path, PerLineParse=True)
split = TextSplit(Text=file, Separators=",")
flip = FlipMatrix(Data=split)
cull_i = CullIndex(List=flip, Indices=0, Wrap=False)
geology = ExplodeTree(Data=cull_i)  # -> _0000, _0010, _0020, _0030, _0040, _0050, _0060

# ---- group: Import Collar.csv
path_2 = FilePath("C:\Users\Daniel.Schutt\Desktop\INB\GEOLOGICAL DATA\dhd_collar.csv")
file_2 = ReadFile(File=path_2, PerLineParse=True)
split_2 = TextSplit(Text=file_2, Separators=",")
flip_2 = FlipMatrix(Data=split_2)
cull_i_2 = CullIndex(List=flip_2, Indices=0, Wrap=False)
collar = ExplodeTree(Data=cull_i_2)  # -> _0000, _0010, _0020, _0030, _0040, _0050, _0060

# ---- group: Filter boreholes inside search domain
pt = ConstructPoint(XCoordinate=collar._0010, YCoordinate=collar._0020, ZCoordinate=collar._0030)
incurve = PointInCurve(Point=pt, Curve=boundary)  # -> Relationship, Point
equals = Equality(FirstNumber="2", SecondNumber=incurve.Relationship)  # -> Equality, Inequality
sift = SiftPattern(List=collar._0000, SiftPattern=equals.Equality)  # -> Output0, Output1
clean = CleanTree(RemoveNulls=True, RemoveInvalid=True, RemoveEmpty=False, Tree=sift.Output1)

# ---- group: Import Survey.csv
path_3 = FilePath("C:\Users\Daniel.Schutt\Desktop\INB\GEOLOGICAL DATA\dhd_survey.csv")
file_3 = ReadFile(File=path_3, PerLineParse=True)
split_3 = TextSplit(Text=file_3, Separators=",")
flip_3 = FlipMatrix(Data=split_3)
cull_i_3 = CullIndex(List=flip_3, Indices=0, Wrap=False)
survey = ExplodeTree(Data=cull_i_3)  # -> _0000, _0010, _0020, _0030
python = GhPythonScript(x=clean, y=survey._0000)  # -> out, a; inputs y: list
# ---------- python: Python ----------
__author__ = "Daniel.Schutt"
__version__ = "2020.08.21"

import rhinoscriptsyntax as rs

a = [True if j.strip() == x.strip() else False for j in y]
# ---------- end python ----------
c_script = CSharpScript(x=python.a)  # -> A
# ---------- c_script: C# ----------
    A = x;
# ---------- end c_script ----------
cluster = Cluster(list=survey._0000, sift_pattern=c_script)
cluster_2 = Cluster(list=survey._0010, sift_pattern=c_script)
cluster_3 = Cluster(list=survey._0020, sift_pattern=c_script)
cluster_4 = Cluster(list=survey._0030, sift_pattern=c_script)

# ---- group: Import Geology.csv (continued)
python_2 = GhPythonScript(x=clean, y=geology._0000)  # -> out, a; inputs y: list; same code as python
c_script_2 = CSharpScript(x=python_2.a)  # -> A; same code as c_script
cluster_5 = Cluster(list=geology._0000, sift_pattern=c_script_2)
cluster_6 = Cluster(list=geology._0020, sift_pattern=c_script_2)
cluster_7 = Cluster(list=geology._0030, sift_pattern=c_script_2)
cluster_8 = Cluster(list=geology._0060, sift_pattern=c_script_2)

# ---- group: Import Collar.csv (continued)
sift_2 = SiftPattern(List=cull_i_2, SiftPattern=equals.Equality)  # -> Output0, Output1
clean_2 = CleanTree(RemoveNulls=True, RemoveInvalid=True, RemoveEmpty=False, Tree=sift_2.Output1)
bang = ExplodeTree(Data=clean_2)  # -> _0000, _0010, _0020, _0030, _0040, _0050, _0060

# ----
entwine = Entwine(Branch0X=cluster_5, Branch1X=cluster_6, Branch2X=cluster_7, Branch3X=cluster_8, FlattenInputs=False)  # -> simplify(Result)
entwine_2 = Entwine(
    Branch00=bang._0000,
    Branch01=bang._0010,
    Branch02=bang._0020,
    Branch03=bang._0030,
    Branch04=cluster_3,
    Branch05=cluster_4,
    Branch06=cluster_2,
    FlattenInputs=True)

# ---- group: Borehole unit vector
panel = Panel("""{0;4}
{0;5}""")
branch = TreeBranch(Tree=entwine_2, Path=panel, MaintainPaths=False)
bang_2 = ExplodeTree(Data=branch)  # -> Branch0, Branch1
python_3 = GhPythonScript(x=bang_2.Branch1)  # -> a
# ---------- python_3: Python ----------
__author__ = "Daniel.Schutt"
__version__ = "2020.08.20"

import rhinoscriptsyntax as rs
import math as m

theta = (1.0/180.0*float(x))*1j
e = m.e.real
dip_direction = e**(m.pi.real*(0.5j - theta))
a = dip_direction.real, dip_direction.imag
# ---------- end python_3 ----------
rad = Radians(Degrees=bang_2.Branch0)
flip_4 = FlipMatrix(Data=python_3)
sin = Sine(Value=rad)
cos = Cosine(Value=rad)
bang_3 = ExplodeTree(Data=flip_4)  # -> Branch0, Branch1
multiplication = Multiplication(A=bang_3.Branch0, B=cos)
multiplication_2 = Multiplication(A=bang_3.Branch1, B=cos)
borehole_orientation_unit_vector = VectorXYZ(XComponent=multiplication, YComponent=multiplication_2, ZComponent=sin)  # -> Vector, Length

# ---- group: Borehole Collar
panel_2 = Panel("""{0;6}
{0;1}
{0;2}
{0;3}""")
branch_2 = TreeBranch(Tree=entwine_2, Path=panel_2, MaintainPaths=False)
bang_4 = ExplodeTree(Data=branch_2)  # -> Branch0, Branch1, Branch2, Branch3
bh = ConstructPoint(XCoordinate=bang_4.Branch1, YCoordinate=bang_4.Branch2, ZCoordinate=bang_4.Branch3)

# ----
split_4 = SplitTree(Data=entwine, Masks=flatten("{0;?}"))  # -> Positive, Negative
lng = ListLength(List=split_4.Positive)

# ---- group: Boreholes
split_5 = SplitTree(Data=entwine, Masks=flatten("{1;?}"))  # -> Positive, Negative
split_6 = SplitTree(Data=entwine, Masks=flatten("{2;?}"))  # -> Positive, Negative
stack = StackData(Data=graft(bh), Stack=lng)
stack_2 = StackData(Data=graft(borehole_orientation_unit_vector.Vector), Stack=lng)
split_7 = SplitTree(Data=entwine, Masks=flatten("{3;?}"))  # -> Positive, Negative
split_8 = SplitTree(Data=entwine, Masks=flatten("{0;?}"))  # -> Positive, Negative
multiplication_3 = Multiplication(A=split_5.Positive, B=stack_2)
subtraction = Subtraction(A=split_6.Positive, B=split_5.Positive)
addition = Addition(A=stack, B=multiplication_3)
multiplication_4 = Multiplication(A=subtraction, B=stack_2)
circle = CircleCNR(Center=addition, Normal=stack_2, Radius="0.5")
extr = Extrude(Base=circle, Direction=multiplication_4)
cap = CapHoles(Brep=extr)

# ---- group: Add geology layers
cset = CreateSet(List=flatten(split_7.Positive))  # -> Set, Map
python_4 = GhPythonScript(x=cset.Set)
# ---------- python_4: Python ----------
__author__ = "Daniel.Schutt"
__version__ = "2020.08.23"

import rhinoscriptsyntax as rs

import Rhino
import scriptcontext
import System.Guid, System.Drawing.Color

def AddLayer(layer_name):
    # Cook up an unused layer name
    scriptcontext.doc = Rhino.RhinoDoc.ActiveDoc

    # Is the layer name valid?
    if not Rhino.DocObjects.Layer.IsValidName(layer_name):
        print layer_name, "is not a valid layer name."
        return Rhino.Commands.Result.Cancel

    # Does a layer with the same name already exist?
    layer_index = scriptcontext.doc.Layers.Find(layer_name, True)
    if layer_index>=0:
        print "A layer with the name", layer_name, "already exists."
        return Rhino.Commands.Result.Cancel

    # Add a new layer to the document
    layer_index = scriptcontext.doc.Layers.Add(layer_name, System.Drawing.Color.Black)
    if layer_index<0:
        print "Unable to add", layer_name, "layer."
        return Rhino.Commands.Result.Failure

    return Rhino.Commands.Result.Success

AddLayer(x)
# ---------- end python_4 ----------
panel_3 = Panel(cset.Set)

# ---- group: Bake Borehole Geometry
vb = VBScript(obj=cap, lay=split_7.Positive, bhid=split_8.Positive, b=Toggle(False))  # -> out, A
# ---------- vb: VB ----------
    If b Then
      Dim lay_index As Int32 = doc.Layers.Find(lay, True)
      If (lay_index < 0) Then
        lay_index = doc.Layers.Add(lay)
      End If

      Dim att As New DocObjects.ObjectAttributes()
      att.LayerIndex = lay_index
      att.Name = bhid

      A = doc.Objects.AddBrep(obj, att)

    End If
# ---------- end vb ----------
panel_4 = Panel(vb.A)

# ==== cluster Cluster
list = ClusterInput()
sift_pattern = ClusterInput()
sift_pattern_2 = SiftPattern(List=simplify(list), SiftPattern=sift_pattern)  # -> Output0, Output1
clean_tree = CleanTree(RemoveNulls=True, RemoveInvalid=True, RemoveEmpty=False, Tree=sift_pattern_2.Output1)
tree = ClusterOutput(clean_tree)
