# Grasshopper definition Circles.gh (Grasshopper 1.0.7)
# plug-ins: Firefly.X

timer = Timer(TimerInterval=100, Target=c_script)
dip_direction = Slider(272, range=0..360)
c_script = CSharpScript()  # -> out, A
# ---------- c_script: C# ----------
    if (toggle == false)
      toggle = true;
    else
      toggle = false;
    A = toggle;
# ---------- c_script: C# additional code ----------
  bool toggle = false;
# ---------- end c_script ----------
curve = Curve(graft([<curve referenced from the Rhino model> x55]))
construct_domain = ConstructDomain(DomainStart=Slider(30, range=0..100), DomainEnd=Slider(330, range=0..1000))
turn_counter_off = BooleanToggle(False)
control_points = ControlPoints(Curve=curve)  # -> Points, Weights, Knots
polygon_center = PolygonCenter(Polyline=curve)  # -> CenterV, CenterE, CenterA
counter = Counter(
    CountDirection=Toggle(True),
    Step=Slider(10, range=0..10),
    StartStop=c_script.A,
    Reset=turn_counter_off,
    OptionalCounterDomain=construct_domain)
point = Point(<point referenced from the Rhino model>)
segment_lengths = SegmentLengths(Curve=curve)  # -> ShortestLength, ShortestDomain, LongestLength, LongestDomain
use_conunter = BooleanToggle(True)
construct_mesh = ConstructMesh(Vertices=control_points.Points, Faces={A=0, B=1, C=2, D=3})
mesh = Mesh(<mesh referenced from the Rhino model>)
custom_preview = CustomPreview(
    Geometry=polygon_center.CenterV,
    Material={diffuse=RGB(221, 160, 221), emission=RGB(66, 48, 66), shine=0.5, specular=RGB(255, 255, 255), transparency=0})
division = Division(A=segment_lengths.LongestLength, B=Slider(2, range=0..10))
face_normals = FaceNormals(Mesh=construct_mesh)  # -> Centers, Normals
panel = Panel(counter)
deconstruct_mesh = DeconstructMesh(Mesh=mesh)  # -> Vertices, Faces, Colours, Normals
expression = Expression(x=use_conunter, y=dip_direction, z=counter, Expression="If(x = false, y, z)")
range = Slider(30, range=0..30)
range_2 = Slider(45, range=0..45)
dip_angle = Slider(45, range=0..90)
deconstruct_vector = DeconstructVector(Vector=face_normals.Normals)  # -> XComponent, YComponent, ZComponent
circle_cnr = CircleCNR(Center=polygon_center.CenterV, Normal=face_normals.Normals, Radius=division)
deconstruct_vector_2 = DeconstructVector(Vector=deconstruct_mesh.Normals)  # -> XComponent, YComponent, ZComponent
subtraction = Subtraction(A=expression, B=range)
addition = Addition(A=expression, B=range)
division_2 = Division(A=deconstruct_vector.XComponent, B=deconstruct_vector.YComponent)
arcsine = ArcSine(Value=deconstruct_vector.ZComponent)
expression_2 = Expression(x=deconstruct_vector.YComponent, Expression="If(x > 0, 90, 270)")
addition_2 = Addition(A=dip_angle, B=range_2)
subtraction_2 = Subtraction(A=dip_angle, B=range_2)
boundary_surfaces = BoundarySurfaces(Edges=circle_cnr)
arctangent = ArcTangent(Value=division_2)
division_3 = Division(A=deconstruct_vector_2.XComponent, B=deconstruct_vector_2.YComponent)
expression_3 = Expression(x=subtraction, Expression="If(x < 0, 360+x, if(x > 360, x-360,x))")
expression_4 = Expression(x=addition, Expression="If(x < 0, 360+x, if(x > 360, x-360,x))")
arcsine_2 = ArcSine(Value=deconstruct_vector_2.ZComponent)
degrees = Degrees(Radians=arcsine)
expression_5 = Expression(x=deconstruct_vector_2.YComponent, Expression="If(x > 0, 90, 270)")
expression_6 = Expression(x=addition_2, Expression="If(x > 90, 90, x)")
expression_7 = Expression(x=subtraction_2, Expression="If(x < 0, 0, x)")
arctangent_2 = ArcTangent(Value=division_3)
degrees_2 = Degrees(Radians=arctangent)
mesh_brep = MeshBrep(
    Brep=boundary_surfaces,
    Settings={GridMaxCount=0, GridMinCount=16, JaggedSeams=False, MaxEdgeLength=0, MinEdgeLength=0.0001, MinTolerance=0, Refine=True, RefineAngle=0, RelativeTolerance=0.65, SimplePlanes=True, Tolerance=0})
degrees_3 = Degrees(Radians=arcsine_2)
expression_8 = Expression(x=degrees, Expression="If(x > 0, 90-x, 90+x)")
degrees_4 = Degrees(Radians=arctangent_2)
addition_3 = Addition(A=degrees_2, B=expression_2)
expression_9 = Expression(x=subtraction, Expression="If(x < 0, 360+x, if(x > 360, x-360,x))")
expression_10 = Expression(x=addition, Expression="If(x < 0, 360+x, if(x > 360, x-360,x))")
construct_domain_2 = ConstructDomain(DomainStart=expression_7, DomainEnd=expression_6)
expression_11 = Expression(x=degrees_3, Expression="If(x > 0, 90-x, 90+x)")
larger_than = LargerThan(FirstNumber=expression_3, SecondNumber=expression_4)  # -> LargerThan, OrEqualTo
addition_4 = Addition(A=degrees_4, B=expression_5)
set_union = SetUnion(SetA=expression_3, SetB=expression_4)
expression_12 = Expression(x=addition_3, y=degrees, Expression="If(y > 0, If(x > 180, x - 180, x + 180), x) ")
bounds = Bounds(Numbers=set_union)
includes = Includes(Value=expression_8, Domain=construct_domain_2)  # -> Includes, Deviation
expression_13 = Expression(x=addition_4, y=degrees_3, Expression="If(y > 0, If(x > 180, x - 180, x + 180), x) ")
construct_domain_3 = ConstructDomain(DomainStart=expression_3, DomainEnd=expression_4)
concatenate = Concatenate(FragmentA="Dip Directon = ", FragmentB=construct_domain_3)
text_tag = TextTag(Location=point, Text=concatenate)
includes_2 = Includes(Value=expression_11, Domain=construct_domain_2)  # -> Includes, Deviation
deconstruct_domain = DeconstructDomain(Domain=bounds)  # -> Start, End
set_union_2 = SetUnion(SetA=expression_9, SetB=expression_10)
larger_than_2 = LargerThan(FirstNumber=expression_9, SecondNumber=expression_10)  # -> LargerThan, OrEqualTo
construct_domain_4 = ConstructDomain(DomainStart=deconstruct_domain.End, DomainEnd=Slider(360, range=0..1000))
construct_domain_5 = ConstructDomain(DomainStart=Slider(0, range=0..100), DomainEnd=deconstruct_domain.Start)
bounds_2 = Bounds(Numbers=set_union_2)
number_slider = Slider(360, range=0..1000)
number_slider_2 = Slider(0, range=0..100)
number_slider_3 = Slider(90, range=0..100)
construct_domain_6 = ConstructDomain(DomainStart=expression_9, DomainEnd=expression_10)
deconstruct_domain_2 = DeconstructDomain(Domain=bounds_2)  # -> Start, End
includes_3 = Includes(Value=expression_12, Domain=construct_domain_5)  # -> Includes, Deviation
includes_4 = Includes(Value=expression_12, Domain=construct_domain_4)  # -> Includes, Deviation
includes_5 = Includes(Value=expression_12, Domain=construct_domain_3)  # -> Includes, Deviation
construct_domain_7 = ConstructDomain(DomainStart=deconstruct_domain_2.End, DomainEnd=Slider(360, range=0..1000))
construct_domain_8 = ConstructDomain(DomainStart=Slider(0, range=0..100), DomainEnd=deconstruct_domain_2.Start)
gradient = Gradient(
    LowerLimit=number_slider_2,
    UpperLimit=number_slider_3,
    Parameter=expression_8,
    stops=[0: RGB(234, 38, 0), 0.25: RGB(234, 126, 0), 0.5: RGB(254, 244, 84), 0.75: RGB(173, 203, 249), 1: RGB(75, 107, 169)])
gradient_2 = Gradient(
    LowerLimit=number_slider_2,
    UpperLimit=number_slider,
    Parameter=expression_12,
    stops=[0: RGB(234, 38, 0), 0.25: RGB(234, 126, 0), 0.5: RGB(254, 244, 84), 0.75: RGB(173, 203, 249), 1: RGB(75, 107, 169)])
gate_and = GateAnd(A=includes_3.Includes, B=includes_4.Includes)
gradient_3 = Gradient(
    LowerLimit=number_slider_2,
    UpperLimit=number_slider,
    Parameter=expression_13,
    stops=[0: RGB(234, 38, 0), 0.25: RGB(234, 126, 0), 0.5: RGB(254, 244, 84), 0.75: RGB(173, 203, 249), 1: RGB(75, 107, 169)])
gradient_4 = Gradient(
    LowerLimit=number_slider_2,
    UpperLimit=number_slider_3,
    Parameter=includes_2.Includes,
    stops=[0: RGB(234, 38, 0), 0.25: RGB(234, 126, 0), 0.5: RGB(254, 244, 84), 0.75: RGB(173, 203, 249), 1: RGB(75, 107, 169)])
colour_by_dip_direction = BooleanToggle(True)
includes_6 = Includes(Value=expression_13, Domain=construct_domain_8)  # -> Includes, Deviation
includes_7 = Includes(Value=expression_13, Domain=construct_domain_7)  # -> Includes, Deviation
includes_8 = Includes(Value=expression_13, Domain=construct_domain_6)  # -> Includes, Deviation
expression_14 = Expression(x=larger_than.LargerThan, y=gate_and, z=includes_5.Includes, Expression="If(x = true, y, z)")
expression_15 = Expression(x=colour_by_dip_direction, y=gradient_2, z=gradient, Expression="If(x = true, y, z)")
gate_and_2 = GateAnd(A=includes_6.Includes, B=includes_7.Includes)
expression_16 = Expression(x=colour_by_dip_direction, y=gradient_3, z=gradient_4, Expression="If(x = true, y, z)")
expression_17 = Expression(x=larger_than_2.LargerThan, y=gate_and_2, z=includes_8.Includes, Expression="If(x = true, y, z)")
gate_and_3 = GateAnd(A=expression_14, B=includes.Includes)
expression_18 = Expression(x=gate_and_3, y=expression_15, Expression="If(x = true, y, 0)")
gate_and_4 = GateAnd(A=expression_17, B=includes_2.Includes)
expression_19 = Expression(x=gate_and_4, y=expression_16, Expression="If(x = true, y, 0)")
custom_preview_2 = CustomPreview(Geometry=mesh_brep, Material=expression_18)
construct_mesh_2 = ConstructMesh(Vertices=deconstruct_mesh.Vertices, Faces=deconstruct_mesh.Faces, Colours=expression_19)
