# Grasshopper definition ColourByZ.gh (Grasshopper 1.0.7)

number_slider = Slider(25, range=0..100)
# JA 29 October 2019
# 
# Grasshopper script for colouring surfaces based on elevation
surface = Surface(<surface referenced from the Rhino model>)
divide_domain² = DivideDomain²(Domain=surface, UCount=number_slider, VCount=number_slider)
isotrim = Isotrim(Surface=surface, Domain=divide_domain²)
panel = Panel("Format(\"{0:0.0}\",x)")
area = Area(Geometry=isotrim)  # -> Area, Centroid
deconstruct = Deconstruct(Point=area.Centroid)  # -> XComponent, YComponent, ZComponent
round = Round(Number=deconstruct.ZComponent)  # -> Nearest, Floor, Ceiling
bounds = Bounds(Numbers=deconstruct.ZComponent)
deconstruct_domain = DeconstructDomain(Domain=bounds)  # -> Start, End
gradient = Gradient(
    LowerLimit=deconstruct_domain.Start,
    UpperLimit=deconstruct_domain.End,
    Parameter=deconstruct.ZComponent,
    stops=[0: RGB(243, 57, 0), 0.1: RGB(236, 27, 60), 0.2: RGB(210, 0, 118), 0.3: RGB(103, 0, 120), 0.4: RGB(39, 72, 161), 0.5: RGB(1, 192, 229), 0.6: RGB(18, 178, 90), 0.7: RGB(79, 186, 8), 0.8: RGB(220, 237, 32), 0.9: RGB(247, 159, 20), 1: RGB(243, 57, 0)])
custom_preview = CustomPreview(Geometry=isotrim, Material=gradient)
text_tag_3d = TextTag3D(Location=area.Centroid, Text=round.Nearest, Size=Slider(5.6, range=0..10), Colour=gradient, Justification=7)
