# Grasshopper definition Defect Query.gh (Grasshopper 1.0.7)

mesh = Mesh(graft([<mesh referenced from the Rhino model> x132]))
facen = FaceNormals(Mesh=mesh)  # -> Centers, Normals
avr = Average(Input=facen.Centers)
avr_2 = Average(Input=facen.Normals)
devec = DeconstructVector(Vector=avr_2)  # -> XComponent, YComponent, ZComponent
circle = CircleCNR(Center=avr, Normal=avr_2, Radius=1)
asin = ArcSine(Value=devec.ZComponent)
division = Division(A=devec.XComponent, B=devec.YComponent)
boundary = BoundarySurfaces(Edges=circle)
deg = Degrees(Radians=asin)
atan = ArcTangent(Value=division)
bbox = BoundingBox(Content=mesh, Plane=boundary, UnionBox=False)  # -> flatten(Box), Box_2
expression = Expression(x=deg, Expression="If(x > 0, 0, 180)")
deg_2 = Degrees(Radians=atan)
edges = BrepEdges(Brep=bbox.Box)  # -> Naked, Interior, NonManifold
boxprop = BoxProperties(Box=bbox.Box)  # -> Center, Diagonal, Area, Volume, Degeneracy
expression_2 = Expression(x=devec.YComponent, Expression="If(x < 0, 180, 0)")
addition = Addition(A=deg_2, B=expression)
expression_3 = Expression(x=devec.YComponent, y=addition, Expression="If(x = 0, 0, y)")
cp = ControlPoints(Curve=edges.Interior)  # -> flatten(Points), Weights, Knots
addition_2 = Addition(A=expression_3, B=expression_2)
cullpt = CullDuplicates(Points=cp.Points, Tolerance=Slider(1, range=0..1), CullMode=3)  # -> Points, Indices, Valence
larger = LargerThan(FirstNumber=addition_2, SecondNumber=Slider(360, range=0..1000))  # -> LargerThan, OrEqualTo
smaller = SmallerThan(FirstNumber=addition_2, SecondNumber=Slider(0, range=0..100))  # -> SmallerThan, OrEqualTo
path_mapper = PathMapper(boxprop.Center, source="{A} (i)", target="{i\1}")
path_mapper_2 = PathMapper(cullpt.Points, source="{A;B} (i)", target="{i\4}")
expression_4 = Expression(x=larger.LargerThan, y=addition_2, Expression="If(x = true, y-360, 0)")
expression_5 = Expression(x=smaller.SmallerThan, y=addition_2, Expression="If(x = true, y+360, 0)")
or = GateOr(A=smaller.SmallerThan, B=larger.LargerThan)
expression_6 = Expression(x=deg, Expression="If(x > 0, 90-x, 90+x)")  # -> flatten(R)
expression_7 = Expression(x=or, y=addition_2, Expression="If(x = true, 0, y)")
panel = Panel(path_mapper)
panel_2 = Panel(path_mapper_2)
addition_3 = Addition(A=expression_5, B=expression_4, C=expression_7)  # -> flatten(Result)
dip_direction = Panel(addition_3)
dip_angle = Panel(expression_6)
bar_graph = BarGraph(dip_angle, BarColor=RGB(255, 0, 90))
bar_graph_2 = BarGraph(dip_direction, BarColor=RGB(255, 0, 90))
