# Grasshopper definition DefectAnalysis.gh (Grasshopper 1.0.7)

mapping_area = Curve(<curve referenced from the Rhino model>)
scanlines = Curve([<curve referenced from the Rhino model> x21])
curve = Curve([<curve referenced from the Rhino model> x200])
end_points = EndPoints(Curve=curve)  # -> Start, End
length = Length(Curve=curve)
deconstruct = Deconstruct(Point=end_points.Start)  # -> XComponent, YComponent, ZComponent
deconstruct_2 = Deconstruct(Point=end_points.End)  # -> XComponent, YComponent, ZComponent
subtraction = Subtraction(A=deconstruct.YComponent, B=deconstruct_2.YComponent)
length_2 = Length(Curve=flatten(scanlines))
subtraction_2 = Subtraction(A=deconstruct.XComponent, B=deconstruct_2.XComponent)
curve_curve = CurveCurve(CurveA=graft(curve), CurveB=scanlines)  # -> flatten(Points), ParamsA, ParamsB
panel = Panel(length)
mass_addition = MassAddition(Input=length)  # -> Result, PartialResults
list_length = ListLength(List=length)
average = Average(Input=length)
absolute = Absolute(Value=subtraction_2)  # -> flatten(Result)
absolute_2 = Absolute(Value=subtraction)  # -> flatten(Result)
text = Text("No. of Defects = ")
mass_addition_2 = MassAddition(Input=length_2)  # -> Result, PartialResults
area = Area(Geometry=mapping_area)  # -> Area, Centroid
concatenate = Concatenate(FragmentA=text, FragmentB=list_length)
list_length_2 = ListLength(List=curve_curve.Points)
panel_2 = Panel(average)
text_2 = Text("Total Borehole Length = ")
bar_graph = BarGraph(length, BarColor=RGB(255, 0, 90))
text_3 = Text("Defect Intersections = ")
division = Division(A=absolute_2, B=absolute)
division_2 = Division(A=mass_addition_2.Result, B=list_length_2)
concatenate_2 = Concatenate(FragmentA=text_2, FragmentB=mass_addition_2.Result)
concatenate_3 = Concatenate(FragmentA=text_3, FragmentB=list_length_2)
text_4 = Text("Average Defect Spacing = ")
division_3 = Division(A=mass_addition.Result, B=area.Area)
text_5 = Text("P21 (m/m2) = ")
arctangent = ArcTangent(Value=division)
concatenate_4 = Concatenate(FragmentA=text_4, FragmentB=division_2)
concatenate_5 = Concatenate(FragmentA=text_5, FragmentB=division_3)
degrees = Degrees(Radians=arctangent)
panel_3 = Panel(concatenate_3)
panel_4 = Panel(concatenate_2)
panel_5 = Panel(concatenate)
panel_6 = Panel(concatenate_4)
expression = Expression(x=degrees, B=absolute, Expression="IF(B=0,0,x)")
panel_7 = Panel(concatenate_5)
bar_graph_2 = BarGraph(expression, BarColor=RGB(255, 0, 90))
