# Grasshopper definition DefectAnalysis_LengthP.gh (Grasshopper 1.0.7)

curve = Curve([<curve referenced from the Rhino model> x126])
end_points = EndPoints(Curve=curve)  # -> Start, End
length = Length(Curve=curve)
curve_middle = CurveMiddle(Curve=curve)
deconstruct = Deconstruct(Point=end_points.Start)  # -> XComponent, YComponent, ZComponent
deconstruct_2 = Deconstruct(Point=end_points.End)  # -> XComponent, YComponent, ZComponent
subtraction = Subtraction(A=deconstruct.YComponent, B=deconstruct_2.YComponent)
subtraction_2 = Subtraction(A=deconstruct.XComponent, B=deconstruct_2.XComponent)
bounds = Bounds(Numbers=length)
absolute = Absolute(Value=subtraction_2)  # -> flatten(Result)
absolute_2 = Absolute(Value=subtraction)  # -> flatten(Result)
deconstruct_3 = Deconstruct(Point=curve_middle)  # -> XComponent, YComponent, ZComponent
expression = Expression(x=length, Expression="Format(\"{0:0.0}m\", x)")
deconstruct_domain = DeconstructDomain(Domain=bounds)  # -> Start, End
division = Division(A=absolute_2, B=absolute)
addition = Addition(A=deconstruct_3.XComponent, B=Slider(2, range=0..10))
arctangent = ArcTangent(Value=division)
gradient = Gradient(
    LowerLimit=deconstruct_domain.Start,
    UpperLimit=deconstruct_domain.End,
    Parameter=length,
    stops=[0: RGB(234, 38, 0), 0.25: RGB(234, 126, 0), 0.5: RGB(254, 244, 84), 0.75: RGB(173, 203, 249), 1: RGB(75, 107, 169)])
construct_point = ConstructPoint(XCoordinate=addition, YCoordinate=deconstruct_3.YComponent, ZCoordinate=deconstruct_3.ZComponent)
degrees = Degrees(Radians=arctangent)
expression_2 = Expression(x=degrees, B=absolute, Expression="IF(B=0,0,x)")
custom_preview = CustomPreview(Geometry=curve, Material=gradient)
bar_graph = BarGraph(expression_2, BarColor=RGB(255, 0, 90))
text_tag = TextTag(Location=construct_point, Text=expression, Colour=gradient)
