# Grasshopper definition Defects.gh (Grasshopper 1.0.7)

number_slider = Slider(1, range=0..1)
number_slider_2 = Slider(4, range=0..50)
number_slider_3 = Slider(2, range=0..50)
number_slider_4 = Slider(3, range=0..50)
file_path = FilePath("O:\PSM3857\Eng\3. Analysis\Dec 2019 - 3DEC\Cindy\test.txt")
expression = Expression(x=number_slider_2, Expression="3*x-3")
expression_2 = Expression(x=number_slider_2, Expression="3*x-2")
expression_3 = Expression(x=number_slider, Expression="3*x-3")
expression_4 = Expression(x=number_slider, Expression="3*x-2")
expression_5 = Expression(x=number_slider_2, Expression="3*x-1")
expression_6 = Expression(x=number_slider, Expression="3*x-1")
expression_7 = Expression(x=number_slider_3, Expression="3*x-3")
expression_8 = Expression(x=number_slider_3, Expression="3*x-2")
expression_9 = Expression(x=number_slider_3, Expression="3*x-1")
expression_10 = Expression(x=number_slider_4, Expression="3*x-3")
expression_11 = Expression(x=number_slider_4, Expression="3*x-2")
expression_12 = Expression(x=number_slider_4, Expression="3*x-1")
import_coordinates = ImportCoordinates(File=file_path, Separator="\t", XIndex=expression_3, YIndex=expression_4, ZIndex=expression_6)
import_coordinates_2 = ImportCoordinates(File=file_path, Separator="\t", XIndex=expression_7, YIndex=expression_8, ZIndex=expression_9)
import_coordinates_3 = ImportCoordinates(File=file_path, Separator="\t", XIndex=expression_10, YIndex=expression_11, ZIndex=expression_12)
import_coordinates_4 = ImportCoordinates(File=file_path, Separator="\t", XIndex=expression, YIndex=expression_2, ZIndex=expression_5)
_4point_surface = _4PointSurface(CornerA=import_coordinates, CornerB=import_coordinates_2, CornerC=import_coordinates_3, CornerD=import_coordinates_4)
