# Grasshopper definition DrawBH.gh (Grasshopper 1.0.7)

path = FilePath("D:\Jiwoo Ahn\Desktop\Stanley St Bridge\BHs.csv")
file = ReadFile(File=path, PerLineParse=True)
split = StringSplit(String=file, Separators=",")  # -> simplify(Result)
flip = FlipMatrix(Data=split)
split_2 = SplitList(List=flip, Index=Slider(1, range=0..100))  # -> simplify(ListA), simplify(ListB)
panel = Panel(split_2.ListA)
bang = ExplodeTree(Data=split_2.ListB)  # -> Branch0, Branch1, Branch2, Branch3, Branch4, Branch5, Branch6
expression = Expression(theta=bang.Branch6, Expression="cos(rad(90-theta))")
expression_2 = Expression(theta=bang.Branch6, Expression="sin(rad(90-theta))")
expression_3 = Expression(plunge=bang.Branch5, Expression="-sin(rad(plunge))")
pt = ConstructPoint(XCoordinate=bang.Branch1, YCoordinate=bang.Branch2, ZCoordinate=bang.Branch3)
