# Grasshopper definition DrawBH_V2.gh (Grasshopper 1.0.7)

path = FilePath("D:\Jiwoo Ahn\Desktop\Stanley St Bridge\BHs_RMU.csv")
file = ReadFile(File=path, PerLineParse=True)
split = StringSplit(String=file, Separators=",")  # -> simplify(Result)
flip = FlipMatrix(Data=split)
split_2 = SplitList(List=flip, Index=Slider(1, range=0..100))  # -> simplify(ListA), simplify(ListB)

path_2 = FilePath("D:\Jiwoo Ahn\Desktop\Stanley St Bridge\BHs.csv")
file_2 = ReadFile(File=path_2, PerLineParse=True)
split_3 = StringSplit(String=file_2, Separators=",")  # -> simplify(Result)
flip_2 = FlipMatrix(Data=split_3)
split_4 = SplitList(List=flip_2, Index=Slider(1, range=0..100))  # -> simplify(ListA), simplify(ListB)

bang = ExplodeTree(Data=split_2.ListB)  # -> Branch0, Branch1, Branch2, Branch3
panel = Panel(split_2.ListA)
split_5 = TextSplit(Text="0,255,255,255,128,64", Separators=",")
panel_2 = Panel(split_4.ListA)
bang_2 = ExplodeTree(Data=split_4.ListB)  # -> Branch0, Branch1, Branch2, Branch3, Branch4, Branch5, Branch6
split_6 = TextSplit(Text="0,128,64,0,0,0", Separators=",")
split_7 = TextSplit(Text="125,255,192,128,64,0", Separators=",")
split_8 = TextSplit(Text="FL,TUFF 5,TUFF 4,TUFF 3,TUFF 2,TUFF 1", Separators=",")
expression = Expression(x=split_7, Expression="x/255")
expression_2 = Expression(x=split_5, Expression="x/255")
expression_3 = Expression(x=split_6, Expression="x/255")
mindex = MemberIndex(Set=bang_2.Branch0, Member=bang.Branch0)  # -> flatten(Index), Count
split_9 = TextSplit(Text="  FILL  ,TUFF 5,TUFF 4,TUFF 3,TUFF 2,TUFF 1", Separators=",")
cluster = Cluster(t=bang_2.Branch6, p=bang_2.Branch5)
mindex_2 = MemberIndex(Set=split_8, Member=bang.Branch3)  # -> flatten(Index), Count
frgb = ColourRGBF(Alpha=1, Red=expression, Green=expression_2, Blue=expression_3)
pt = ConstructPoint(XCoordinate=bang_2.Branch1, YCoordinate=bang_2.Branch2, ZCoordinate=bang_2.Branch3)
rec = Rectangle({Plane=Plane(origin=(53396.26182, 156997.2652, -15.06987802), x=(0.1536755073, 0.9881213683, 0), y=(0, 0, 1)), Size=Domain2(u=-2.177539048..2.177539048, v=-4.499219971..4.499219971)})
item = ListItem(List=pt, Index=mindex.Index, Wrap=True)
item_2 = ListItem(List=cluster, Index=mindex.Index, Wrap=True)
item_3 = ListItem(List=frgb, Index=mindex_2.Index, Wrap=True)
crv = Curve(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)
expression_4 = Expression(x=bang.Branch1, y=bang.Branch2, Expression="y-x")
line = LineSDL(Start=item, Direction=item_2, Length=bang.Branch1)
line_2 = LineSDL(Start=item, Direction=item_2, Length=bang.Branch2)
expression_5 = Expression(x=bang_2.Branch3, Expression="x+2")
crv_cp = CurveClosestPoint(Point=pt, Curve=crv)  # -> Point, Parameter, Distance
legend = Legend(Colour=frgb, Tags=split_9, Rectangle=rec, LegendType=1)
panel_3 = Panel(item_3)
end = EndPoints(Curve=line)  # -> Start, End
end_2 = EndPoints(Curve=line_2)  # -> Start, End
pdecon = Deconstruct(Point=crv_cp.Point)  # -> XComponent, YComponent, ZComponent
pt_2 = ConstructPoint(XCoordinate=bang_2.Branch1, YCoordinate=bang_2.Branch2, ZCoordinate=expression_5)
expression_6 = Expression(Expression="Format(\"{0}, {1}\", x, y)")
panel_4 = Panel(frgb)
ln = Line(StartPoint=end.End, EndPoint=end_2.End)
expression_7 = Expression(
    id=bang_2.Branch0,
    x=pdecon.XComponent,
    y=pdecon.YComponent,
    u=bang_2.Branch1,
    v=bang_2.Branch2,
    Expression="Format(\"{0} Offset {1:0.0}m\",id,((x-u)^2+(y-v)^2)^0.5)")
cyl = Cylinder(Base=ln, Radius=0.5, Length=expression_4)
cap = CapHoles(Brep=cyl)
preview = CustomPreview(Geometry=cap, Material=item_3)
tag = TextTag(Location=pt_2, Text=expression_7)

# ==== cluster Cluster
t = ClusterInput()
p = ClusterInput()
expression = Expression(t=t, p=p, Expression="sin(rad(t))*cos(rad(p))")
expression_2 = Expression(t=t, p=p, Expression="cos(rad(t))*cos(rad(p))")
expression_3 = Expression(p=p, Expression="-sin(rad(p))")
vec = VectorXYZ(XComponent=expression, YComponent=expression_2, ZComponent=expression_3)  # -> Vector, Length
V = ClusterOutput(vec.Vector)
