# Grasshopper definition GocadLines.gh (Grasshopper 1.0.7)

# ----
# Import GOCAD File
path = FilePath("O:\PSM3825\Eng\Fracman\GoCad TraceMaps\SectionC_CrossJoint_Traces.pl")
file = ReadFile(File=path, PerLineParse=True)
split = StringSplit(String=file, Separators=" ")
flip = FlipMatrix(Data=split)
bang = ExplodeTree(Data=flip)  # -> Branch0, Branch1, Branch2, Branch3, Branch4

# ----
# Extract out segment IDs
panel = Panel("SEG")
tmatch = MatchText(Text=bang.Branch0, Pattern=panel, Case=True)
dispatch = Dispatch(List=bang.Branch1, DispatchPattern=tmatch)  # -> ListA, ListB
dispatch_2 = Dispatch(List=bang.Branch2, DispatchPattern=tmatch)  # -> ListA, ListB
num = Number(dispatch.ListA)
num_2 = Number(dispatch_2.ListA)

# ----
# Extract out vertices
panel_2 = Panel("VRTX")
tmatch_2 = MatchText(Text=bang.Branch0, Pattern=panel_2, Case=True)
dispatch_3 = Dispatch(List=bang.Branch1, DispatchPattern=tmatch_2)  # -> ListA, ListB
dispatch_4 = Dispatch(List=bang.Branch3, DispatchPattern=tmatch_2)  # -> ListA, ListB
dispatch_5 = Dispatch(List=bang.Branch4, DispatchPattern=tmatch_2)  # -> ListA, ListB
dispatch_6 = Dispatch(List=bang.Branch2, DispatchPattern=tmatch_2)  # -> ListA, ListB
number_slider = Slider(3, range=0..10)
num_3 = Number(dispatch_5.ListA)
num_4 = Number(dispatch_4.ListA)
num_5 = Number(dispatch_6.ListA)
num_6 = Number(dispatch_3.ListA)

# ----
# Match segment nodes with list of
# vertcies and construct lines
python = GhPythonScript(i=num_6, x=num_5, y=num_4, z=num_3, i1=num, i2=num_2)  # -> out, x1, y1, z1, x2, y2, z2; inputs i: list, x: list, y: list, z: list
# ---------- python: Python ----------
__author__ = "Jiwoo Ahn"
__version__ = "2020.08.14"

import rhinoscriptsyntax as rs

i1_ind = i.index(i1)
i2_ind = i.index(i2)
x1 = x[i1_ind]
y1 = y[i1_ind]
z1 = z[i1_ind]
x2=  x[i2_ind]
y2 =  y[i2_ind]
z2 =  z[i2_ind]
# ---------- end python ----------
pt = ConstructPoint(XCoordinate=python.x1, YCoordinate=python.y1, ZCoordinate=python.z1)
pt_2 = ConstructPoint(XCoordinate=python.x2, YCoordinate=python.y2, ZCoordinate=python.z2)
ln = Line(StartPoint=pt, EndPoint=pt_2)
