# Grasshopper definition GocadTsurf.gh (Grasshopper 1.0.7)
# plug-ins: Human

path = FilePath("D:\Jiwoo Ahn\Desktop\Thesis Modelling\DFN\test.ts")
crv = Curve([<curve referenced from the Rhino model> x12])
file = ReadFile(File=path, PerLineParse=True)
lng = ListLength(List=crv)
boundary = BoundarySurfaces(Edges=crv)
lng_2 = ListLength(List=file)
tmatch = MatchText(Text=file, Pattern="TFACE", Case=True)
tmatch_2 = MatchText(Text=file, Pattern="END", Case=True)
series = Series(Start=0, Step=1, Count=lng_2)
area = Area(Geometry=boundary)  # -> Area, Centroid
X = UnitX(Factor=Slider(6, range=0..10))
dispatch = Dispatch(List=series, DispatchPattern=tmatch_2)  # -> ListA, ListB
dispatch_2 = Dispatch(List=series, DispatchPattern=tmatch)  # -> ListA, ListB
expression = Expression(x=dispatch_2.ListA, Expression="x+1")
expression_2 = Expression(x=dispatch.ListA, Expression="x-1")
expression_3 = Expression(x=area.Area, Expression="Format(\"{0:0.0}m²\", x)")
move = Move(Geometry=area.Centroid, Motion=X)  # -> Geometry, Transform
dom = ConstructDomain(DomainStart=expression, DomainEnd=expression_2)
subset = SubList(List=file, Domain=dom, Wrap=True)  # -> simplify(List), Index
X_2 = UnitX(Factor=Slider(2, range=0..10))
ln = Line(StartPoint=move.Geometry, EndPoint=area.Centroid)
move_2 = Move(Geometry=move.Geometry, Motion=X_2)  # -> Geometry, Transform
tmatch_3 = MatchText(Text=subset.List, Pattern="VRTX*", Case=True)
vdis = VectorDisplay(Anchor=move.Geometry, Vector=ln)
dispatch_3 = Dispatch(List=subset.List, DispatchPattern=tmatch_3)  # -> ListA, ListB
tag = TextTag(Location=move_2.Geometry, Text=expression_3)
split = TextSplit(Text=dispatch_3.ListB, Separators=" ")
split_2 = TextSplit(Text=dispatch_3.ListA, Separators=" ")
item = ListItem(List=split_2, Index=Slider(3, range=0..10), Wrap=True)
item_2 = ListItem(List=split_2, Index=Slider(4, range=0..10), Wrap=True)
item_3 = ListItem(List=split, Index=Slider(2, range=0..10), Wrap=True)
item_4 = ListItem(List=split, Index=Slider(3, range=0..10), Wrap=True)
item_5 = ListItem(List=split_2, Index=Slider(2, range=0..10), Wrap=True)
item_6 = ListItem(List=split, Index=Slider(1, range=0..10), Wrap=True)
panel = Panel("""0.49361885
100
100
100
50
100
50
50
50
100
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""")
expression_4 = Expression(x=item_3, Expression="x-1")
expression_5 = Expression(x=item_4, Expression="x-1")
expression_6 = Expression(x=item_6, Expression="x-1")
pt = ConstructPoint(XCoordinate=item_5, YCoordinate=item, ZCoordinate=item_2)
triangle = MeshTriangle(CornerA=expression_6, CornerB=expression_4, CornerC=expression_5)
pshift = ShiftPaths(Data=pt, Offset=-1)
col = Colour(RGB(255, 0, 0))
col_2 = Colour(RGB(0, 255, 0))
pshift_2 = ShiftPaths(Data=triangle, Offset=-1)
smaller = SmallerThan(FirstNumber=panel, SecondNumber=Slider(1.5, range=0..10))  # -> graft(SmallerThan), OrEqualTo
p_n_c = PickNChoose(Pattern=smaller.SmallerThan, Stream0=col_2, Stream1=col)  # -> simplify(graft(Result))
conmesh = ConstructMesh(Vertices=pshift, Faces=pshift_2, Colours=p_n_c)
createatts = CreateAttributes(Color=p_n_c, enableFullPath=False)
bake = BakeGeometry(Bake=Button(), Geometry=conmesh, Attributes=createatts, DeleteOldBakes=False, PreserveTrees=False)
