# Grasshopper definition LineRotate.gh (Grasshopper 1.0.7)

radians = Radians(Degrees=Slider(-34, range=-90..90))
number_slider = Slider(0, range=0..100)
number_slider_2 = Slider(1, range=0..1)
tangent = Tangent(Value=radians)
curve = Curve([<curve referenced from the Rhino model> x746])
evaluate_length = EvaluateLength(Curve=curve, Length=Slider(0.5, range=0..1), Normalized=True)  # -> Point, Tangent, Parameter
construct_point = ConstructPoint(XCoordinate=number_slider_2, YCoordinate=number_slider, ZCoordinate=number_slider)
construct_point_2 = ConstructPoint(XCoordinate=number_slider_2, YCoordinate=tangent, ZCoordinate=number_slider)
rotate_direction = RotateDirection(Geometry=curve, Center=evaluate_length.Point, From=construct_point, To=construct_point_2)  # -> Geometry, Transform
