# Grasshopper definition MESH.gh (Grasshopper 1.0.7)

radial_division = Integer(530)
extrados = Curve(<curve referenced from the Rhino model>)
intrados = Curve(<curve referenced from the Rhino model>)
divide = DivideCurve(Curve=intrados, Count=radial_division, Kinks=False)  # -> Points, Tangents, Parameters
divide_2 = DivideCurve(Curve=extrados, Count=radial_division, Kinks=False)  # -> Points, Tangents, Parameters
alongcrv = SortAlongCurve(Points=divide.Points, Curve=intrados)  # -> Points, Indices
alongcrv_2 = SortAlongCurve(Points=divide_2.Points, Curve=extrados)  # -> Points, Indices
rev = ReverseList(List=alongcrv.Points)
ln = Line(StartPoint=alongcrv.Points, EndPoint=alongcrv_2.Points)
pline = PolyLine(Vertices=alongcrv.Points, Closed=False)
pdecon = Deconstruct(Point=alongcrv.Points)  # -> XComponent, YComponent, ZComponent
pdecon_2 = Deconstruct(Point=alongcrv_2.Points)  # -> XComponent, YComponent, ZComponent
pline_2 = PolyLine(Vertices=alongcrv_2.Points, Closed=False)
subtraction = Subtraction(A=pdecon_2.YComponent, B=pdecon.YComponent)
subtraction_2 = Subtraction(A=pdecon_2.XComponent, B=pdecon.XComponent)
subtraction_3 = Subtraction(A=pdecon_2.ZComponent, B=pdecon.ZComponent)
num = Number(0.5)
vec = VectorXYZ(XComponent=subtraction_2, YComponent=subtraction, ZComponent=subtraction_3)  # -> Vector, Length
multiplication = Multiplication(A=vec.Length, B=num)
amp = Amplitude(Vector=vec.Vector, Amplitude=multiplication)
devec = DeconstructVector(Vector=amp)  # -> XComponent, YComponent, ZComponent
addition = Addition(A=pdecon.ZComponent, B=devec.ZComponent)
addition_2 = Addition(A=pdecon.YComponent, B=devec.YComponent)
addition_3 = Addition(A=pdecon.XComponent, B=devec.XComponent)
pt = ConstructPoint(XCoordinate=addition_3, YCoordinate=addition_2, ZCoordinate=addition)
lng = ListLength(List=pt)
subtraction_4 = Subtraction(A=lng, B=1)
series = Series(Start=1, Step=1, Count=subtraction_4)
series_2 = Series(Start=0, Step=1, Count=subtraction_4)
item = ListItem(List=pt, Index=series_2, Wrap=True)
item_2 = ListItem(List=pt, Index=series, Wrap=True)
pdecon_3 = Deconstruct(Point=item)  # -> XComponent, YComponent, ZComponent
pdecon_4 = Deconstruct(Point=item_2)  # -> XComponent, YComponent, ZComponent
subtraction_5 = Subtraction(A=pdecon_4.YComponent, B=pdecon_3.YComponent)
subtraction_6 = Subtraction(A=pdecon_4.XComponent, B=pdecon_3.XComponent)
subtraction_7 = Subtraction(A=pdecon_4.ZComponent, B=pdecon_3.ZComponent)
Y = UnitY(Factor=1)
num_2 = Number(0.1)
vec_2 = VectorXYZ(XComponent=subtraction_6, YComponent=subtraction_5, ZComponent=subtraction_7)  # -> Vector, Length
Y_2 = UnitY(Factor=1)
Z = UnitZ(Factor=1)
vrot = Rotate(Vector=vec_2.Vector, Axis=Z, Angle=1.570796327)
series_3 = Series(Start=1, Step=1, Count=10)
devec_2 = DeconstructVector(Vector=vrot)  # -> XComponent, YComponent, ZComponent
addition_4 = Addition(A=pdecon_3.ZComponent, B=devec_2.ZComponent)
addition_5 = Addition(A=pdecon_3.YComponent, B=devec_2.YComponent)
addition_6 = Addition(A=pdecon_3.XComponent, B=devec_2.XComponent)
pt_2 = ConstructPoint(XCoordinate=addition_6, YCoordinate=addition_5, ZCoordinate=addition_4)
ln_2 = Line(StartPoint=item, EndPoint=pt_2)
ext = ExtendCurve(Curve=ln_2, Type=0, Start=1, End=1)
ccx = CurveCurve(CurveA=ext, CurveB=pline)  # -> Points, ParamsA, ParamsB
ccx_2 = CurveCurve(CurveA=ext, CurveB=pline_2)  # -> Points, ParamsA, ParamsB
alongcrv_3 = SortAlongCurve(Points=ccx.Points, Curve=pline)  # -> Points, Indices
alongcrv_4 = SortAlongCurve(Points=ccx_2.Points, Curve=pline_2)  # -> Points, Indices
flatten = FlattenTree(Tree=alongcrv_3.Points, Path="{0}")
flatten_2 = FlattenTree(Tree=alongcrv_4.Points, Path="{0}")
ln_3 = Line(StartPoint=alongcrv_3.Points, EndPoint=alongcrv_4.Points)
pline_3 = PolyLine(Vertices=flatten, Closed=False)
pline_4 = PolyLine(Vertices=flatten_2, Closed=False)
lng_2 = ListLength(List=flatten)
end = EndPoints(Curve=ln_3)  # -> Start, End
subtraction_8 = Subtraction(A=lng_2, B=1)
vec2pt = Vector2Pt(PointA=end.Start, PointB=end.End, Unitize=False)  # -> Vector, Length
multiplication_2 = Multiplication(A=vec2pt.Length, B=num_2)
series_4 = Series(Start=0, Step=1, Count=subtraction_8)
series_5 = Series(Start=1, Step=1, Count=subtraction_8)
amp_2 = Amplitude(Vector=vec2pt.Vector, Amplitude=multiplication_2)
item_3 = ListItem(List=flatten, Index=series_4, Wrap=True)
item_4 = ListItem(List=flatten, Index=series_5, Wrap=True)
arrlinear = LinearArray(Geometry=end.Start, Direction=amp_2, Count=10)  # -> Geometry, Transform
ln_4 = Line(StartPoint=item_3, EndPoint=item_4)

int = Integer(9)
item_5 = ListItem(List=arrlinear.Geometry, Index=int, Wrap=True)
flatten_3 = FlattenTree(Tree=item_5, Path="{0}")
pline_5 = PolyLine(Vertices=flatten_3, Closed=False)

int_2 = Integer(6)
item_6 = ListItem(List=arrlinear.Geometry, Index=int_2, Wrap=True)
flatten_4 = FlattenTree(Tree=item_6, Path="{0}")
pline_6 = PolyLine(Vertices=flatten_4, Closed=False)

int_3 = Integer(7)
item_7 = ListItem(List=arrlinear.Geometry, Index=int_3, Wrap=True)
flatten_5 = FlattenTree(Tree=item_7, Path="{0}")
pline_7 = PolyLine(Vertices=flatten_5, Closed=False)

int_4 = Integer(5)
item_8 = ListItem(List=arrlinear.Geometry, Index=int_4, Wrap=True)
flatten_6 = FlattenTree(Tree=item_8, Path="{0}")
pline_8 = PolyLine(Vertices=flatten_6, Closed=False)

int_5 = Integer(8)
item_9 = ListItem(List=arrlinear.Geometry, Index=int_5, Wrap=True)
flatten_7 = FlattenTree(Tree=item_9, Path="{0}")
pline_9 = PolyLine(Vertices=flatten_7, Closed=False)

int_6 = Integer(3)
item_10 = ListItem(List=arrlinear.Geometry, Index=int_6, Wrap=True)
flatten_8 = FlattenTree(Tree=item_10, Path="{0}")
pline_10 = PolyLine(Vertices=flatten_8, Closed=False)

int_7 = Integer(4)
item_11 = ListItem(List=arrlinear.Geometry, Index=int_7, Wrap=True)
flatten_9 = FlattenTree(Tree=item_11, Path="{0}")
pline_11 = PolyLine(Vertices=flatten_9, Closed=False)

int_8 = Integer(2)
item_12 = ListItem(List=arrlinear.Geometry, Index=int_8, Wrap=True)
flatten_10 = FlattenTree(Tree=item_12, Path="{0}")
pline_12 = PolyLine(Vertices=flatten_10, Closed=False)

int_9 = Integer(1)
item_13 = ListItem(List=arrlinear.Geometry, Index=int_9, Wrap=True)
flatten_11 = FlattenTree(Tree=item_13, Path="{0}")
pline_13 = PolyLine(Vertices=flatten_11, Closed=False)

crv = Curve([pline_3, ln_3, flatten_2, pline_13, pline_12, pline_10, pline_11, pline_8, pline_6, pline_7, pline_9, pline_5, pline_4])
lng_3 = ListLength(List=ext)
int_10 = Integer(10)
integer_division = IntegerDivision(A=lng_3, B=int_10)
panel = Panel(flatten_10)
series_6 = Series(Start=0, Step=int_10, Count=integer_division)
item_14 = ListItem(List=ext, Index=series_6, Wrap=True)
lng_4 = ListLength(List=item_14)
panel_2 = Panel(item_14)
