# Grasshopper definition Mapping Halos.gh (Grasshopper 1.0.7)

geometry_pipeline = GeometryPipeline(
    GroupByLayer=False,
    GroupByType=False,
    IncludeHidden=True,
    IncludeLocked=True,
    LayerFilter="MAPPING_CURVES",
    NameFilter="*",
    SublayerFiltering=True,
    TypeFilter=4)
curve = Curve(graft(geometry_pipeline))
control_points = ControlPoints(Curve=curve)  # -> Points, Weights, Knots
polygon_center = PolygonCenter(Polyline=curve)  # -> CenterV, CenterE, CenterA
segment_lengths = SegmentLengths(Curve=curve)  # -> ShortestLength, ShortestDomain, LongestLength, LongestDomain
construct_mesh = ConstructMesh(Vertices=control_points.Points, Faces={A=0, B=1, C=2, D=3})
division = Division(A=segment_lengths.LongestLength, B=Slider(2, range=0..10))
face_normals = FaceNormals(Mesh=construct_mesh)  # -> Centers, Normals
devec = DeconstructVector(Vector=face_normals.Normals)  # -> XComponent, YComponent, ZComponent
circle_cnr = CircleCNR(Center=polygon_center.CenterV, Normal=face_normals.Normals, Radius=division)
equivalent_radius = BarGraph(division, BarColor=RGB(255, 0, 90))
asin = ArcSine(Value=devec.ZComponent)
division_2 = Division(A=devec.XComponent, B=devec.YComponent)
boundary_surfaces = BoundarySurfaces(Edges=circle_cnr)
deg = Degrees(Radians=asin)
atan = ArcTangent(Value=division_2)
mesh_brep = MeshBrep(
    Brep=boundary_surfaces,
    Settings={GridMaxCount=0, GridMinCount=16, JaggedSeams=False, MaxEdgeLength=0, MinEdgeLength=0.0001, MinTolerance=0, Refine=True, RefineAngle=0, RelativeTolerance=0.65, SimplePlanes=True, Tolerance=0})
expression = Expression(x=deg, Expression="If(x > 0, 0, 180)")
deg_2 = Degrees(Radians=atan)
expression_2 = Expression(x=devec.YComponent, Expression="If(x < 0, 180, 0)")
addition = Addition(A=deg_2, B=expression)
expression_3 = Expression(x=devec.YComponent, y=addition, Expression="If(x = 0, 0, y)")
colour_by_dip_direction_false_color_by_d = BooleanToggle(False)  # "Colour By Dip Direction (False = Color by Dip Angle)"
addition_2 = Addition(A=expression_3, B=expression_2)
larger = LargerThan(FirstNumber=addition_2, SecondNumber=Slider(360, range=0..1000))  # -> LargerThan, OrEqualTo
smaller = SmallerThan(FirstNumber=addition_2, SecondNumber=Slider(0, range=0..100))  # -> SmallerThan, OrEqualTo
expression_4 = Expression(x=deg, Expression="If(x > 0, 90-x, 90+x)")
expression_5 = Expression(x=colour_by_dip_direction_false_color_by_d, y=mesh_brep, Expression="If(x = true, 0, y)")
number_slider = Slider(0, range=0..100)
number_slider_2 = Slider(0.111, range=0..1)
expression_6 = Expression(x=larger.LargerThan, y=addition_2, Expression="If(x = true, y-360, 0)")
expression_7 = Expression(x=smaller.SmallerThan, y=addition_2, Expression="If(x = true, y+360, 0)")
or = GateOr(A=smaller.SmallerThan, B=larger.LargerThan)
expression_8 = Expression(x=or, y=addition_2, Expression="If(x = true, 0, y)")
number_slider_3 = Slider(1, range=0..1)
number_slider_4 = Slider(30, range=0..100)
construct_point = ConstructPoint(XCoordinate=0, YCoordinate=0, ZCoordinate=0)
series = Series(Start=number_slider_2, Step=number_slider_2, Count=Slider(9, range=0..10))
construct_point_2 = ConstructPoint(XCoordinate=Slider(-1, range=-1..1), YCoordinate=number_slider, ZCoordinate=0)
construct_point_3 = ConstructPoint(XCoordinate=Slider(1, range=0..1), YCoordinate=number_slider, ZCoordinate=0)
addition_3 = Addition(A=expression_7, B=expression_6, C=expression_8)
circle_cnr_2 = CircleCNR(Center=construct_point, Normal=Vector(0, 0, 1), Radius=series)
series_2 = Series(Start=number_slider_4, Step=number_slider_4, Count=Slider(6, range=0..10))
dip_angle = Panel(expression_4)
line = Line(StartPoint=construct_point_2, EndPoint=construct_point_3)
radians = Radians(Degrees=series_2)
dip_direction = Panel(addition_3)
colour = Colour(RGB(0, 0, 0))
custom_preview = CustomPreview(Geometry=circle_cnr_2, Material=colour)
rotate = Rotate(Geometry=line, Angle=radians, Plane=PlaneXY(0, 0, 0))  # -> Geometry, Transform
addition_4 = Addition(A=series_2, B=Slider(180, range=0..1000))
gradient = Gradient(
    LowerLimit=Slider(0, range=0..100),
    UpperLimit=Slider(90, range=0..100),
    Parameter=dip_angle,
    stops=[0: RGB(234, 38, 0), 0.25: RGB(234, 126, 0), 0.5: RGB(254, 244, 84), 0.75: RGB(173, 203, 249), 1: RGB(75, 107, 169)])
number = Number(flatten(dip_angle))
number_2 = Number(flatten(dip_direction))
set_union = SetUnion(SetA=series_2, SetB=addition_4)
curve_2 = Curve(rotate.Geometry)
control_points_2 = ControlPoints(Curve=curve_2)  # -> flatten(Points), Weights, Knots
split_list = SplitList(List=set_union, Index=Slider(3, range=0..10))  # -> ListA, ListB
custom_preview_2 = CustomPreview(Geometry=curve_2, Material=colour)
gradient_2 = Gradient(
    LowerLimit=Slider(0, range=0..100),
    UpperLimit=Slider(360, range=0..1000),
    Parameter=dip_direction,
    stops=[0: RGB(234, 38, 0), 0.25: RGB(234, 126, 0), 0.5: RGB(254, 244, 84), 0.75: RGB(173, 203, 249), 1: RGB(75, 107, 169)])
expression_9 = Expression(x=number_2, y=number, Expression="Format(\"DipDir = {0}, Dip = {1}\", round(x), round(y))")  # -> graft(Result)
sort_along_curve = SortAlongCurve(Points=control_points_2.Points, Curve=circle_cnr_2)  # -> reverse(Points), Indices
set_union_2 = SetUnion(SetA=split_list.ListB, SetB=split_list.ListA)
number_slider_5 = Slider(1.15, range=0..10)
deconstruct = Deconstruct(Point=sort_along_curve.Points)  # -> XComponent, YComponent, ZComponent
expression_10 = Expression(x=colour_by_dip_direction_false_color_by_d, y=gradient_2, z=gradient, Expression="If(x = true, y, z)")
expression_11 = Expression(x=set_union_2, Expression="Format(\"{0}°\", x)")
multiplication = Multiplication(A=number_slider_5, B=deconstruct.XComponent)
multiplication_2 = Multiplication(A=number_slider_5, B=deconstruct.YComponent)
multiplication_3 = Multiplication(A=number_slider_5, B=deconstruct.ZComponent)
construct_point_4 = ConstructPoint(XCoordinate=multiplication, YCoordinate=multiplication_2, ZCoordinate=multiplication_3)
colour_2 = Colour(expression_10)
custom_preview_3 = CustomPreview(Geometry=face_normals.Normals, Material=colour_2)
text_tag = TextTag(Location=polygon_center.CenterV, Text=expression_9, Colour=colour_2)
custom_preview_4 = CustomPreview(Geometry=mesh_brep, Material=colour_2)
text_tag_2 = TextTag(Location=construct_point_4, Text=expression_11, Colour=colour)
