# Grasshopper definition Mapping.gh (Grasshopper 1.0.7)

mesh = Mesh(<mesh referenced from the Rhino model>)
deconstruct_mesh = DeconstructMesh(Mesh=mesh)  # -> Vertices, Faces, Colours, Normals
avr = Average(Input=deconstruct_mesh.Normals)
pt = ConstructPoint(XCoordinate="-183.43", YCoordinate="-488.05", ZCoordinate="992.93")
deconstruct_vector = DeconstructVector(Vector=avr)  # -> XComponent, YComponent, ZComponent
line = LineSDL(Start=pt, Direction=Vector(0, 0, 1), Length=1)
division = Division(A=deconstruct_vector.XComponent, B=deconstruct_vector.YComponent)
arcsine = ArcSine(Value=deconstruct_vector.ZComponent)
expression = Expression(x=deconstruct_vector.YComponent, Expression="If(x > 0, 90, 270)")
arctangent = ArcTangent(Value=division)
degrees = Degrees(Radians=arcsine)
degrees_2 = Degrees(Radians=arctangent)
addition = Addition(A=degrees_2, B=expression)
expression_2 = Expression(x=addition, y=degrees, Expression="If(y > 0, If(x > 180, x - 180, x + 180), x) ")
expression_3 = Expression(x=degrees, Expression="If(x > 0, 90-x, 90+x)")
panel = Panel(expression_2)
panel_2 = Panel(expression_3)
