# Grasshopper definition Mesh Gradient Colour.gh (Grasshopper 1.0.7)

mesh = Mesh(<mesh referenced from the Rhino model>)
deconstruct_mesh = DeconstructMesh(Mesh=mesh)  # -> Vertices, Faces, Colours, Normals

# ----
# Math to calculate dip direction
# and dip angle
deconstruct_vector = DeconstructVector(Vector=deconstruct_mesh.Normals)  # -> XComponent, YComponent, ZComponent
division = Division(A=deconstruct_vector.XComponent, B=deconstruct_vector.YComponent)
arcsine = ArcSine(Value=deconstruct_vector.ZComponent)
expression = Expression(x=deconstruct_vector.YComponent, Expression="If(x > 0, 90, 270)")
arctangent = ArcTangent(Value=division)
degrees = Degrees(Radians=arcsine)
degrees_2 = Degrees(Radians=arctangent)
expression_2 = Expression(x=degrees, Expression="If(x > 0, 90-x, 90+x)")
addition = Addition(A=degrees_2, B=expression)
expression_3 = Expression(x=addition, y=degrees, Expression="If(y > 0, If(x > 180, x - 180, x + 180), x) ")
dip_angle = Panel(expression_2)
dip_direction = Panel(expression_3)

bounds = Bounds(Numbers=expression_2)
deconstruct_domain = DeconstructDomain(Domain=bounds)  # -> Start, End
gradient = Gradient(
    LowerLimit=deconstruct_domain.Start,
    UpperLimit=deconstruct_domain.End,
    Parameter=expression_2,
    stops=[0: RGB(234, 38, 0), 0.25: RGB(234, 126, 0), 0.5: RGB(254, 244, 84), 0.75: RGB(173, 203, 249), 1: RGB(75, 107, 169)])

construct_mesh = ConstructMesh(Vertices=deconstruct_mesh.Vertices, Faces=deconstruct_mesh.Faces, Colours=gradient)
