# Grasshopper definition MeshCompare.gh (Grasshopper 1.0.7)

mesh = Mesh(<mesh referenced from the Rhino model>)
number = Number(-1)
deconstruct_mesh = DeconstructMesh(Mesh=mesh)  # -> Vertices, Faces, Colours, Normals
mesh_2 = Mesh(<mesh referenced from the Rhino model>)
unit_z = UnitZ(Factor=1)
unit_z_2 = UnitZ(Factor=number)
project_point = ProjectPoint(Point=deconstruct_mesh.Vertices, Direction=unit_z_2, Geometry=mesh_2)  # -> Point, Index
project_point_2 = ProjectPoint(Point=deconstruct_mesh.Vertices, Direction=unit_z, Geometry=mesh_2)  # -> Point, Index
combine_data = CombineData(Input0=project_point_2.Point, Input1=project_point.Point)  # -> Result, Index
distance = Distance(PointA=combine_data.Result, PointB=deconstruct_mesh.Vertices)
includes = Includes(Value=distance, Domain="0.00001 to 10000")  # -> Includes, Deviation
bounds = Bounds(Numbers=distance)
dispatch = Dispatch(List=deconstruct_mesh.Vertices, DispatchPattern=includes.Includes)  # -> ListA, ListB
expression = Expression(x=distance, Expression="Format(\"{0:0}\", x)")  # disabled
deconstruct_domain = DeconstructDomain(Domain=bounds)  # -> Start, End
gradient = Gradient(
    LowerLimit=deconstruct_domain.Start,
    UpperLimit=deconstruct_domain.End,
    Parameter=distance,
    stops=[0: RGB(234, 38, 0), 0.25: RGB(234, 126, 0), 0.5: RGB(254, 244, 84), 0.75: RGB(173, 203, 249), 1: RGB(75, 107, 169)])
text_tag = TextTag(Location=deconstruct_mesh.Vertices, Text=expression, Colour=gradient)  # disabled
cull_vertices = CullVertices(Mesh=mesh, Pattern=includes.Deviation, Shrink=True)
point = Point(dispatch.ListB)
point_2 = Point(dispatch.ListA)
mesh_3 = Mesh(cull_vertices)
custom_preview = CustomPreview(Geometry=combine_data.Result, Material=gradient)
