# Grasshopper definition MeshToSurface.gh (Grasshopper 1.0.7)
# plug-ins: Section To XY

curve = Curve(<curve referenced from the Rhino model>)
mesh = Mesh(<mesh referenced from the Rhino model>)
section_serial = SectionSerial(Mesh=mesh, Curve=curve, Interval=Slider(200, range=0..1000), Width=Slider(4400, range=0..10000))  # -> Sections, Linear
reduce = Reduce(Polyline=section_serial.Sections, Tolerance=Slider(10, range=0..10))  # -> Polyline, Reduction
patch = Patch(Curves=reduce.Polyline, Spans=20, Flexibility=Slider(1, range=0..1), Trim=True)
custom_preview = CustomPreview(Material={diffuse=RGB(221, 160, 221), emission=RGB(66, 48, 66), shine=0.5, specular=RGB(255, 255, 255), transparency=0})
