# Grasshopper definition Optimise Corbel.gh (Grasshopper 1.0.7)

number_slider = Slider(0, range=0..1)
lx = Slider(0.268, range=0.1..0.9)
lx_2 = Slider(0.172, range=0.1..0.9)
lx_3 = Slider(0.244, range=0.1..0.3)
addition = Addition(A=number_slider, B=lx_3)
crv = Curve(<curve referenced from the Rhino model>)
addition_2 = Addition(A=addition, B=lx)
addition_3 = Addition(A=addition_2, B=lx_2)
number_slider_2 = Slider(4, range=0..10)
num = Number([number_slider, addition, addition_2, addition_3, Slider(1, range=0..1)])
eval = EvaluateLength(Curve=crv, Length=num, Normalized=True)  # -> Point, Tangent, Parameter
series = Series(Start=Slider(1, range=0..1), Step=1, Count=number_slider_2)
series_2 = Series(Start=Slider(0, range=0..1), Step=1, Count=number_slider_2)
item = ListItem(List=eval.Point, Index=series, Wrap=True)  # -> graft(Item)
item_2 = ListItem(List=eval.Point, Index=series_2, Wrap=True)  # -> graft(Item)
pdecon = Deconstruct(Point=flatten(item_2))  # -> XComponent, YComponent, ZComponent
pdecon_2 = Deconstruct(Point=flatten(item))  # -> XComponent, YComponent, ZComponent
avr = Average(Input=[item, item_2])  # -> simplify(ArithmeticMean)
X = UnitX(Factor=1)
X_2 = UnitX(Factor=1)
expression = Expression(x1=pdecon_2.YComponent, x2=pdecon.YComponent, Expression="abs(x1-x2)")  # -> graft(R)
divide = DivideCurve(Curve=crv, Count=Slider(50, range=0..100), Kinks=False)  # -> Points, Tangents, Parameters
line = LineSDL(Start=avr, Direction=X, Length=Slider(5, range=0..10))
crv_2 = Curve(<curve referenced from the Rhino model>)
clx = CurveLine(Curve=crv_2, Line=line)  # -> simplify(Points), Params, Count
line_2 = LineSDL(Start=divide.Points, Direction=X_2, Length=Slider(5, range=0..10))
pdecon_3 = Deconstruct(Point=avr)  # -> XComponent, YComponent, ZComponent
pdecon_4 = Deconstruct(Point=clx.Points)  # -> XComponent, YComponent, ZComponent
pt = ConstructPoint(XCoordinate=pdecon_3.XComponent, YCoordinate=graft(pdecon_2.YComponent), ZCoordinate=0)
expression_2 = Expression(x1=pdecon_3.XComponent, x2=pdecon_4.XComponent, Expression="abs(x1-x2)")
expression_3 = Expression(x=expression, Expression="x/2")
Y = UnitY(Factor=1)
neg = Negative(Value=Y)
line_3 = LineSDL(Start=clx.Points, Direction=Y, Length=expression_3)
line_4 = LineSDL(Start=clx.Points, Direction=neg, Length=expression_3)
rectangle = Rectangle(Plane=pt, XSize=expression_2, YSize=expression, Radius=0)  # -> Rectangle, Length
join = JoinCurves(Curves=[line_3, line_4], Preserve=False)
area = Area(Geometry=flatten(rectangle.Rectangle))  # -> Area, Centroid
crv_3 = Curve(<curve referenced from the Rhino model>)
ma = MassAddition(Input=area.Area)  # -> Result, PartialResults
crv_4 = Curve(<curve referenced from the Rhino model>)
area_2 = Number(ma.Result)
area_3 = Area(Geometry=crv_4)  # -> Area, Centroid
clx_2 = CurveLine(Curve=crv_3, Line=line_2)  # -> flatten(Points), Params, Count
clx_3 = CurveLine(Curve=join, Line=line_2)  # -> flatten(Points), Params, Count
panel = Panel(ma.Result)
panel_2 = Panel(area_3.Area)
ln = Line(StartPoint=clx_2.Points, EndPoint=divide.Points)
ln_2 = Line(StartPoint=clx_3.Points, EndPoint=divide.Points)
len = Length(Curve=ln_2)
len_2 = Length(Curve=ln)
subtraction = Subtraction(A=len_2, B=len)
expression_4 = Expression(x=subtraction, Expression="x^2")
bnd = Bounds(Numbers=subtraction)
number_slider_3 = Slider(0, range=0..100)
dedomain = DeconstructDomain(Domain=bnd)  # -> Start, End
ma_2 = MassAddition(Input=expression_4)  # -> Result, PartialResults
gradient = Gradient(
    LowerLimit=dedomain.Start,
    UpperLimit=dedomain.End,
    Parameter=subtraction,
    stops=[0: RGB(234, 38, 0), 0.25: RGB(234, 126, 0), 0.5: RGB(254, 244, 84), 0.75: RGB(173, 203, 249), 1: RGB(75, 107, 169)])
sse = Number(ma_2.Result)
c_script = CSharpScript(Slider="Lx", Value="Area", Target=panel_2, Compute=Toggle(False))  # inputs Slider: String, Value: String, Target: Double, Compute: Boolean
# ---------- c_script: C# ----------
    if (!Compute)
      return;

    if (_solver != null)
      return;

    _solver = new BinarySolver(GrasshopperDocument, Target, Slider, Value);
    GrasshopperDocument.SolutionEnd += HandleSolutionEnd;
# ---------- c_script: C# additional code ----------
  private BinarySolver _solver;

  private void HandleSolutionEnd(object sender, GH_SolutionEventArgs e)
  {
    GrasshopperDocument.SolutionEnd -= HandleSolutionEnd;

    // Just to be nice, let's switch the toggle to false.
    if (Component.Params.Input[3].SourceCount == 1)
    {
      IGH_Param source = Component.Params.Input[3].Sources[0];
      Grasshopper.Kernel.Special.GH_BooleanToggle toggle =
        source as Grasshopper.Kernel.Special.GH_BooleanToggle;
      if (toggle != null)
      {
        if (toggle.Value)
        {
          toggle.Value = false;
          toggle.ExpireSolution(false);
        }
      }
    }

    BinarySolver solver = _solver;
    _solver = null;
    solver.Solve();
  }

  public class BinarySolver
  {
    private readonly GH_Document _doc;
    private readonly double _target;
    private readonly Grasshopper.Kernel.Special.GH_NumberSlider _slider;
    private readonly Grasshopper.Kernel.Parameters.Param_Number _param;
    private readonly int _samples = 6;
    private readonly Dictionary<int, double> _cache = new Dictionary<int, double>();

    public BinarySolver(GH_Document doc, double target, string slider, string param)
    {
      _doc = doc;
      _target = target;

      foreach (IGH_DocumentObject obj in doc.Objects)
        if (_slider == null && obj.NickName.Equals(slider, StringComparison.Ordinal))
          _slider = obj as Grasshopper.Kernel.Special.GH_NumberSlider;

      foreach (IGH_DocumentObject obj in doc.Objects)
        if (_param == null && obj.NickName.Equals(param, StringComparison.Ordinal))
          _param = obj as Grasshopper.Kernel.Parameters.Param_Number;

      if (_slider == null)
        throw new Exception("Slider " + slider + " could not be found");

      if (_param == null)
        throw new Exception("Number parameter " + param + " could not be found");
    }

    public void Solve()
    {
      Rhino.RhinoApp.WriteLine("Grasshopper binary search started.");
      _cache.Clear();

      int tick0 = 0;
      int tick1 = _slider.TickCount;
      int chicken = 0;
      while(chicken < 32)
      {
        chicken++;

        // Divide the current search domain into N subdomains.
        int[] ticks = CreateTickArray(tick0, tick1, _samples);

        // Evaluate all samples and abort if a solution is found.
        double[] values = new double[_samples];
        for (int i = 0; i < _samples; i++)
        {
          values[i] = ComputeValue(ticks[i]);
          if (IsAcceptable(values[i]))
          {
            Rhino.RhinoApp.WriteLine("Grasshopper binary search completed.");
            return;
          }
        }

        // Find the two indices that bound the promising subdomain.
        int index0, index1;
        FindRegion(values, out index0, out index1);
        if (index0 < 0)
          throw new Exception("No suitable search domain could be found.");

        tick0 = ticks[index0];
        tick1 = ticks[index1];

        if (tick0 == tick1 - 1)
        {
          Rhino.RhinoApp.WriteLine("Grasshopper binary search exhausted.");
          return;
        }
      }

      Rhino.RhinoApp.WriteLine("Grasshopper binary search chickened out.");
    }

    private static int[] CreateTickArray(int tick0, int tick1, int samples)
    {
      samples = Math.Min(samples, (tick1 - tick0) + 1);

      int[] ticks = new int[samples];

      ticks[0] = tick0;
      ticks[samples - 1] = tick1;
      for (int i = 1; i < samples - 1; i++)
      {
        double factor = (double) i / samples;
        int offset = (int) (factor * (tick1 - tick0));
        ticks[i] = tick0 + offset;
      }
      return ticks;
    }
    /// <summary>
    /// Find the two indices that bound the most interesting region for the search.
    /// </summary>
    /// <param name="values">Value array.</param>
    /// <param name="index0">Index of lower bounding tick.</param>
    /// <param name="index1">Index of upper bounding tick.</param>
    /// <returns></returns>
    private void FindRegion(double[] values, out int index0, out int index1)
    {
      // The values array may contain lots of consecutive NaNs.
      for (int i = 0; i < values.Length - 1; i++)
      {
        if (double.IsNaN(values[i]))
          continue;

        for (int j = i + 1; j < values.Length; j++)
        {
          //Rhino.RhinoApp.WriteLine(
          //  string.Format("[{0}, {1}] = [{2:0.0}, {3:0.0}]", i, j, values[i], values[j]));

          if (double.IsNaN(values[j]))
            continue;

          if (values[i] < _target && values[j] > _target)
          {
            index0 = i;
            index1 = j;
            return;
          }

          if (values[i] > _target && values[j] < _target)
          {
            index0 = i;
            index1 = j;
            return;
          }

          break;
        }
      }
      index0 = -1;
      index1 = -1;
    }
    /// <summary>
    /// Compute the value associated with a specific slider position.
    /// </summary>
    /// <param name="tick">Slider tick.</param>
    private double ComputeValue(int tick)
    {
      if (_cache.ContainsKey(tick))
        return _cache[tick];

      _slider.TickValue = tick;
      _doc.NewSolution(false);
      double val = ResolveValue();

      _cache.Add(tick, val);
      return val;
    }
    /// <summary>
    /// Resolve what number is inside the target parameter.
    /// All non-null and non-NaN values are averaged. If the
    /// parameter contains no values, NaN is returned.
    /// </summary>
    private double ResolveValue()
    {
      GH_Structure<GH_Number> data = _param.VolatileData as GH_Structure<GH_Number>;

      double number = 0.0;
      int count = 0;

      foreach (GH_Number goo in data.AllData(true))
      {
        if (!Rhino.RhinoMath.IsValidDouble(goo.Value))
          continue;

        number += goo.Value;
        count++;
      }

      // This is a problem, the algorithm actually isn't equipped to deal with NaNs yet...
      if (count == 0)
        return double.NaN;

      return number / count;
    }
    /// <summary>
    /// Tests whether a specific value is close enough.
    /// This can be made customizable.
    /// </summary>
    private bool IsAcceptable(double number)
    {
      return Math.Abs(number - _target) < 1e-2;
    }
  }
# ---------- end c_script ----------
preview = CustomPreview(Geometry=ln, Material=gradient)
