# Grasshopper definition RocFall.gh (Grasshopper 1.0.7)
# plug-ins: Kangaroo2 Components, Section To XY

collision_strength = Slider(1, range=0..10)
brep = Brep(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)
radius = Slider(1, range=0..10)
brep_2 = Brep(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)
negative = Negative(Value=Slider(0.103, range=0..1))
populate_geometry = PopulateGeometry(Geometry=brep, Count=Slider(200, range=0..10000), Seed=1)
Z = UnitZ(Factor=negative)
spc = SolidPointCollide(Points=populate_geometry, Solid=brep_2, Interior=False, Unidirectional=Toggle(True), Strength=Slider(1, range=0..100))
reset = Button()
sc = SphereCollide(Points=populate_geometry, Radius=radius, Strength=collision_strength)
load = Load(Point=populate_geometry, ForceVector=Z)
on = BooleanToggle(True)
relay = Relay()
solver = Solver(GoalObjects=[sc, spc, load], Reset=reset, Threshold=1e-15, Tolerance=0.01, On=on)  # -> I, V, O
deconstruct_vector = DeconstructVector(Vector=solver.V)  # -> XComponent, YComponent, ZComponent
deconstruct_vector_2 = DeconstructVector(Vector=solver.V)  # -> XComponent, YComponent, ZComponent
number_slider = Slider(100, range=0..100)
mesh = Mesh(<mesh referenced from the Rhino model>)
dotdisplay = DotDisplay(Point=solver.V)
concavity = Concavity(Mesh=mesh)  # -> Mesh, Colors, Tags, Concavity; disabled
remesh_triangular = RemeshTriangular(Mesh=mesh, Grid=Slider(50, range=0..100))  # disabled
slope = Slope(Mesh=mesh)  # -> Mesh, Colors, Tags, Slope; disabled
