# Grasshopper definition Sandwich Model Results.gh (Grasshopper 1.0.7)

# ----
# Faces (N1-4)
path = FilePath("Y:\Users\JA\faces.txt")
file = ReadFile(File=path, PerLineParse=True)
split = StringSplit(String=file, Separators="\t")
flip = FlipMatrix(Data=split)
bang = ExplodeTree(Data=flip)  # -> Branch0, Branch1, Branch2, Branch3

# ----
# Results
path_2 = FilePath("C:\Users\Jiwoo Ahn\Desktop\Sandwich Model\BarSizeDifference_A1.csv")
file_2 = ReadFile(File=path_2, PerLineParse=True)
split_2 = StringSplit(String=file_2, Separators=",")
flip_2 = FlipMatrix(Data=split_2)
bang_2 = ExplodeTree(Data=flip_2)  # -> Branch0, Branch1, Branch2, Branch3, Branch4, Branch5, Branch6

# ----
# Node (XYZ)
path_3 = FilePath("Y:\Users\JA\vertices.txt")
file_3 = ReadFile(File=path_3, PerLineParse=True)
split_3 = StringSplit(String=file_3, Separators="\t")
flip_3 = FlipMatrix(Data=split_3)
bang_3 = ExplodeTree(Data=flip_3)  # -> Branch0, Branch1, Branch2
pt = ConstructPoint(XCoordinate=bang_3.Branch0, YCoordinate=bang_3.Branch1, ZCoordinate=bang_3.Branch2)

bnd = Bounds(Numbers=bang_3.Branch2)
bnd_2 = Bounds(Numbers=bang_3.Branch0)
bnd_3 = Bounds(Numbers=bang_3.Branch1)
cluster = Cluster(nodes=pt, n1=bang.Branch0, n2=bang.Branch1, n3=bang.Branch2, n4=bang.Branch3)
cluster_2 = Cluster(nodes=pt, n1=bang.Branch0, n2=bang.Branch1, n3=bang.Branch2, n4=bang.Branch3)  # disabled
number_slider = Slider(5, range=0..10)
dedomain = DeconstructDomain(Domain=bnd_2)  # -> Start, End
dedomain_2 = DeconstructDomain(Domain=bnd_3)  # -> Start, End
dedomain_3 = DeconstructDomain(Domain=bnd)  # -> Start, End
list_length = ListLength(List=flatten(cluster))
subtraction = Subtraction(A=dedomain.End, B=dedomain.Start)
subtraction_2 = Subtraction(A=dedomain_2.End, B=dedomain_2.Start)
cluster_3 = Cluster_2(x1=dedomain.Start, y1=dedomain_2.End, Z=dedomain_3.Start)
dup = DuplicateData(Data=cluster, Number=number_slider, Order=True)
addition = Addition(A=Slider(10, range=0..10), B=subtraction)
number_slider_2 = Slider(10, range=0..10)
series = Series(Start=Slider(0, range=0..100), Step=addition, Count=number_slider)
vec = VectorXYZ(XComponent=series, YComponent=0, ZComponent=0)  # -> Vector, Length
duplicate_data = DuplicateData(Data=graft(vec.Vector), Number=list_length, Order=True)  # -> flatten(Data)
move = Move(Geometry=dup, Motion=duplicate_data)  # -> Geometry, Transform
move_2 = Move(Geometry=cluster_3, Motion=vec.Vector)  # -> Geometry, Transform
cluster_4 = Cluster_3(
    result=[bang_2.Branch2, bang_2.Branch3, bang_2.Branch4, bang_2.Branch5, bang_2.Branch6],
    legend_box=graft(move_2.Geometry))  # -> graft(C)
m_explode = MeshExplode(M=move.Geometry, N=True)  # -> out, A; inputs M: Mesh
# ---------- m_explode: VB ----------
    Component.Params.Input(0).Name = "Mesh"
    Component.Params.Input(0).Description = "Open or closed mesh"
    Component.Params.Input(1).Name = "Modify Normals"
    Component.Params.Input(1).Description = "An optional boolean that specifies whether vertex normals will be maintained if false or recalculated with the new face"

    Component.Params.Output(1).Name = "Mesh"
    Component.Params.Output(1).Description = "If successful, a list of valid meshes"

    If m IsNot Nothing Then
      Dim i As Integer

      Dim clrB As Boolean
      Dim mshs As New list(Of mesh)
      Dim mf As Rhino.Geometry.Collections.MeshFaceList = Nothing
      Dim mv As Rhino.Geometry.Collections.MeshVertexList = Nothing
      Dim mn As Rhino.Geometry.Collections.MeshVertexNormalList = Nothing
      Dim mc As Rhino.Geometry.Collections.MeshVertexColorList = Nothing

      If m.VertexColors.count() > 0 Then clrB = True Else m.VertexColors.CreateMonotoneMesh(color.White)
      If m.Normals.Count() < 1 Then m.Normals.ComputeNormals()
      mf = m.Faces
      mv = m.Vertices
      mn = m.Normals
      mc = m.VertexColors

      For i = 0 To mf.Count() - 1 Step 1
        Dim pts As New list(Of point3d)
        Dim fc As New meshFace
        Dim clr As New list(Of Color)
        Dim vec As New list(Of Vector3f)
        Dim msh As New mesh

        pts.add(New point3d(mv(mf(i).A)))
        pts.add(New point3d(mv(mf(i).B)))
        pts.add(New point3d(mv(mf(i).C)))
        If mf(i).IsQuad Then pts.add(New point3d(mv(mf(i).D)))

        clr.add(mc(mf(i).A))
        clr.add(mc(mf(i).B))
        clr.add(mc(mf(i).C))
        If mf(i).IsQuad Then clr.add(mc(mf(i).D))

        If N Then
          vec.add(mn(mf(i).A))
          vec.add(mn(mf(i).B))
          vec.add(mn(mf(i).C))
          If mf(i).IsQuad Then vec.add(mn(mf(i).D))
        End If

        If mf(i).IsQuad Then fc = New meshFace(0, 1, 2, 3) Else fc = New meshface(0, 1, 2)

        msh.Vertices.AddVertices(pts.toarray())
        msh.Faces.AddFace(fc)
        If clrB Then msh.VertexColors.AppendColors(clr.toarray())
        If N Then msh.Normals.AddRange(vec.toarray()) Else msh.Normals.ComputeNormals()
        mshs.add(msh)
      Next

      A = mshs
    End If
# ---------- end m_explode ----------
demesh = DeconstructMesh(Mesh=m_explode.A)  # -> Vertices, Faces, Colours, Normals
bakeattributes = CSharpScript(activate=Toggle(False))  # -> out; inputs objs: list, names: list of String, layers: list of String, colors: list of Color, pWidths: list of Double, wiresEach: list of Int32, materials: list, activate: Boolean, groupListTgthr: Boolean; disabled
# ---------- bakeattributes: C# ----------
    //Inserts geometry into the Rhino document, with custom attributes
    //Written by Giulio Piacentino
    //Version written 2011 10 18 - for Grasshopper 0.8.52

    if (activate)
    {
      int groupIndex = -1;
      if(groupListTgthr)
        groupIndex = doc.Groups.Add();

      for(int i = 0; i < objs.Count; i++)
      {
        object obj = objs[i];
        if(obj == null)
        {
          Print("No object to bake");
          return;
        }

        //Make new attribute to set name
        Rhino.DocObjects.ObjectAttributes att = new Rhino.DocObjects.ObjectAttributes();

        string name = names.Count > 0 ? names[i % names.Count] : null;
        //Set object name
        if(!string.IsNullOrEmpty(name))
        {
          att.Name = name;
        }

        Color color = colors.Count > 0 ? colors[i % colors.Count] : new Color();
        //Set color
        if(!color.IsEmpty)
        {
          att.ColorSource = Rhino.DocObjects.ObjectColorSource.ColorFromObject; //Make the color type "by object"
          att.ObjectColor = color;

          att.PlotColorSource = Rhino.DocObjects.ObjectPlotColorSource.PlotColorFromObject; //Make the plot color type "by object"
          att.PlotColor = color;
        }

        string layer = layers.Count > 0 ? layers[i % layers.Count] : null;
        //Set layer
        if(!string.IsNullOrEmpty(layer) && Rhino.DocObjects.Layer.IsValidName(layer))
        {
          //Get the current layer index
          Rhino.DocObjects.Tables.LayerTable layerTable = doc.Layers;
          int layerIndex = layerTable.Find(layer, true);

          if(layerIndex < 0) //This layer does not exist, we add it
          {
            Rhino.DocObjects.Layer onlayer = new Rhino.DocObjects.Layer(); //Make a new layer
            onlayer.Name = layer;

            layerIndex = layerTable.Add(onlayer); //Add the layer to the layer table
            if (layerIndex > -1) //We manged to add layer!
            {
              att.LayerIndex = layerIndex;
              Print("Added new layer to the document at position " + layerIndex + " named " + layer + ". ");
            } else
              Print("Layer did not add. Try cleaning up your layers."); //This never happened to me.
          }
          else
            att.LayerIndex = layerIndex; //We simply add to the existing layer
        }


        double pWidth = pWidths.Count > 0 ? pWidths[i % pWidths.Count] : 0;
        //Set plotweight
        if(pWidth > 0)
        {
          att.PlotWeightSource = Rhino.DocObjects.ObjectPlotWeightSource.PlotWeightFromObject;
          att.PlotWeight = pWidth;
        }


        object material = materials.Count > 0 ? materials[i % materials.Count] : null;
        //Set material
        bool materialByName = !string.IsNullOrEmpty(material as string);
        Rhino.Display.DisplayMaterial inMaterial = material as Rhino.Display.DisplayMaterial;
        if(material is Color)
        {
          inMaterial = new Rhino.Display.DisplayMaterial((Color) material);
        }
        if(material != null && inMaterial == null && !materialByName)
        {
          if(!(material is string))
          {
            try //We also resort to try with IConvertible
            {
              inMaterial = (Rhino.Display.DisplayMaterial) Convert.ChangeType(material, typeof(Rhino.Display.DisplayMaterial));
            }
            catch(InvalidCastException)
            {
            }
          }
        }
        if(inMaterial != null || materialByName)
        {
          string matName;

          if(!materialByName)
          {
            matName = string.Format("A:{0}-D:{1}-E:{2}-S:{3},{4}-T:{5}",
              Format(inMaterial.Ambient),
              Format(inMaterial.Diffuse),
              Format(inMaterial.Emission),
              Format(inMaterial.Specular),
              inMaterial.Shine.ToString(),
              inMaterial.Transparency.ToString()
              );
          }
          else
          {
            matName = (string) material;
          }

          int materialIndex = doc.Materials.Find(matName, true);
          if(materialIndex < 0 && !materialByName) //Material does not exist and we have its specs
          {
            materialIndex = doc.Materials.Add(); //Let's add it
            if(materialIndex > -1)
            {
              Print("Added new material at position " + materialIndex + " named \"" + matName + "\". ");
              Rhino.DocObjects.Material m = doc.Materials[materialIndex];
              m.Name = matName;
              m.AmbientColor = inMaterial.Ambient;
              m.DiffuseColor = inMaterial.Diffuse;
              m.EmissionColor = inMaterial.Emission;
              //m.ReflectionColor = no equivalent
              m.SpecularColor = inMaterial.Specular;
              m.Shine = inMaterial.Shine;
              m.Transparency = inMaterial.Transparency;
              //m.TransparentColor = no equivalent
              m.CommitChanges();

              att.MaterialSource = Rhino.DocObjects.ObjectMaterialSource.MaterialFromObject;
              att.MaterialIndex = materialIndex;
            }
            else
              Print("Material did not add. Try cleaning up your materials."); //This never happened to me.
          }
          else if(materialIndex < 0 && materialByName) //Material does not exist and we do not have its specs. We do nothing
          {
            Print("Warning: material name not found. I cannot set the source to this material name. Add a material with name: " + matName);
          }
          else
          {
            //If this material exists, we do not replace it!
            att.MaterialSource = Rhino.DocObjects.ObjectMaterialSource.MaterialFromObject;
            att.MaterialIndex = materialIndex;
          }
        }


        int wires = wiresEach.Count > 0 ? wiresEach[i % wiresEach.Count] : 0;
        //Set wire density
        if(wires == -1 || wires > 0)
        {
          att.WireDensity = wires;
        }

        Bake(obj, att, groupIndex);
      }
    }
    else
    {
      Print("Inactive");
    }
# ---------- bakeattributes: C# additional code ----------
  void Bake(object obj, Rhino.DocObjects.ObjectAttributes att, int groupIndex)
  {
    if(obj == null)
      return;

    Guid id;

    //Bake to the right type of object
    if(obj is GeometryBase)
    {
      GeometryBase geomObj = obj as GeometryBase;

      switch(geomObj.ObjectType)
      {
        case Rhino.DocObjects.ObjectType.Brep:
          id = doc.Objects.AddBrep(obj as Brep, att);
          break;
        case Rhino.DocObjects.ObjectType.Curve:
          id = doc.Objects.AddCurve(obj as Curve, att);
          break;
        case Rhino.DocObjects.ObjectType.Point:
          id = doc.Objects.AddPoint((obj as Rhino.Geometry.Point).Location, att);
          break;
        case Rhino.DocObjects.ObjectType.Surface:
          id = doc.Objects.AddSurface(obj as Surface, att);
          break;
        case Rhino.DocObjects.ObjectType.Mesh:
          id = doc.Objects.AddMesh(obj as Mesh, att);
          break;
        case (Rhino.DocObjects.ObjectType) 1073741824://Rhino.DocObjects.ObjectType.Extrusion:
          id = (Guid) typeof(Rhino.DocObjects.Tables.ObjectTable).InvokeMember("AddExtrusion", BindingFlags.Instance | BindingFlags.InvokeMethod, null, doc.Objects, new object[]{obj, att});
          break;
        case Rhino.DocObjects.ObjectType.PointSet:
          id = doc.Objects.AddPointCloud(obj as Rhino.Geometry.PointCloud, att); //This is a speculative entry
          break;
        default:
          Print("The script does not know how to handle this type of geometry: " + obj.GetType().FullName);
          return;
      }
    }
    else
    {
      Type objectType = obj.GetType();

      if(objectType == typeof(Arc))
      {
        id = doc.Objects.AddArc((Arc) obj, att);
      }
      else if(objectType == typeof(Box))
      {
        id = doc.Objects.AddBrep(((Box) obj).ToBrep(), att);
      }
      else if(objectType == typeof(Circle))
      {
        id = doc.Objects.AddCircle((Circle) obj, att);
      }
      else if(objectType == typeof(Ellipse))
      {
        id = doc.Objects.AddEllipse((Ellipse) obj, att);
      }
      else if(objectType == typeof(Polyline))
      {
        id = doc.Objects.AddPolyline((Polyline) obj, att);
      }
      else if(objectType == typeof(Sphere))
      {
        id = doc.Objects.AddSphere((Sphere) obj, att);
      }
      else if(objectType == typeof(Point3d))
      {
        id = doc.Objects.AddPoint((Point3d) obj, att);
      }
      else if(objectType == typeof(Line))
      {
        id = doc.Objects.AddLine((Line) obj, att);
      }
      else if(objectType == typeof(Vector3d))
      {
        Print("Impossible to bake vectors");
        return;
      }
      else if(obj is IEnumerable)
      {
        int newGroupIndex;
        if(groupIndex == -1)
          newGroupIndex = doc.Groups.Add();
        else
          newGroupIndex = groupIndex;
        foreach(object o in obj as IEnumerable)
        {
          Bake(o, att, newGroupIndex);
        }
        return;
      }
      else
      {
        Print("Unhandled type: " + objectType.FullName);
        return;
      }
    }

    if(groupIndex != -1)
    {
      doc.Groups.AddToGroup(groupIndex, id);
      Print("Added " + obj.GetType().Name + " to group number " + groupIndex);
    }
    else
      Print("Added " + obj.GetType().Name);
  }

  static string Format(Color c)
  {
    return (new System.Text.StringBuilder("A")).Append(c.A.ToString()).Append("R").Append(c.R.ToString()).Append("G")
      .Append(c.G.ToString()).Append("B").Append(c.B.ToString()).ToString();
  }
# ---------- end bakeattributes ----------
conmesh = ConstructMesh(Vertices=demesh.Vertices, Faces=demesh.Faces, Colours=cluster_4)

# ==== cluster Cluster
n1 = ClusterInput()
n2 = ClusterInput()
n3 = ClusterInput()
n4 = ClusterInput()

# ----
# Grasshopper indexing starts at 0
expression = Expression(x=n1, Expression="x-1")
expression_2 = Expression(x=n4, Expression="x-1")
expression_3 = Expression(x=n2, Expression="x-1")
expression_4 = Expression(x=n3, Expression="x-1")

nodes = ClusterInput()

# ----
# Create mesh from STRAND7 (Unused)
expression_5 = Expression(x=n4, Expression="if(x ≠ \" \", True, False)")

sift = SiftPattern(List=expression, SiftPattern=expression_5)  # -> Output0, Output1
sift_2 = SiftPattern(List=expression_3, SiftPattern=expression_5)  # -> Output0, Output1
sift_3 = SiftPattern(List=expression_2, SiftPattern=expression_5)  # -> Output0, Output1
sift_4 = SiftPattern(List=expression_4, SiftPattern=expression_5)  # -> Output0, Output1

quad = MeshQuad(CornerA=sift.Output1, CornerB=sift_2.Output1, CornerC=sift_4.Output1, CornerD=sift_3.Output1)
triangle = MeshTriangle(CornerA=sift.Output0, CornerB=sift_2.Output0, CornerC=sift_4.Output0)

combine = CombineData(Input0=quad, Input1=triangle)  # -> Result, Index

conmesh = ConstructMesh(Vertices=nodes, Faces=combine.Result)

M = ClusterOutput(conmesh)

# ==== cluster Cluster_2
y1 = ClusterInput()
x1 = ClusterInput()
Z = ClusterInput()
expression = Expression(x=x1, Expression="x-2")
expression_2 = Expression(x=y1, Expression="x-2")
expression_3 = Expression(x=expression_2, Expression="x-20")
expression_4 = Expression(x=expression, Expression="x-5")
Z_2 = UnitZ(Factor=Z)
pt = ConstructPoint(XCoordinate=expression, YCoordinate=expression_2, ZCoordinate=0)
pt_2 = ConstructPoint(XCoordinate=expression_4, YCoordinate=expression_3, ZCoordinate=0)
rec_2pt = Rectangle2Pt(Plane=PlaneXY(0, 0, 0), PointA=pt, PointB=pt_2, Radius=0)  # -> Rectangle, Length
move = Move(Geometry=rec_2pt.Rectangle, Motion=Z_2)  # -> Geometry, Transform
legend_box = ClusterOutput(move.Geometry)

# ==== cluster Cluster_3
result = ClusterInput()
legend_box = ClusterInput()
split = SplitList(List=result, Index=1)  # -> ListA, ListB
number_slider = Slider(10, range=0..10)
area = Area(Geometry=legend_box)  # -> Area, Centroid
cp = ControlPoints(Curve=legend_box)  # -> Points, Weights, Knots
bnd = Bounds(Numbers=split.ListB)
pdecon = Deconstruct(Point=cp.Points)  # -> XComponent, YComponent, ZComponent
pdecon_2 = Deconstruct(Point=area.Centroid)  # -> XComponent, YComponent, ZComponent
dedomain = DeconstructDomain(Domain=bnd)  # -> Start, End
expression = Expression(x=dedomain.Start, y=dedomain.End, z=number_slider, Expression="(y-x)/z")
expression_2 = Expression(x=number_slider, Expression="x+1")
bnd_2 = Bounds(Numbers=pdecon.YComponent)
dedomain_2 = DeconstructDomain(Domain=bnd_2)  # -> Start, End
series = Series(Start=dedomain.Start, Step=expression, Count=expression_2)
subtraction = Subtraction(A=dedomain_2.Start, B=Slider(3, range=0..10))
pt = ConstructPoint(XCoordinate=pdecon_2.XComponent, YCoordinate=subtraction, ZCoordinate=pdecon_2.ZComponent)
expression_3 = Expression(x=series, Expression="Format(\"{0:0}\",x)")
tag = TextTag(Location=pt, Text=split.ListA)  # disabled
gradient = Gradient(
    LowerLimit=dedomain.Start,
    UpperLimit=dedomain.End,
    Parameter=split.ListB,
    stops=[0: RGB(243, 57, 0), 0.1: RGB(236, 27, 60), 0.2: RGB(210, 0, 118), 0.3: RGB(103, 0, 120), 0.4: RGB(39, 72, 161), 0.5: RGB(1, 192, 229), 0.6: RGB(18, 178, 90), 0.7: RGB(79, 186, 8), 0.8: RGB(220, 237, 32), 0.9: RGB(247, 159, 20), 1: RGB(243, 57, 0)])
gradient_2 = Gradient(
    LowerLimit=dedomain.Start,
    UpperLimit=dedomain.End,
    Parameter=series,
    stops=[0: RGB(243, 57, 0), 0.1: RGB(236, 27, 60), 0.2: RGB(210, 0, 118), 0.3: RGB(103, 0, 120), 0.4: RGB(39, 72, 161), 0.5: RGB(1, 192, 229), 0.6: RGB(18, 178, 90), 0.7: RGB(79, 186, 8), 0.8: RGB(220, 237, 32), 0.9: RGB(247, 159, 20), 1: RGB(243, 57, 0)])
tag_2 = TextTag3D(Location=pt, Text=split.ListA, Size=1, Justification=7)
C = ClusterOutput(gradient)
legend = Legend(Colour=gradient_2, Tags=expression_3, Rectangle=legend_box, LegendType=101)
