# Grasshopper definition Section Lines.gh (Grasshopper 1.0.7)

path = FilePath("C:\Users\Jiwoo Ahn\Desktop\PSM3857\FLAC3D Run01\section_lines.txt")
file = ReadFile(File=path, PerLineParse=True)
split = StringSplit(String=file, Separators="\t")
flip = FlipMatrix(Data=split)
bang = ExplodeTree(Data=flip)  # -> Branch0, Branch1, Branch2, Branch3, Branch4
expression = Expression(x=bang.Branch4, Expression="90-x")
pt = ConstructPoint(XCoordinate=bang.Branch0, YCoordinate=bang.Branch1, ZCoordinate=bang.Branch2)
Y = UnitY(Factor=1)
series = Series(Start=Slider(1, range=0..1), Step=Slider(1, range=0..1), Count=Slider(4, range=0..10))
rad = Radians(Degrees=expression)
expression_2 = Expression(x=series, Expression="Format(\"Section {0}\", x)")
circle = CircleCNR(Center=pt, Normal=Y, Radius=Slider(115, range=0..1000))
rotate = Rotate(Geometry=circle, Angle=rad, Plane=pt)  # -> Geometry, Transform
tag = TextTag(Location=pt, Text=expression_2)
