# Grasshopper definition SelCrv.gh (Grasshopper 1.0.7)

mesh = Mesh(<mesh referenced from the Rhino model>)
number = Number(-1)
point = Point([<point referenced from the Rhino model> x5000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])
unit_z = UnitZ(Factor=1)
unit_z_2 = UnitZ(Factor=number)
project_point = ProjectPoint(Point=point, Direction=unit_z_2, Geometry=mesh)  # -> Point, Index
project_point_2 = ProjectPoint(Point=point, Direction=unit_z, Geometry=mesh)  # -> Point, Index
combine_data = CombineData(Input0=project_point_2.Point, Input1=project_point.Point)  # -> Result, Index
distance = Distance(PointA=combine_data.Result)
includes = Includes(Value=distance, Domain="0.00001 to 10000")  # -> Includes, Deviation
dispatch = Dispatch(DispatchPattern=includes.Includes)  # -> ListA, ListB
expression = Expression(x=distance, Expression="Format(\"{0:0}\", x)")  # disabled
text_tag = TextTag(Text=expression)  # disabled
cull_vertices = CullVertices(Mesh=mesh, Pattern=includes.Deviation, Shrink=True)
point_2 = Point(dispatch.ListB)
point_3 = Point(dispatch.ListA)
mesh_2 = Mesh(cull_vertices)
custom_preview = CustomPreview(
    Geometry=combine_data.Result,
    Material={diffuse=RGB(221, 160, 221), emission=RGB(66, 48, 66), shine=0.5, specular=RGB(255, 255, 255), transparency=0})
