# Grasshopper definition Slide3 - Section - WIP.gh (Grasshopper 1.0.7)

# ----
# Adjust distance to section line
number_slider = Slider(20, range=0..100)

# ----
# Section Line
crv = Curve(<curve referenced from the Rhino model>)

# ----
# Import Data as .txt file (tab delimited)
path = FilePath("D:\Jiwoo Ahn\Desktop\ColumnResults.txt")
file = ReadFile(File=path, PerLineParse=True)
split = TextSplit(Text=file, Separators="\t")
flip = FlipMatrix(Data=split)  # -> simplify(Data)
split_2 = SplitList(List=flip, Index=Slider(1, range=0..1))  # -> ListA, ListB
bang = ExplodeTree(Data=split_2.ListB)  # -> Branch0, Branch1, Branch2, Branch3, Branch4, Branch5, Branch6, Branch7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

panel = Panel(split_2.ListA)
pt = ConstructPoint(XCoordinate=bang.Branch1, YCoordinate=bang.Branch2, ZCoordinate=0)
division = Division(A=bang.Branch11, B=bang.Branch3)
rad = Radians(Degrees=bang.Branch17)
pt_2 = ConstructPoint(XCoordinate=bang.Branch1, YCoordinate=bang.Branch2, ZCoordinate=bang.Branch20)
pt_3 = ConstructPoint(XCoordinate=bang.Branch1, YCoordinate=bang.Branch2, ZCoordinate=bang.Branch21)
neg = Negative(Value=rad)

expression = Expression(x=division, Expression="sqrt(x)/2")
neg_2 = Negative(Value=expression)
dom = ConstructDomain(DomainStart=neg_2, DomainEnd=expression)
rectangle = Rectangle(Plane=pt_2, XSize=dom, YSize=dom, Radius=0)  # -> Rectangle, Length
rectangle_2 = Rectangle(Plane=pt_3, XSize=dom, YSize=dom, Radius=0)  # -> Rectangle, Length
X = UnitX(Factor=1)
rot3d = Rotate3D(Geometry=rectangle_2.Rectangle, Angle=neg, Center=pt_3, Axis=X)  # -> Geometry, Transform
entwine = Entwine(Branch00=rectangle.Rectangle, Branch01=rot3d.Geometry, FlattenInputs=True)
flip_2 = FlipMatrix(Data=entwine)
loft = Loft(Curves=flip_2, Options={Adjust=False, Closed=False, LoftEnds=0, LoftSimp=0, LoftType=0, Rebuild=10, Refit=0.01})
cap = CapHoles(Brep=loft)
preview = CustomPreview(
    Geometry=cap,
    Material={diffuse=RGB(221, 160, 221), emission=RGB(66, 48, 66), shine=0.5, specular=RGB(255, 255, 255), transparency=0})

crv_cp = CurveClosestPoint(Point=pt, Curve=crv)  # -> Point, Parameter, Distance
smaller = SmallerThan(FirstNumber=crv_cp.Distance, SecondNumber=number_slider)  # -> SmallerThan, OrEqualTo
colour = ColourPicker(PickedColour=RGB(0, 255, 128))
dispatch = Dispatch(List=crv_cp.Point, DispatchPattern=smaller.SmallerThan)  # -> ListA, ListB
dispatch_2 = Dispatch(List=pt, DispatchPattern=smaller.SmallerThan)  # -> ListA, ListB
pt_4 = Point(dispatch_2.ListA)
pt_5 = Point(dispatch.ListA)
preview_2 = CustomPreview(
    Geometry=pt_4,
    Material={diffuse=RGB(221, 160, 221), emission=RGB(66, 48, 66), shine=0.5, specular=RGB(255, 255, 255), transparency=0})
preview_3 = CustomPreview(Geometry=pt_5, Material=colour)
