# Grasshopper definition Slide3 - Section.gh (Grasshopper 1.0.7)

# ----
# 1. Import Data as .txt file (tab delimited)
path = FilePath("D:\Jiwoo Ahn\Desktop\Test1.txt")
file = ReadFile(File=path, PerLineParse=True)
split = TextSplit(Text=file, Separators="\t")
flip = FlipMatrix(Data=split)  # -> simplify(Data)
split_2 = SplitList(List=flip, Index=Slider(1, range=0..1))  # -> ListA, ListB
bang = ExplodeTree(Data=split_2.ListB)  # -> Branch0, Branch1, Branch2, Branch3, Branch4, Branch5, Branch6, Branch7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

# ----
# 2. Define section Line
crv = Curve(<curve referenced from the Rhino model>)

panel = Panel(split_2.ListA)
pt = ConstructPoint(XCoordinate=bang.Branch1, YCoordinate=bang.Branch2, ZCoordinate=0)
division = Division(A=bang.Branch11, B=bang.Branch3)

# ----
# 3. Adjust distance to section line
number_slider = Slider(15, range=0..100)

crv_cp = CurveClosestPoint(Point=pt, Curve=crv)  # -> Point, Parameter, Distance
smaller = SmallerThan(FirstNumber=crv_cp.Distance, SecondNumber=number_slider)  # -> SmallerThan, OrEqualTo
dispatch = Dispatch(List=crv_cp.Point, DispatchPattern=smaller.SmallerThan)  # -> ListA, ListB
dispatch_2 = Dispatch(List=pt, DispatchPattern=smaller.SmallerThan)  # -> ListA, ListB
colour = ColourPicker(PickedColour=RGB(0, 255, 128))

# ----
# 4. Right click, and press
# "copy data only"
# paste back into spreadsheet
panel_2 = Panel(smaller.SmallerThan)

pt_2 = Point(dispatch_2.ListA)
pt_3 = Point(dispatch.ListA)
preview = CustomPreview(
    Geometry=pt_2,
    Material={diffuse=RGB(221, 160, 221), emission=RGB(66, 48, 66), shine=0.5, specular=RGB(255, 255, 255), transparency=0})
preview_2 = CustomPreview(Geometry=pt_3, Material=colour)
