# Grasshopper definition Strand7 plates.gh (Grasshopper 1.0.7)

# ----
# Faces (N1-4)
path = FilePath("Y:\Users\JA\faces.txt")
file = ReadFile(File=path, PerLineParse=True)
split = StringSplit(String=file, Separators="\t")
flip = FlipMatrix(Data=split)
bang = ExplodeTree(Data=flip)  # -> Branch0, Branch1, Branch2, Branch3

# ----
# Results
path_2 = FilePath("Y:\Users\JA\Results.txt")
file_2 = ReadFile(File=path_2, PerLineParse=True)
split_2 = StringSplit(String=file_2, Separators="\t")
flip_2 = FlipMatrix(Data=split_2)
bang_2 = ExplodeTree(Data=flip_2)  # -> Branch0, Branch1, Branch2, Branch3, Branch4, Branch5, Branch6, Branch7

# ----
# Node (XYZ)
path_3 = FilePath("Y:\Users\JA\vertices.txt")
file_3 = ReadFile(File=path_3, PerLineParse=True)
split_3 = StringSplit(String=file_3, Separators="\t")
flip_3 = FlipMatrix(Data=split_3)
bang_3 = ExplodeTree(Data=flip_3)  # -> Branch0, Branch1, Branch2
pt = ConstructPoint(XCoordinate=bang_3.Branch0, YCoordinate=bang_3.Branch1, ZCoordinate=bang_3.Branch2)

split_4 = SplitList(List=bang_2.Branch3, Index=1)  # -> ListA, ListB
bnd = Bounds(Numbers=split_4.ListB)

# ----
# Grasshopper indexing starts at 0
expression = Expression(x=bang.Branch0, Expression="x-1")
expression_2 = Expression(x=bang.Branch3, Expression="x-1")
expression_3 = Expression(x=bang.Branch1, Expression="x-1")
expression_4 = Expression(x=bang.Branch2, Expression="x-1")

sort = SortList(Keys=split_4.ListB)  # -> Keys, ValuesA
dedomain = DeconstructDomain(Domain=bnd)  # -> Start, End

# ----
# Create mesh from STRAND7 (Unused)
expression_5 = Expression(x=bang.Branch3, Expression="if(x ≠ \" \", True, False)")
dispatch = Dispatch(List=expression, DispatchPattern=expression_5)  # -> ListA, ListB
dispatch_2 = Dispatch(List=expression_3, DispatchPattern=expression_5)  # -> ListA, ListB
dispatch_3 = Dispatch(List=expression_4, DispatchPattern=expression_5)  # -> ListA, ListB
dispatch_4 = Dispatch(List=expression_2, DispatchPattern=expression_5)  # -> ListA, ListB
quad = MeshQuad(CornerA=dispatch.ListA, CornerB=dispatch_2.ListA, CornerC=dispatch_3.ListA, CornerD=dispatch_4.ListA)
triangle = MeshTriangle(CornerA=dispatch.ListB, CornerB=dispatch_2.ListB, CornerC=dispatch_3.ListB)
conmesh = ConstructMesh(Vertices=pt, Faces=[triangle, quad])

expression_6 = Expression(x=sort.Keys, Expression="Round(x,1)")
gradient = Gradient(
    LowerLimit=dedomain.Start,
    UpperLimit=dedomain.End,
    Parameter=split_4.ListB,
    stops=[0: RGB(243, 57, 0), 0.1: RGB(236, 27, 60), 0.2: RGB(210, 0, 118), 0.3: RGB(103, 0, 120), 0.4: RGB(39, 72, 161), 0.5: RGB(1, 192, 229), 0.6: RGB(18, 178, 90), 0.7: RGB(79, 186, 8), 0.8: RGB(220, 237, 32), 0.9: RGB(247, 159, 20), 1: RGB(243, 57, 0)])
rec = Rectangle({Plane=PlaneXY(50, 0, 0), Size=Domain2(u=0..6, v=0..40)})
item = ListItem(List=pt, Index=expression, Wrap=True)
item_2 = ListItem(List=pt, Index=expression_3, Wrap=True)
item_3 = ListItem(List=pt, Index=expression_4, Wrap=True)
item_4 = ListItem(List=pt, Index=expression_2, Wrap=True)
srf4pt = _4PointSurface(CornerA=item, CornerB=item_2, CornerC=item_3, CornerD=item_4)
custom_preview = CustomPreview(Geometry=srf4pt, Material=gradient)
