# Grasshopper definition SurfaceFromContour_CurveDistance.gh (Grasshopper 1.0.7)

contour_lines = Curve([<curve referenced from the Rhino model> x89])
project_point = ProjectPoint(Direction=Vector(0, 0, -1))  # -> Point, Index
unit_z = UnitZ(Factor=1)
text = Text("1")
patch = Patch(Curves=contour_lines, Spans=20, Flexibility=Slider(10, range=0..10), Trim=text)
project = Project(Curve=contour_lines, Brep=patch, Direction=unit_z)
control_points = ControlPoints(Curve=contour_lines)  # -> Points, Weights, Knots
distance = Distance(PointB=control_points.Points)
expression = Expression(x=distance, y=Slider(3, range=0..10), Expression="Format(\"{0:0.0}\", x, y)")
bounds = Bounds(Numbers=distance)
distance_2 = Distance()
deconstruct_domain = DeconstructDomain(Domain=bounds)  # -> Start, End
gradient = Gradient(
    LowerLimit=deconstruct_domain.Start,
    UpperLimit=deconstruct_domain.End,
    Parameter=distance,
    stops=[0: RGB(234, 38, 0), 0.25: RGB(234, 126, 0), 0.5: RGB(254, 244, 84), 0.75: RGB(173, 203, 249), 1: RGB(75, 107, 169)])
text_tag_3d = TextTag3D(Location=control_points.Points, Text=expression, Size=Slider(1, range=0..10), Colour=gradient, Justification=7)
custom_preview = CustomPreview(Geometry=contour_lines, Material=gradient)
