# Grasshopper definition TBM V3 (follow alignment).gh (Grasshopper 1.0.7)

segment_thickness_mm = Slider(270, range=0..1000)
number_of_segments = Slider(6, range=2..20)
axis_rotation = Slider(0, range=0..360)
segment_angles_2 = Panel("""24
56
56
56
56
56
56""")
segment_length = Slider(3.4, range=0..5)
segment_angles_1 = Panel("""17
62
52
62
52
62
53""")
tunnel_radius = Slider(3.455, range=0..10)
position = Slider(2, range=0..5)
int = Integer(segment_angles_1)
int_2 = Integer(segment_angles_2)
expression = Expression(R=tunnel_radius, t=segment_thickness_mm, Expression="R-t/1000")
python = GhPythonScript(x=int_2, n=number_of_segments)  # -> out, a; inputs x: list
# ---------- python: Python ----------
__author__ = "Jiwoo Ahn"
__version__ = "2021.01.05"

import rhinoscriptsyntax as rs

if sum(x) != 360:
    a = 'Segment angles add to {0}, must add to 360'.format(sum(x))
elif len(x) != n+1:
    a = 'Number of segment angles must equal {0}'.format(n+1)
else:
    a = 'Inputs are valid'
# ---------- end python ----------
python_2 = GhPythonScript(x=int, n=number_of_segments)  # -> out, a; inputs x: list; same code as python
panel = Panel(python_2.a)
panel_2 = Panel(python.a)

cluster = Cluster(tunnel_radius_m=tunnel_radius, segment_angle=int)
cluster_2 = Cluster(tunnel_radius_m=expression, segment_angle=int)

cluster_3 = Cluster(tunnel_radius_m=tunnel_radius, segment_angle=int_2)
cluster_4 = Cluster(tunnel_radius_m=expression, segment_angle=int_2)

Y = UnitY(Factor=segment_length)
crv = Curve(graft(cluster))
crv_2 = Curve(graft(cluster_2))
crv_3 = Curve(graft(cluster_3))
crv_4 = Curve(graft(cluster_4))
loft = Loft(Curves=[crv_3, crv_4], Options={Adjust=False, Closed=False, LoftEnds=0, LoftSimp=0, LoftType=0, Rebuild=10, Refit=0.01})
loft_2 = Loft(Curves=[crv, crv_2], Options={Adjust=False, Closed=False, LoftEnds=0, LoftSimp=0, LoftType=0, Rebuild=10, Refit=0.01})
move = Move(Geometry=loft, Motion=Y)  # -> Geometry, Transform
loft_3 = Loft(
    Curves=[loft_2, move.Geometry],
    Options={Adjust=False, Closed=False, LoftEnds=0, LoftSimp=0, LoftType=0, Rebuild=10, Refit=0.01})
expression_2 = Expression(x=position, Expression="60*x")
cap = CapHoles(Brep=loft_3)  # -> flatten(Brep)
rad = Radians(Degrees=expression_2)
Y_2 = UnitY(Factor=segment_length)
expression_3 = Expression(x=segment_length, Expression="x/4")
rot3d = Rotate3D(Geometry=cap, Angle=rad, Center=Point(0, 0, 0), Axis=Y_2)  # -> Geometry, Transform
volume = Volume(Geometry=rot3d.Geometry)  # -> Volume, Centroid
neg = Negative(Value=expression_3)
avr = Average(Input=volume.Centroid)
Y_3 = UnitY(Factor=[expression_3, neg])
expression_4 = Expression(x=tunnel_radius, Expression="x+1")
Y_4 = UnitY(Factor=1)
Z = UnitZ(Factor=1)
move_2 = Move(Geometry=avr, Motion=Y_3)  # -> Geometry, Transform
rad_2 = Radians(Degrees=Slider(-0.2, range=-10..10))
circle = CircleCNR(Center=move_2.Geometry, Normal=Y_4, Radius=expression_4)
line = LineSDL(Start=move_2.Geometry, Direction=Z, Length=1)
neg_2 = Negative(Value=rad_2)
number_slider = Slider(1, range=0..1)
rotax = RotateAxis(Geometry=circle, Angle=[rad_2, neg_2], Axis=line)  # -> Geometry, Transform
boundary = BoundarySurfaces(Edges=rotax.Geometry)
split = SplitList(List=boundary, Index=1)  # -> ListA, ListB
split_2 = SplitBrep(Brep=rot3d.Geometry, Cutter=split.ListA)
item = ListItem(List=split_2, Index=number_slider, Wrap=True)  # -> flatten(Item)
expression_5 = Expression(x=segment_length, Expression="-x/4")
split_3 = SplitBrep(Brep=item, Cutter=split.ListB)
number_slider_2 = Slider(5, range=0..10)
Y_5 = UnitY(Factor=expression_5)
item_2 = ListItem(List=split_3, Index=number_slider, Wrap=True)  # -> flatten(Item)
cap_2 = CapHoles(Brep=item_2)
move_3 = Move(Geometry=cap_2, Motion=Y_5)  # -> Geometry, Transform
python_3 = GhPythonScript(x=cluster)  # -> out, Label, R, G, B; inputs x: list
# ---------- python_3: Python ----------
__author__ = "Jiwoo Ahn"
__version__ = "2021.01.05"

import rhinoscriptsyntax as rs



def GetColor(r, g, b):
    #Color = &HFF000000 Or RGB( r*255, g*255, b * 255 )    
    r = r + 0.6
    if r > 1:
        r = r - 1
        g = g + 0.6
        if g > 1:
            g = g - 1
            b = b + 0.6
            if b > 1 :
                b = b - 1
    
    return r, g, b

# the start value of r g b
r = 1
g = 1
b = 1
R = []
G = []
B = []
Label = []
for i in range(0,len(x)): #iterate through all selected objects
    r, g, b = GetColor(r, g, b) #I made a function from your script to modify aColor.
    R.append(int(r * 255))
    G.append(int(g * 255))
    B.append(int(b * 255))
    if i == 0:
        Label.append('Keystone')
    else:
        Label.append("Segment {0}".format(i))
# ---------- end python_3 ----------
volume_2 = Volume(Geometry=move_3.Geometry)  # -> Volume, Centroid
rgb = ColourRGB(Alpha=255, Red=python_3.R, Green=python_3.G, Blue=python_3.B)
unit = UnitVector(Vector=volume_2.Centroid)
move_4 = Move(Geometry=volume_2.Centroid, Motion=unit)  # -> Geometry, Transform
tag = TextTag(Location=move_4.Geometry, Text=python_3.Label, Colour=rgb)

# ----
# Alignment String Test
crv_5 = Curve(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)

bakeattributes = CSharpScript(objs=move_3.Geometry, colors=rgb, activate=Button())  # -> out; inputs objs: list, names: list of String, layers: list of String, colors: list of Color, pWidths: list of Double, wiresEach: list of Int32, materials: list, activate: Boolean, groupListTgthr: Boolean
# ---------- bakeattributes: C# ----------
    //Inserts geometry into the Rhino document, with custom attributes
    //Written by Giulio Piacentino
    //Version written 2011 10 18 - for Grasshopper 0.8.52

    if (activate)
    {
      int groupIndex = -1;
      if(groupListTgthr)
        groupIndex = doc.Groups.Add();

      for(int i = 0; i < objs.Count; i++)
      {
        object obj = objs[i];
        if(obj == null)
        {
          Print("No object to bake");
          return;
        }

        //Make new attribute to set name
        Rhino.DocObjects.ObjectAttributes att = new Rhino.DocObjects.ObjectAttributes();

        string name = names.Count > 0 ? names[i % names.Count] : null;
        //Set object name
        if(!string.IsNullOrEmpty(name))
        {
          att.Name = name;
        }

        Color color = colors.Count > 0 ? colors[i % colors.Count] : new Color();
        //Set color
        if(!color.IsEmpty)
        {
          att.ColorSource = Rhino.DocObjects.ObjectColorSource.ColorFromObject; //Make the color type "by object"
          att.ObjectColor = color;

          att.PlotColorSource = Rhino.DocObjects.ObjectPlotColorSource.PlotColorFromObject; //Make the plot color type "by object"
          att.PlotColor = color;
        }

        string layer = layers.Count > 0 ? layers[i % layers.Count] : null;
        //Set layer
        if(!string.IsNullOrEmpty(layer) && Rhino.DocObjects.Layer.IsValidName(layer))
        {
          //Get the current layer index
          Rhino.DocObjects.Tables.LayerTable layerTable = doc.Layers;
          int layerIndex = layerTable.Find(layer, true);

          if(layerIndex < 0) //This layer does not exist, we add it
          {
            Rhino.DocObjects.Layer onlayer = new Rhino.DocObjects.Layer(); //Make a new layer
            onlayer.Name = layer;

            layerIndex = layerTable.Add(onlayer); //Add the layer to the layer table
            if (layerIndex > -1) //We manged to add layer!
            {
              att.LayerIndex = layerIndex;
              Print("Added new layer to the document at position " + layerIndex + " named " + layer + ". ");
            } else
              Print("Layer did not add. Try cleaning up your layers."); //This never happened to me.
          }
          else
            att.LayerIndex = layerIndex; //We simply add to the existing layer
        }


        double pWidth = pWidths.Count > 0 ? pWidths[i % pWidths.Count] : 0;
        //Set plotweight
        if(pWidth > 0)
        {
          att.PlotWeightSource = Rhino.DocObjects.ObjectPlotWeightSource.PlotWeightFromObject;
          att.PlotWeight = pWidth;
        }


        object material = materials.Count > 0 ? materials[i % materials.Count] : null;
        //Set material
        bool materialByName = !string.IsNullOrEmpty(material as string);
        Rhino.Display.DisplayMaterial inMaterial = material as Rhino.Display.DisplayMaterial;
        if(material is Color)
        {
          inMaterial = new Rhino.Display.DisplayMaterial((Color) material);
        }
        if(material != null && inMaterial == null && !materialByName)
        {
          if(!(material is string))
          {
            try //We also resort to try with IConvertible
            {
              inMaterial = (Rhino.Display.DisplayMaterial) Convert.ChangeType(material, typeof(Rhino.Display.DisplayMaterial));
            }
            catch(InvalidCastException)
            {
            }
          }
        }
        if(inMaterial != null || materialByName)
        {
          string matName;

          if(!materialByName)
          {
            matName = string.Format("A:{0}-D:{1}-E:{2}-S:{3},{4}-T:{5}",
              Format(inMaterial.Ambient),
              Format(inMaterial.Diffuse),
              Format(inMaterial.Emission),
              Format(inMaterial.Specular),
              inMaterial.Shine.ToString(),
              inMaterial.Transparency.ToString()
              );
          }
          else
          {
            matName = (string) material;
          }

          int materialIndex = doc.Materials.Find(matName, true);
          if(materialIndex < 0 && !materialByName) //Material does not exist and we have its specs
          {
            materialIndex = doc.Materials.Add(); //Let's add it
            if(materialIndex > -1)
            {
              Print("Added new material at position " + materialIndex + " named \"" + matName + "\". ");
              Rhino.DocObjects.Material m = doc.Materials[materialIndex];
              m.Name = matName;
              m.AmbientColor = inMaterial.Ambient;
              m.DiffuseColor = inMaterial.Diffuse;
              m.EmissionColor = inMaterial.Emission;
              //m.ReflectionColor = no equivalent
              m.SpecularColor = inMaterial.Specular;
              m.Shine = inMaterial.Shine;
              m.Transparency = inMaterial.Transparency;
              //m.TransparentColor = no equivalent
              m.CommitChanges();

              att.MaterialSource = Rhino.DocObjects.ObjectMaterialSource.MaterialFromObject;
              att.MaterialIndex = materialIndex;
            }
            else
              Print("Material did not add. Try cleaning up your materials."); //This never happened to me.
          }
          else if(materialIndex < 0 && materialByName) //Material does not exist and we do not have its specs. We do nothing
          {
            Print("Warning: material name not found. I cannot set the source to this material name. Add a material with name: " + matName);
          }
          else
          {
            //If this material exists, we do not replace it!
            att.MaterialSource = Rhino.DocObjects.ObjectMaterialSource.MaterialFromObject;
            att.MaterialIndex = materialIndex;
          }
        }


        int wires = wiresEach.Count > 0 ? wiresEach[i % wiresEach.Count] : 0;
        //Set wire density
        if(wires == -1 || wires > 0)
        {
          att.WireDensity = wires;
        }

        Bake(obj, att, groupIndex);
      }
    }
    else
    {
      Print("Inactive");
    }
# ---------- bakeattributes: C# additional code ----------
  void Bake(object obj, Rhino.DocObjects.ObjectAttributes att, int groupIndex)
  {
    if(obj == null)
      return;

    Guid id;

    //Bake to the right type of object
    if(obj is GeometryBase)
    {
      GeometryBase geomObj = obj as GeometryBase;

      switch(geomObj.ObjectType)
      {
        case Rhino.DocObjects.ObjectType.Brep:
          id = doc.Objects.AddBrep(obj as Brep, att);
          break;
        case Rhino.DocObjects.ObjectType.Curve:
          id = doc.Objects.AddCurve(obj as Curve, att);
          break;
        case Rhino.DocObjects.ObjectType.Point:
          id = doc.Objects.AddPoint((obj as Rhino.Geometry.Point).Location, att);
          break;
        case Rhino.DocObjects.ObjectType.Surface:
          id = doc.Objects.AddSurface(obj as Surface, att);
          break;
        case Rhino.DocObjects.ObjectType.Mesh:
          id = doc.Objects.AddMesh(obj as Mesh, att);
          break;
        case (Rhino.DocObjects.ObjectType) 1073741824://Rhino.DocObjects.ObjectType.Extrusion:
          id = (Guid) typeof(Rhino.DocObjects.Tables.ObjectTable).InvokeMember("AddExtrusion", BindingFlags.Instance | BindingFlags.InvokeMethod, null, doc.Objects, new object[]{obj, att});
          break;
        case Rhino.DocObjects.ObjectType.PointSet:
          id = doc.Objects.AddPointCloud(obj as Rhino.Geometry.PointCloud, att); //This is a speculative entry
          break;
        default:
          Print("The script does not know how to handle this type of geometry: " + obj.GetType().FullName);
          return;
      }
    }
    else
    {
      Type objectType = obj.GetType();

      if(objectType == typeof(Arc))
      {
        id = doc.Objects.AddArc((Arc) obj, att);
      }
      else if(objectType == typeof(Box))
      {
        id = doc.Objects.AddBrep(((Box) obj).ToBrep(), att);
      }
      else if(objectType == typeof(Circle))
      {
        id = doc.Objects.AddCircle((Circle) obj, att);
      }
      else if(objectType == typeof(Ellipse))
      {
        id = doc.Objects.AddEllipse((Ellipse) obj, att);
      }
      else if(objectType == typeof(Polyline))
      {
        id = doc.Objects.AddPolyline((Polyline) obj, att);
      }
      else if(objectType == typeof(Sphere))
      {
        id = doc.Objects.AddSphere((Sphere) obj, att);
      }
      else if(objectType == typeof(Point3d))
      {
        id = doc.Objects.AddPoint((Point3d) obj, att);
      }
      else if(objectType == typeof(Line))
      {
        id = doc.Objects.AddLine((Line) obj, att);
      }
      else if(objectType == typeof(Vector3d))
      {
        Print("Impossible to bake vectors");
        return;
      }
      else if(obj is IEnumerable)
      {
        int newGroupIndex;
        if(groupIndex == -1)
          newGroupIndex = doc.Groups.Add();
        else
          newGroupIndex = groupIndex;
        foreach(object o in obj as IEnumerable)
        {
          Bake(o, att, newGroupIndex);
        }
        return;
      }
      else
      {
        Print("Unhandled type: " + objectType.FullName);
        return;
      }
    }

    if(groupIndex != -1)
    {
      doc.Groups.AddToGroup(groupIndex, id);
      Print("Added " + obj.GetType().Name + " to group number " + groupIndex);
    }
    else
      Print("Added " + obj.GetType().Name);
  }

  static string Format(Color c)
  {
    return (new System.Text.StringBuilder("A")).Append(c.A.ToString()).Append("R").Append(c.R.ToString()).Append("G")
      .Append(c.G.ToString()).Append("B").Append(c.B.ToString()).ToString();
  }
# ---------- end bakeattributes ----------

# ----
# Alignment String
crv_6 = Curve(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)

cp = ControlPoints(Curve=crv_5)  # -> Points, Weights, Knots
lng = ListLength(List=cp.Points)
expression_6 = Expression(x=lng, Expression="x-1")
pdecon = Deconstruct(Point=cp.Points)  # -> XComponent, YComponent, ZComponent
split_4 = SplitList(List=cp.Points, Index=expression_6)  # -> ListA, ListB
split_5 = SplitList(List=cp.Points, Index=Slider(1, range=0..100))  # -> ListA, ListB
python_4 = GhPythonScript(
    x=pdecon.XComponent,
    y=pdecon.YComponent,
    z=pdecon.ZComponent,
    tol=Slider(0.001, range=0..0.001),
    rot=Slider(20, range=0..100))  # -> out, a, b, c; inputs x: list, y: list, z: list
# ---------- python_4: Python ----------
__author__ = "Jiwoo Ahn"
__version__ = "2021.01.06"

import rhinoscriptsyntax as rs
import math

def sign(a):
    return (a > 0) - (a < 0)

a = []
b = []
c = []

for i in range(1,len(x)):
    x0 = x[i-1]
    x1 = x[i]
    y0 = y[i-1]
    y1 = y[i]
    z0 = z[i-1]
    z1 = z[i]
    
    dx = x1 - x0
    dy = y1 - y0
    dz = z1 - z0
    
    if dx > tol:
        a.append(1*rot)
    elif dx < -tol:
        a.append(-1*rot)
    else:
        a.append(180)
        
    L = (dx**2+dy**2+dz**2)**0.5
    b.append(math.asin(dz/L))
    
    c.append(math.atan(x1/y1))
# ---------- end python_4 ----------
vec2pt = Vector2Pt(PointA=split_4.ListA, PointB=split_5.ListB, Unitize=False)  # -> Vector, Length
lng_2 = ListLength(List=vec2pt.Vector)
expression_7 = Expression(x=lng_2, Expression="x-1")
panel_3 = Panel(python_4.a)
panel_4 = Panel(python_4.b)
split_6 = SplitList(List=vec2pt.Vector, Index=expression_7)  # -> ListA, ListB
vec = Vector(Vector(0, 0, 0))
pdecon_2 = Deconstruct(Point=split_5.ListB)  # -> XComponent, YComponent, ZComponent
pdecon_3 = Deconstruct(Point=split_4.ListA)  # -> XComponent, YComponent, ZComponent
dup = DuplicateData(Data=rgb, Number=lng_2, Order=True)
rad_3 = Radians(Degrees=panel_3)
vec_2 = Vector(flatten([vec, split_6.ListA]))
panel_5 = Panel(python_4.c)
pt = ConstructPoint(XCoordinate=pdecon_3.XComponent, YCoordinate=pdecon_3.YComponent, ZCoordinate=0)
pt_2 = ConstructPoint(XCoordinate=pdecon_2.XComponent, YCoordinate=pdecon_2.YComponent, ZCoordinate=0)
neg_3 = Negative(Value=rad_3)
vec2pt_2 = Vector2Pt(PointA=pt, PointB=pt_2, Unitize=False)  # -> Vector, Length
neg_4 = Negative(Value=panel_5)
ma = MassAddition(Input=neg_3)  # -> Result, PartialResults
ma_2 = MassAddition(Input=vec_2)  # -> Result, PartialResults
neg_5 = Negative(Value=panel_4)
move_5 = Move(Geometry=move_3.Geometry, Motion=graft(ma_2.PartialResults))  # -> simplify(Geometry), Transform
ma_3 = MassAddition(Input=neg_5)  # -> Result, PartialResults
Z_2 = UnitZ(Factor=1)

# ----
# Roll Axis
rot3d_2 = Rotate3D(
    Geometry=move_5.Geometry,
    Angle=simplify(graft(ma.PartialResults)),
    Center=simplify(graft(split_4.ListA)),
    Axis=simplify(graft(vec2pt.Vector)))  # -> Geometry, Transform

line_2 = LineSDL(Start=split_4.ListA, Direction=Z_2, Length=1)

# ----
# Pitch Axis
rot3d_3 = Rotate3D(
    Geometry=rot3d_2.Geometry,
    Angle=simplify(graft(ma_3.PartialResults)),
    Center=simplify(graft(split_4.ListA)),
    Axis=simplify(graft(vec2pt.Vector)))  # -> Geometry, Transform

# ----
# Yaw Axis
rot3d_4 = Rotate3D(
    Geometry=rot3d_3.Geometry,
    Angle=simplify(graft(neg_4)),
    Center=simplify(graft(split_4.ListA)),
    Axis=simplify(graft(line_2)))  # -> Geometry, Transform

preview = CustomPreview(Geometry=flatten(rot3d_4.Geometry), Material=dup)

# ==== cluster Cluster
segment_angle = ClusterInput()
tunnel_radius_m = ClusterInput()
rad = Radians(Degrees=segment_angle)
python = GhPythonScript(x=rad)  # -> out, a; inputs x: list
# ---------- python: Python ----------
__author__ = "Jiwoo Ahn"
__version__ = "2021.01.05"

import rhinoscriptsyntax as rs

a = []
k = x[0]/2

for c, i in enumerate(x):
    if c == 0:
        a.append(i-k)
    else:
        a.append(a[c-1] + i)
# ---------- end python ----------
expression = Expression(x=python.a, Expression="(π/2-x)")
arc = Arc(Plane=PlaneXY(0, 0, 0), Radius=tunnel_radius_m, Angle=rad)  # -> Arc, Length
rotate = Rotate(Geometry=arc.Arc, Angle=expression, Plane=PlaneXY(0, 0, 0))  # -> Geometry, Transform
crv = Curve(rotate.Geometry)
X = UnitX(Factor=1)
rot3d = Rotate3D(Geometry=crv, Angle=1.570796327, Center=Point(0, 0, 0), Axis=X)  # -> flatten(Geometry), Transform
G = ClusterOutput(rot3d.Geometry)
