# Grasshopper definition TBM.gh (Grasshopper 1.0.7)

segment_thickness_mm = Slider(360, range=0..1000)
number_of_segments = Slider(6, range=2..20)
segment_length = Slider(2, range=0..5)
axis_rotation = Slider(0, range=0..360)
keystone_angle = Slider(17, range=0..90)
segment_angles_1 = Panel("""17
60
55
60
55
60
55""")
tunnel_radius = Slider(3, range=0..10)
int = Integer(segment_angles_1)
expression = Expression(R=tunnel_radius, t=segment_thickness_mm, Expression="R-t/1000")
python = GhPythonScript(x=int, n=number_of_segments)  # -> out, a; inputs x: list
# ---------- python: Python ----------
__author__ = "Jiwoo Ahn"
__version__ = "2021.01.05"

import rhinoscriptsyntax as rs

if sum(x) != 360:
    out = 'Segment angles add to {0}, must add to 360'.format(sum(x))
elif len(x) != n+1:
    out = 'Number of segment angles must equal {0}'.format(n+1)
else:
    out = 'Inputs are valid'
# ---------- end python ----------
expression_2 = Expression(k=keystone_angle, n=number_of_segments, Expression="(360-k)/n")
cluster = Cluster(tunnel_radius_m=tunnel_radius, keystone_angle=keystone_angle, no_segments=number_of_segments)
cluster_2 = Cluster(tunnel_radius_m=expression, keystone_angle=keystone_angle, no_segments=number_of_segments)
crv = Curve(graft(cluster))
crv_2 = Curve(graft(cluster_2))
Y = UnitY(Factor=segment_length)
loft = Loft(Curves=[crv, crv_2], Options={Adjust=False, Closed=False, LoftEnds=0, LoftSimp=0, LoftType=0, Rebuild=10, Refit=0.01})
extr = Extrude(Base=loft, Direction=Y)  # -> flatten(Extrusion)
rad = Radians(Degrees=axis_rotation)
rot3d = Rotate3D(Geometry=extr, Angle=rad, Center=Point(0, 0, 0), Axis=Y)  # -> Geometry, Transform
volume = Volume(Geometry=rot3d.Geometry)  # -> Volume, Centroid
unit = UnitVector(Vector=volume.Centroid)
python_2 = GhPythonScript(x=cluster)  # -> out, Label, R, G, B; inputs x: list
# ---------- python_2: Python ----------
__author__ = "Jiwoo Ahn"
__version__ = "2021.01.05"

import rhinoscriptsyntax as rs



def GetColor(r, g, b):
    #Color = &HFF000000 Or RGB( r*255, g*255, b * 255 )    
    r = r + 0.6
    if r > 1:
        r = r - 1
        g = g + 0.6
        if g > 1:
            g = g - 1
            b = b + 0.6
            if b > 1 :
                b = b - 1
    
    return r, g, b

# the start value of r g b
r = 1
g = 0
b = 0
R = []
G = []
B = []
Label = []
for i in range(0,len(x)+1): #iterate through all selected objects
    r, g, b = GetColor(r, g, b) #I made a function from your script to modify aColor.
    R.append(int(r * 255))
    G.append(int(g * 255))
    B.append(int(b * 255))
    if i == 0:
        Label.append('Keystone')
    else:
        Label.append("Segment {0}".format(i))
# ---------- end python_2 ----------
move = Move(Geometry=volume.Centroid, Motion=unit)  # -> Geometry, Transform
rgb = ColourRGB(Alpha=255, Red=python_2.R, Green=python_2.G, Blue=python_2.B)
tag = TextTag(Location=move.Geometry, Text=python_2.Label, Colour=rgb)
preview = CustomPreview(Geometry=rot3d.Geometry, Material=rgb)

# ==== cluster Cluster
no_segments = ClusterInput()
keystone_angle = ClusterInput()
tunnel_radius_m = ClusterInput()
rad = Radians(Degrees=keystone_angle)
rad_2 = Radians(Degrees=keystone_angle)
expression = Expression(x=rad_2, Expression="(π-x)/2")
expression_2 = Expression(x=rad, n=no_segments, Expression="(2*π-x)/n")
arc = Arc(Plane=PlaneXY(0, 0, 0), Radius=tunnel_radius_m, Angle=rad_2)  # -> Arc, Length
expression_3 = Expression(x=expression, y=rad_2, Expression="x+y")
rotate = Rotate(Geometry=arc.Arc, Angle=expression, Plane=PlaneXY(0, 0, 0))  # -> Geometry, Transform
crv = Curve(rotate.Geometry)
arc_2 = Arc(Plane=PlaneXY(0, 0, 0), Radius=tunnel_radius_m, Angle=expression_2)  # -> Arc, Length
series = Series(Start=expression_3, Step=expression_2, Count=no_segments)
rotate_2 = Rotate(Geometry=arc_2.Arc, Angle=series, Plane=PlaneXY(0, 0, 0))  # -> Geometry, Transform
X = UnitX(Factor=1)
crv_2 = Curve(rotate_2.Geometry)
rot3d = Rotate3D(Geometry=[crv, crv_2], Angle=1.570796327, Center=Point(0, 0, 0), Axis=X)  # -> flatten(Geometry), Transform
G = ClusterOutput(rot3d.Geometry)
