# Grasshopper definition Tetgen Mesh.gh (Grasshopper 1.0.7)
# plug-ins: TetgenGH

mesh = Mesh(<mesh referenced from the Rhino model>)
tetgen = Tetrahedralize(Mesh=mesh, Flags=Slider(1, range=0..3), MinRatio=2)  # -> Mesh, Indices, Points
tetgen_2 = Tetrahedralize(Mesh=mesh, Flags=Slider(2, range=0..3), MinRatio=2)  # -> Mesh, Indices, Points
tetgen_3 = Tetrahedralize(Mesh=mesh, Flags=Slider(0, range=0..3), MinRatio=2)  # -> Mesh, Indices, Points
item = ListItem(List=tetgen_2.Indices, Index=Slider(0, range=0..100), Wrap=True)  # -> flatten(Item)
item_2 = ListItem(List=tetgen_2.Indices, Index=Slider(2, range=0..10), Wrap=True)  # -> flatten(Item)
item_3 = ListItem(List=tetgen_2.Indices, Index=Slider(3, range=0..10), Wrap=True)  # -> flatten(Item)
item_4 = ListItem(List=tetgen_2.Indices, Index=Slider(1, range=0..1), Wrap=True)  # -> flatten(Item)
lng = ListLength(List=flatten(tetgen_2.Indices))
expression = Expression(x=item, Expression="x+1")
expression_2 = Expression(x=item_2, Expression="x+1")
expression_3 = Expression(x=item_4, Expression="x+1")
expression_4 = Expression(x=item_3, Expression="x+1")
lng_2 = ListLength(List=tetgen_2.Points)
expression_5 = Expression(x=lng, y=lng_2, Expression="Format(\"* Tetgen generated {0} zones and {1} gridpoints\", x/4, y)")
pdecon = Deconstruct(Point=tetgen_2.Points)  # -> XComponent, YComponent, ZComponent
series = Series(Start=Slider(1, range=0..1), Step=1, Count=lng_2)
expression_6 = Expression(x=lng, Expression="x/4")
panel = Panel("""* .f3grid generation of tetrahedral mesh using Tetgen library
* Author : Jiwoo Ahn
* Date: 19/06/2020
* ---------------------------------""")
expression_7 = Expression(
    x=pdecon.XComponent,
    y=pdecon.YComponent,
    z=pdecon.ZComponent,
    n=series,
    Expression="Format(\"G {0} {1} {2} {3}\", n, x, y, z)")
series_2 = Series(Start=Slider(1, range=0..1), Step=1, Count=expression_6)
expression_8 = Expression(
    a=expression,
    b=expression_3,
    c=expression_2,
    d=expression_4,
    n=series_2,
    Expression="Format(\"Z T4 {0} {1} {2} {3} {4}\", n, a, b, c, d)")
ins = InsertItems(List=panel, Item=expression_5, Indices=Slider(1, range=0..1), Wrap=True)
ins_2 = InsertItems(List=ins, Item=expression_7, Indices=Slider(2, range=0..10), Wrap=True)
lng_3 = ListLength(List=ins_2)
ins_3 = InsertItems(List=ins_2, Item=expression_8, Indices=lng_3, Wrap=True)
panel_2 = Panel(ins_3)
