# Grasshopper definition Tunnel Lining.gh (Grasshopper 1.0.7)

# ----
# INPUT PARAMETERS
# USE FLIP CURVE IF NEED
hitch_spring_length = Number(1)
beam_length = Number(0.1)
spring_length = Number(1)
tunnel_lining = Curve(<curve referenced from the Rhino model>)
flip_curve = FlipCurve(Curve=tunnel_lining)  # -> Curve, Flag

crv = Curve(flip_curve.Curve)
len = Length(Curve=crv)
division = Division(A=len, B=beam_length)
multiplication = Multiplication(A=spring_length, B=-1)
Z = UnitZ(Factor=multiplication)

# ----
# CHECK CURVE ORIENTATION TO BE LEFT TO RIGHT, IF BELOW BOX IS TRUE THEN FLIP CURVE
end = EndPoints(Curve=tunnel_lining)  # -> Start, End
pdecon = Deconstruct(Point=end.End)  # -> XComponent, YComponent, ZComponent
pdecon_2 = Deconstruct(Point=end.Start)  # -> XComponent, YComponent, ZComponent
subtraction = Subtraction(A=pdecon_2.YComponent, B=pdecon.YComponent)
smaller = SmallerThan(FirstNumber=subtraction, SecondNumber=0)  # -> SmallerThan, OrEqualTo
panel = Panel(smaller.SmallerThan)

divide = DivideCurve(Curve=crv, Count=division, Kinks=False)  # -> Points, Tangents, Parameters
strand7_spring_processing = Strand7SpringProcessing(P=divide.Points, A=divide.Tangents, B=Z)
strand7_beam_processing = Strand7BeamProcessing(L=divide.Points, L_2=divide.Points, L_3=divide.Points)  # -> i, R, i_2
cluster = Cluster(
    L=divide.Points,
    L_2=divide.Tangents,
    A_2=hitch_spring_length,
    L_4=divide.Points,
    i_2=strand7_beam_processing.R,
    L_3=divide.Tangents,
    i=strand7_beam_processing.R,
    A=hitch_spring_length)  # -> L_5, L_6
strand_7_hitch_springs = Curve([cluster.L_5, cluster.L_6])
strand_7_beam = Line(StartPoint=strand7_beam_processing.i, EndPoint=strand7_beam_processing.i_2)
strand7_springs = Line(StartPoint=divide.Points, EndPoint=strand7_spring_processing)
panel_2 = Panel("BAKE ONCE DONE")

# ==== cluster Strand7BeamProcessing
L = ClusterInput()
L_2 = ClusterInput()
L_3 = ClusterInput()

lng = ListLength(List=L)
subtraction = Subtraction(A=lng, B=1)
series = Series(Start=0, Step=1, Count=subtraction)
series_2 = Series(Start=1, Step=1, Count=subtraction)
item = ListItem(List=L_2, Index=series, Wrap=True)
item_2 = ListItem(List=L_3, Index=series_2, Wrap=True)

R = ClusterOutput(subtraction)
i = ClusterOutput(item)
i_2 = ClusterOutput(item_2)

# ==== cluster Strand7SpringProcessing
A = ClusterInput()
B = ClusterInput()
P = ClusterInput()
xprod = CrossProduct(VectorA=A, VectorB=B, Unitize=True)  # -> Vector, Length
pdecon = Deconstruct(Point=P)  # -> XComponent, YComponent, ZComponent
devec = DeconstructVector(Vector=xprod.Vector)  # -> XComponent, YComponent, ZComponent
addition = Addition(A=pdecon.XComponent, B=devec.XComponent)
addition_2 = Addition(A=pdecon.YComponent, B=devec.YComponent)
addition_3 = Addition(A=pdecon.ZComponent, B=devec.ZComponent)
pt = ConstructPoint(XCoordinate=addition, YCoordinate=addition_2, ZCoordinate=addition_3)
pt_2 = ClusterOutput(pt)

# ==== cluster Cluster
L = ClusterInput()
L_2 = ClusterInput()
L_3 = ClusterInput()
i = ClusterInput()
A = ClusterInput()
A_2 = ClusterInput()
L_4 = ClusterInput()
i_2 = ClusterInput()
start_point_num = Integer(0)
int = Integer(-1)
item = ListItem(List=L_3, Index=i, Wrap=True)
item_2 = ListItem(List=L_2, Index=start_point_num, Wrap=True)
int_2 = Integer(1)
item_3 = ListItem(List=L_4, Index=i_2, Wrap=True)
unit = UnitVector(Vector=item_2)
unit_2 = UnitVector(Vector=item)
multiplication = Multiplication(A=A_2, B=int)
item_4 = ListItem(List=L, Index=start_point_num, Wrap=True)
devec = DeconstructVector(Vector=unit)  # -> XComponent, YComponent, ZComponent
unit_3 = UnitVector(Vector=item)
multiplication_2 = Multiplication(A=A, B=int_2)
pdecon = Deconstruct(Point=item_4)  # -> XComponent, YComponent, ZComponent
devec_2 = DeconstructVector(Vector=unit_2)  # -> XComponent, YComponent, ZComponent
multiplication_3 = Multiplication(A=devec.ZComponent, B=multiplication)
multiplication_4 = Multiplication(A=devec.XComponent, B=multiplication)
multiplication_5 = Multiplication(A=devec.YComponent, B=multiplication)
pdecon_2 = Deconstruct(Point=item_3)  # -> XComponent, YComponent, ZComponent
multiplication_6 = Multiplication(A=devec_2.XComponent, B=multiplication_2)
multiplication_7 = Multiplication(A=devec_2.ZComponent, B=multiplication_2)
multiplication_8 = Multiplication(A=devec_2.YComponent, B=multiplication_2)
addition = Addition(A=pdecon.ZComponent, B=multiplication_3)
addition_2 = Addition(A=pdecon.YComponent, B=multiplication_5)
addition_3 = Addition(A=pdecon.XComponent, B=multiplication_4)
# HITCH SPRING LEFT END
pt = ConstructPoint(XCoordinate=addition_3, YCoordinate=addition_2, ZCoordinate=addition)
# HITCH SPRING RIGHT END
addition_4 = Addition(A=pdecon_2.ZComponent, B=multiplication_7)
addition_5 = Addition(A=pdecon_2.YComponent, B=multiplication_8)
addition_6 = Addition(A=pdecon_2.XComponent, B=multiplication_6)
pt_2 = ConstructPoint(XCoordinate=addition_6, YCoordinate=addition_5, ZCoordinate=addition_4)
ln = Line(StartPoint=item_4, EndPoint=pt)
L_5 = ClusterOutput(ln)
ln_2 = Line(StartPoint=item_3, EndPoint=pt_2)
L_6 = ClusterOutput(ln_2)
