# Grasshopper definition Tunnel.gh (Grasshopper 0.9.76)

segments = Slider(509, range=1..1000)
tunnel_width_m = Slider(6.884, range=1..30)
tunnel_height_m = Slider(8.33, range=1..30)
crv = Curve(<curve referenced from the Rhino model>)
divide = DivideCurve(Curve=crv, Count=segments, Kinks=False)  # -> Points, Tangents, Parameters
division = Division(A=tunnel_height_m, B=2)
Z = UnitZ(Factor=1)
division_2 = Division(A=tunnel_width_m, B=2)
neg = Negative(Value=division_2)
xprod = CrossProduct(VectorA=divide.Tangents, VectorB=Z, Unitize=False)  # -> Vector, Length
line = LineSDL(Start=divide.Points, Direction=xprod.Vector, Length=neg)
line_2 = LineSDL(Start=divide.Points, Direction=xprod.Vector, Length=division_2)
end = EndPoints(Curve=line)  # -> Start, End
line_3 = LineSDL(Start=end.End, Direction=Z, Length=division)
end_2 = EndPoints(Curve=line_2)  # -> Start, End
line_4 = LineSDL(Start=end_2.End, Direction=Z, Length=division)
end_3 = EndPoints(Curve=line_3)  # -> Start, End
Z_2 = UnitZ(Factor=1)
end_4 = EndPoints(Curve=line_4)  # -> Start, End
arc = ArcSED(Start=end_4.End, End=end_3.End, Direction=Z_2)  # -> Arc, Plane, Radius
combine = CombineData(Input0=[line_2, line_4, line_3, arc.Arc, line])  # -> Result, Index
join = JoinCurves(Curves=combine.Result, Preserve=False)
item = ListItem(List=join, Index=1, Wrap=True)
swp1 = Sweep1(Rail=crv, Sections=item, Miter=1)
