# Grasshopper definition UDEC_CrackGenerator.gh (Grasshopper 1.0.7)

crv = Curve([<curve referenced from the Rhino model> x16])
xy = XYPlane(Origin=Point(0, 0, 0))
cp = ControlPoints(Curve=crv)  # -> Points, Weights, Knots
crv_2 = Curve()
vb = VBScript(C=crv_2, P=xy)  # -> out, CN; inputs C: list of Curve, P: Plane
# ---------- vb: VB ----------
    'Start by Shattering all of your input curves by intersecting them with each other

    Dim Crvs As New List(Of Curve)

    For CStart As Int32 = 0 To C.Count - 1

      Dim T As New List(Of Double)

      For CCut As Int32 = 0 To C.Count - 1
        If CStart <> CCut Then
          Dim CI As Intersect.CurveIntersections = Intersect.Intersection.CurveCurve(C(CStart), C(CCut), RhinoDoc.ActiveDoc.ModelAbsoluteTolerance, RhinoDoc.ActiveDoc.ModelAbsoluteTolerance)
          For Each IE As Intersect.IntersectionEvent In CI
            T.Add(IE.ParameterA)
          Next
        End If
      Next

      Dim CShattered() As Curve = C(CStart).Split(T)

      Crvs.AddRange(CShattered)

    Next

    'Set your "half-curve" lists

    Dim Vtc As New List(Of Point3d) 'all unique vertices

    Dim HC As New List(Of Curve) 'list of half-curves
    Dim HCI As New List(Of Int32) 'half curve indices
    Dim HCO As New List(Of Int32) 'half curve opposites
    Dim HCN As New List(Of Int32) 'next index for each half-curve
    Dim HCV As New List(Of Int32) 'half-curve vertex
    Dim HCF As New List(Of Int32) 'half-curve face
    Dim HCPln As New List(Of Plane) 'half-curve plane
    Dim HCK As New List(Of Boolean) 'flag if a half-curve needs to be killed (if it either starts or ends hanging)
    
    Dim F As New DataTree(Of Curve) 'data tree for faces
    Dim VOut As New DataTree(Of Int32) 'data tree of outgoing half-curves from each vertex
    

    For Each Crv As Curve In Crvs 'cycle through each curve

      For CRun As Int32 = 0 To 2 Step 2 'create two half-curves: first in one direction, and then the other...

        HC.Add(Crv)
        HCI.Add(HCI.Count)
        HCO.Add(HCI.Count - Crun) 'a little index trick
        HCN.Add(-1)
        HCF.Add(-1)
        HCK.Add(False)

        Dim VtcSet As Int32 = -1
        For VtxCheck As Int32 = 0 To Vtc.Count - 1
          If Vtc(VtxCheck).DistanceTo(Crv.PointAtStart) < RhinoDoc.ActiveDoc.ModelAbsoluteTolerance Then
            VtcSet = VtxCheck 'get the vertex index, if it already exists
            Exit For
          End If
        Next

        If VtcSet > -1 Then
          HCV.Add(VtcSet) 'If the vertex already exists, set the half-curve vertex
          VOut.Add(HCI.Last, New GH_Path(VtcSet)) 'add the new half-curve index to the list of outgoing half-curves associated with the vertex
        Else
          HCV.Add(Vtc.Count) 'if the vertex doesn't already exist, add a new vertex index
          VOut.Add(HCI.Last, New GH_Path(Vtc.Count)) 'add the new half-curve index to the list of outgoing half-curves associated with the vertex
          Vtc.Add(Crv.PointAtStart) 'add the new vertex to the vertex list
        End If

        'create, align and add the plane to be used for sequencing half-curves
        Dim AddPlane As New Plane(Vtc(HCV.Last), P.ZAxis) 
        AddPlane.Rotate(Vector3d.VectorAngle(AddPlane.XAxis, Crv.TangentAtStart, AddPlane), AddPlane.ZAxis) 
        HCPln.Add(AddPlane)

        Crv.Reverse 'reverse the curve for creating the opposite half-curve in the second part of the loop

      Next

    Next

    
    'For each Vertex that has only one outgoing half-curve, kill the half-curve and its opposite
    For Each Pth As GH_Path In VOut.Paths
      If VOut.Branch(Pth).Count = 1 Then
        HCK(VOut.Branch(Pth)(0)) = True
        HCK(HCO(VOut.Branch(Pth)(0))) = True
      End If
    Next

    'Find the "next" half-curve for each starting half curve by identifying the outgoing half-curve from the end vertex
    'that presents the smallest angle by calculating its plane's x-axis angle from x-axis of the starting half-curve's opposite plane
    For Each HCIdx As Int32 In HCI
      Dim PlaneUse As Plane = HCPln(HCO(HCIdx))
      Dim MinIdx As int32 = -1
      Dim MinAngle As Double = 2 * Math.PI
      For Each HCOut As Int32 In VOut.Branch(HCV(HCO(HCIdx)))
        If HCOut <> HCO(HCIdx) And HCK(HCIdx) = False And HCK(HCOut) = False
          Dim AngleTest As Double = Vector3d.VectorAngle(PlaneUse.XAxis, HCPln(HCOut).XAxis, PlaneUse)
          If AngleTest < MinAngle Then
            MinIdx = HCOut
            MinAngle = AngleTest
          End If
        End If
      Next
      HCN(HCIdx) = MinIdx
    Next

    'Sequence half-curves into faces by running along "next" half-curves in order until the starting half-curve is returned to
    Dim FaceEdges As New List(Of Int32)
    Dim DeleteEdges As New List(Of Int32)

    'cycle through each half-curve
    For Each HCIdx As Int32 In HCI
      Dim EmExit As Int32 = 0
      If HCF(HCIdx) = -1 Then 'if it hasn't yet been assigned to a 
        Dim EdgeCounter As Int32 = 1
        Dim FaceIdx as Int32 = F.Paths.Count
        Dim CurrentIdx As Int32 = HCIdx
        F.Add(HC(CurrentIdx), New GH_Path(FaceIdx))
        HCF(CurrentIdx) = FaceIdx
        Do
          If HCN(CurrentIdx) = -1 Then 'if sequence half-curve has no next curve assigned, then the face is invalid
            DeleteEdges.Add(FaceIdx) 'and will be added to the delete list
            Exit Do
          End If
          CurrentIdx = HCN(CurrentIdx)
          F.Add(HC(CurrentIdx), New GH_Path(FaceIdx))
          EdgeCounter += 1
          HCF(CurrentIdx) = FaceIdx
          If HCN(CurrentIdx) = HCIdx Then Exit Do 'exit once the starting half-curve is reached again
          EmExit += 1
          If EmExit = Crvs.Count - 1 Then Exit Do 'emergency exit prevents infinite loops
        Loop
        FaceEdges.Add(EdgeCounter)
      End If
    Next

    'Find the perimeter by counting edges...it's possible that an interior face might have the most edges
    'so this could easily be improved upon
    Dim Perim As Int32 = -1
    Dim PerimCount As Int32 = -1
    For FE As Int32 = 0 To FaceEdges.Count - 1
      If FaceEdges(FE) > PerimCount Then
        Perim = FE
        PerimCount = FaceEdges(FE)
      End If
    Next
    DeleteEdges.Add(Perim)

    Dim NewPath As Int32 = 0
    Dim OutputFaces As New DataTree(Of Curve)

    'only output those faces that haven't been identified as either the perimeter or open
    For Each Pth As GH_Path In F.Paths

      If DeleteEdges.Contains(Pth.Indices(0)) = False Then
        OutputFaces.AddRange(F.Branch(Pth), New GH_Path(NewPath))
        NewPath += 1
      End If

    Next

    CN = OutputFaces
# ---------- end vb ----------
crv_3 = Curve(<curve referenced from the Rhino model>)
tstat = TreeStatistics(Tree=cp.Points)  # -> Paths, Length, Count
viewer = ParamViewer(cp.Points)
boundary = BoundarySurfaces(Edges=vb.CN)
series = Series(Start=Slider(1, range=0..1), Step=1, Count=tstat.Count)
cp_2 = ControlPoints(Curve=crv_3)  # -> Points, Weights, Knots
rev = ReverseList(List=cp.Points)
rev_2 = ReverseList(List=cp_2.Points)
cluster = Cluster(data=boundary)  # -> data_3, V
int = Integer(series)
pdecon = Deconstruct(Point=rev_2)  # -> XComponent, YComponent, ZComponent
edges = BrepEdges(Brep=cluster.data_3)  # -> Naked, Interior, NonManifold
stack = StackData(Data=int, Stack=tstat.Length)
preview = CustomPreview(Geometry=cluster.data_3, Shader=cluster.V)
pdecon_2 = Deconstruct(Point=rev)  # -> XComponent, YComponent, ZComponent
python = GhPythonScript(x=pdecon.XComponent, y=pdecon.YComponent)  # -> out, a; inputs x: list, y: list
# ---------- python: Python ----------
__author__ = "Jiwoo Ahn"
__version__ = "2020.03.03"

import rhinoscriptsyntax as rs
x_len = len(x)

for c in range(0,x_len):
    a = x[c]
    b = y[c]
    if c == 0:
        print("block create polygon &")
    if c == x_len-1:
        print("{0},{1}".format(a,b))
    else:
        print("{0},{1} &".format(a,b))
# ---------- end python ----------
cset = CreateSet(List=stack)  # -> Set, Map
join = JoinCurves(Curves=edges.Naked, Preserve=False)
mindex = MemberIndex(Set=stack, Member=cset.Set)  # -> Index, Count
panel = Panel(python.out)
crv_4 = Curve(join)
item = ListItem(List=stack, Index=mindex.Index, Wrap=True)
multiplication = Multiplication(A=Slider(100, range=0..100), B=Slider(4, range=0..10))
addition = Addition(A=item, B=multiplication)
python_2 = GhPythonScript(x=pdecon_2.XComponent, y=pdecon_2.YComponent, i=addition, join=Toggle(False))  # -> out, a; inputs x: list, y: list, i: list
# ---------- python_2: Python ----------
__author__ = "Jiwoo Ahn"
__version__ = "2020.03.03"

import rhinoscriptsyntax as rs

"""
def tree_to_list(input, retrieve_base = lambda x: x[0]):
    #Returns a list representation of a Grasshopper DataTree
    def extend_at(path, index, simple_input, rest_list):
        target = path[index]
        if len(rest_list) <= target: rest_list.extend([None]*(target-len(rest_list)+1))
        if index == path.Length - 1:
            rest_list[target] = list(simple_input)
        else:
            if rest_list[target] is None: rest_list[target] = []
            extend_at(path, index+1, simple_input, rest_list[target])
    all = []
    for i in range(input.BranchCount):
        path = input.Path(i)
        extend_at(path, 0, input.Branch(path), all)
    return retrieve_base(all)
"""
if join == True:
    j = "join"
else:
    j = ""

x_len = len(x)

for c in range(0,x_len):
    a = x[c]
    b = y[c]
    n = i[c]
    if c == 0:
        print("table {0} add &".format(n))
    if c == x_len-1:
        print("{0:.3f},{1:.3f}".format(a,b))
        print("block cut table {0} {1}".format(n,j))
        print("")
    else:
        print("{0:.3f},{1:.3f} &".format(a,b))



"""
if join == True:
    j = "join"
else:
    j = ""


for n in i:
    print("table {0} add &".format(n))
    

    
    print("block cut table {0} {1}".format(n,j))
    print("")
"""
# ---------- end python_2 ----------
python_3 = GhPythonScript(x=pdecon_2.XComponent, y=pdecon_2.YComponent, i=addition)  # -> out, a; inputs x: list, y: list, i: list
# ---------- python_3: Python ----------
__author__ = "Jiwoo Ahn"
__version__ = "2020.03.03"

import rhinoscriptsyntax as rs

"""
def tree_to_list(input, retrieve_base = lambda x: x[0]):
    #Returns a list representation of a Grasshopper DataTree
    def extend_at(path, index, simple_input, rest_list):
        target = path[index]
        if len(rest_list) <= target: rest_list.extend([None]*(target-len(rest_list)+1))
        if index == path.Length - 1:
            rest_list[target] = list(simple_input)
        else:
            if rest_list[target] is None: rest_list[target] = []
            extend_at(path, index+1, simple_input, rest_list[target])
    all = []
    for i in range(input.BranchCount):
        path = input.Path(i)
        extend_at(path, 0, input.Branch(path), all)
    return retrieve_base(all)
"""
x_len = len(x)

for c in range(0,x_len):
    a = x[c]
    b = y[c]
    n = i[c]
    if c == 0:
        print("table {0} add &".format(n))
    if c == x_len-1:
        print("{0:.3f},{1:.3f}".format(a,b))
        print("")
    else:
        print("{0:.3f},{1:.3f} &".format(a,b))



"""
if join == True:
    j = "join"
else:
    j = ""


for n in i:
    print("table {0} add &".format(n))
    

    
    print("block cut table {0} {1}".format(n,j))
    print("")
"""
# ---------- end python_3 ----------
panel_2 = Panel(python_3.out)
crack_table = Panel(python_2.out)
bond_length = Slider(3, range=0..10)
crv_5 = Curve(<curve referenced from the Rhino model>)
crv_6 = Curve()
len = Length(Curve=crv_6)
end = EndPoints(Curve=crv_5)  # -> Start, End
subtraction = Subtraction(A=len, B=bond_length)
end_2 = EndPoints(Curve=crv_6)  # -> Start, End
pdecon_3 = Deconstruct(Point=end.Start)  # -> XComponent, YComponent, ZComponent
pdecon_4 = Deconstruct(Point=end.End)  # -> XComponent, YComponent, ZComponent
pdecon_5 = Deconstruct(Point=end_2.Start)  # -> XComponent, YComponent, ZComponent
pdecon_6 = Deconstruct(Point=end_2.End)  # -> XComponent, YComponent, ZComponent
expression = Expression(x=pdecon_3.XComponent, y=pdecon_3.YComponent, Expression="Format(\"{0:0.000},{1:0.000}\", x, y)")
expression_2 = Expression(x=pdecon_4.XComponent, y=pdecon_4.YComponent, Expression="Format(\"{0:0.000},{1:0.000}\", x, y)")
eval = EvaluateLength(Curve=crv_6, Length=subtraction, Normalized=Toggle(False))  # -> Point, Tangent, Parameter
number_of_segments = Slider(10, range=0..15)
expression_3 = Expression(y1=pdecon_5.YComponent, y2=pdecon_6.YComponent, x=pdecon_5.YComponent, y=pdecon_6.YComponent, Expression="if(y1>y2,x,y)")
panel_3 = Panel("TSW1_A12")
expression_4 = Expression(y1=pdecon_5.YComponent, y2=pdecon_6.YComponent, x=pdecon_5.XComponent, y=pdecon_6.XComponent, Expression="if(y1<y2,x,y)")
expression_5 = Expression(y1=pdecon_5.YComponent, y2=pdecon_6.YComponent, x=pdecon_5.XComponent, y=pdecon_6.XComponent, Expression="if(y1>y2,x,y)")
expression_6 = Expression(y1=pdecon_5.YComponent, y2=pdecon_6.YComponent, x=pdecon_5.YComponent, y=pdecon_6.YComponent, Expression="if(y1<y2,x,y)")
mat_number = Slider(4, range=0..10)
pdecon_7 = Deconstruct(Point=eval.Point)  # -> XComponent, YComponent, ZComponent
expression_7 = Expression(x=pdecon_7.XComponent, y=pdecon_7.YComponent, Expression="Format(\"{0:0.000}, {1:0.000}\", x, y)")
expression_8 = Expression(x=expression_4, y=expression_6, Expression="Format(\"{0:0.000}, {1:0.000}\", x, y)")
expression_9 = Expression(x=expression_5, y=expression_3, Expression="Format(\"{0:0.000}, {1:0.000}\", x, y)")
number_of_segments_2 = Slider(10, range=0..15)
expression_10 = Expression(y1=pdecon_3.YComponent, y2=pdecon_4.YComponent, x=expression, y=expression_2, Expression="if(y1>y2,x,y)")
expression_11 = Expression(y1=pdecon_3.YComponent, y2=pdecon_4.YComponent, x=expression, y=expression_2, Expression="if(y1<y2,x,y)")
mat_number_2 = Slider(6, range=0..10)
addition_2 = Addition(A=mat_number, B=Slider(10, range=0..10))
expression_12 = Expression(
    x=expression_10,
    y=expression_11,
    s=number_of_segments,
    m=mat_number,
    g="TSW1_A13",
    m1=addition_2,
    Expression="Format(\"block structure cable create begin {0} end {1} segments {2} material-steel {3} material-grout {3} material-first-node {4} group 'cable={5}'\", x, y,s,m,m1,g)")
expression_13 = Expression(
    x=expression_10,
    y=expression_11,
    s=number_of_segments,
    m=mat_number,
    g="TSW1_A13",
    Expression="Format(\"block structure cable create begin {0} end {1} segments {2} material-steel {3} material-grout {3} connect group 'cable={4}'\", x, y,s,m,g)")
addition_3 = Addition(A=mat_number_2, B=Slider(20, range=0..20))
addition_4 = Addition(A=mat_number_2, B=Slider(10, range=0..10))
expression_14 = Expression(
    x=expression_9,
    y=expression_7,
    s=number_of_segments_2,
    m=addition_3,
    g="TSW1_A1",
    m1=addition_4,
    Expression="Format(\"block structure cable create begin {0} end {1} segments {2} material-steel {3} material-grout {3} material-first-node {4} group 'cable={5}'\", x, y,s,m,m1,g)")
expression_15 = Expression(
    x=expression_7,
    y=expression_8,
    s=number_of_segments_2,
    m=mat_number_2,
    g="TSW1_A1",
    m1=addition_4,
    Expression="Format(\"block structure cable create begin {0} end {1} segments {2} material-steel {3} material-grout {3} extend group 'cable={5}'\", x, y,s,m,m1,g)")
panel_5 = Panel(expression_12)
panel_6 = Panel(expression_13)
rev_3 = ReverseList(List=expression_15)
rev_4 = ReverseList(List=expression_14)
python_4 = GhPythonScript(x=rev_4, y=rev_3)  # -> out, a
# ---------- python_4: Python ----------
__author__ = "Jiwoo Ahn"
__version__ = "2020.03.04"

import rhinoscriptsyntax as rs

print(x)
print(y)
print("")
# ---------- end python_4 ----------
panel_7 = Panel(python_4.out)

# ==== cluster Cluster
data = ClusterInput()
data_2 = Data(flatten(data))
lng = ListLength(List=data_2)  # -> expr("x-1", Length)
data_3 = ClusterOutput(data_2)
range = Range(Domain=Domain(0, 1), Steps=lng)
gradient = Gradient(
    LowerLimit=0,
    UpperLimit=1,
    Parameter=range,
    stops=[0: RGBA(243, 57, 0, 139), 0: RGBA(243, 57, 0, 140), 0.109: RGBA(236, 27, 60, 140), 0.219: RGBA(210, 0, 118, 140), 0.332: RGBA(103, 0, 120, 140), 0.438: RGBA(39, 72, 161, 140), 0.554: RGBA(1, 192, 229, 140), 0.667: RGBA(18, 178, 90, 140), 0.778: RGBA(79, 186, 8, 139), 0.893: RGBA(220, 237, 32, 140), 1: RGBA(247, 159, 20, 140)])
jitter = Jitter(List=gradient, Jitter=1, Seed=4)  # -> Values, Indices
V = ClusterOutput(jitter.Values)
