# Grasshopper definition UDL Annotation.gh (Grasshopper 1.0.7)
# plug-ins: Human

crv = Curve([<curve referenced from the Rhino model> x3])
len = Length(Curve=crv)
divide = DivideCurve(Curve=crv, Count=len, Kinks=False)  # -> Points, Tangents, Parameters
objatts = ObjectAttributes(ObjectOrAttributes=crv)  # -> Name, LayerName, LayerFullPath, Color, MaterialName, LinetypeName, GroupIndices, PlotWeight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
line = LineSDL(Start=divide.Points, Direction=Vector(0, 0, 1), Length=Slider(2, range=0..10))
expression = Expression(x=objatts.Name, Expression="Format(\"{0} kPa\", x)")
vec = Vector(line)
colour = ColourPicker(PickedColour=RGB(255, 0, 0))
end = EndPoints(Curve=line)  # -> Start, End
neg = Negative(Value=vec)
number_slider = Slider(2, range=0..10)
move = Move(Geometry=crv, Motion=line)  # -> Geometry, Transform
midpt = CurveMiddle(Curve=move.Geometry)
previewlw = CustomPreviewLineweights(Geometry=move.Geometry, Shader=colour, Thickness=number_slider, Absolute=False)
vdisex = VectorDisplayEx(Point=end.End, Vector=neg, Colour=colour, Width=number_slider)
Z = UnitZ(Factor=1)
move_2 = Move(Geometry=midpt, Motion=Z)  # -> Geometry, Transform
