# Grasshopper definition UnRollCurve.gh (Grasshopper 1.0.7)

discretisation_length = Slider(1, range=0..10)
number_slider = Slider(0.1, range=0..0.1)

# ----
# Control line
control_line = Curve(<curve referenced from the Rhino model>)

# ----
# Curves to unroll
crv = Curve([<curve referenced from the Rhino model> x30])

# ----
# Starting point
pt = Point(Point(53100.40287, 155260.4674, 48.39954508))

cluster = Cluster(P=pt, crv=crv, control_line=control_line, discretisation_length=Slider(0.2, range=0..1))
id = Guid(crv)
python = PythonScript(rhinoObjId=id)  # -> out, Layer
# ---------- python: Python ----------
import Rhino

rhinoObj = Rhino.RhinoDoc.ActiveDoc.Objects.Find(rhinoObjId)
index = rhinoObj.Attributes.LayerIndex
Layer = Rhino.RhinoDoc.ActiveDoc.Layers[index].Name
# ---------- end python ----------
bakeattributes = CSharpScript(objs=cluster, layers=python.Layer, activate=Button())  # -> out; inputs objs: list, names: list of String, layers: list of String, colors: list of Color, pWidths: list of Double, wiresEach: list of Int32, materials: list, activate: Boolean, groupListTgthr: Boolean
# ---------- bakeattributes: C# ----------
    //Inserts geometry into the Rhino document, with custom attributes
    //Written by Giulio Piacentino
    //Version written 2011 10 18 - for Grasshopper 0.8.52

    if (activate)
    {
      int groupIndex = -1;
      if(groupListTgthr)
        groupIndex = doc.Groups.Add();

      for(int i = 0; i < objs.Count; i++)
      {
        object obj = objs[i];
        if(obj == null)
        {
          Print("No object to bake");
          return;
        }

        //Make new attribute to set name
        Rhino.DocObjects.ObjectAttributes att = new Rhino.DocObjects.ObjectAttributes();

        string name = names.Count > 0 ? names[i % names.Count] : null;
        //Set object name
        if(!string.IsNullOrEmpty(name))
        {
          att.Name = name;
        }

        Color color = colors.Count > 0 ? colors[i % colors.Count] : new Color();
        //Set color
        if(!color.IsEmpty)
        {
          att.ColorSource = Rhino.DocObjects.ObjectColorSource.ColorFromObject; //Make the color type "by object"
          att.ObjectColor = color;

          att.PlotColorSource = Rhino.DocObjects.ObjectPlotColorSource.PlotColorFromObject; //Make the plot color type "by object"
          att.PlotColor = color;
        }

        string layer = layers.Count > 0 ? layers[i % layers.Count] : null;
        //Set layer
        if(!string.IsNullOrEmpty(layer) && Rhino.DocObjects.Layer.IsValidName(layer))
        {
          //Get the current layer index
          Rhino.DocObjects.Tables.LayerTable layerTable = doc.Layers;
          int layerIndex = layerTable.Find(layer, true);

          if(layerIndex < 0) //This layer does not exist, we add it
          {
            Rhino.DocObjects.Layer onlayer = new Rhino.DocObjects.Layer(); //Make a new layer
            onlayer.Name = layer;

            layerIndex = layerTable.Add(onlayer); //Add the layer to the layer table
            if (layerIndex > -1) //We manged to add layer!
            {
              att.LayerIndex = layerIndex;
              Print("Added new layer to the document at position " + layerIndex + " named " + layer + ". ");
            } else
              Print("Layer did not add. Try cleaning up your layers."); //This never happened to me.
          }
          else
            att.LayerIndex = layerIndex; //We simply add to the existing layer
        }


        double pWidth = pWidths.Count > 0 ? pWidths[i % pWidths.Count] : 0;
        //Set plotweight
        if(pWidth > 0)
        {
          att.PlotWeightSource = Rhino.DocObjects.ObjectPlotWeightSource.PlotWeightFromObject;
          att.PlotWeight = pWidth;
        }


        object material = materials.Count > 0 ? materials[i % materials.Count] : null;
        //Set material
        bool materialByName = !string.IsNullOrEmpty(material as string);
        Rhino.Display.DisplayMaterial inMaterial = material as Rhino.Display.DisplayMaterial;
        if(material is Color)
        {
          inMaterial = new Rhino.Display.DisplayMaterial((Color) material);
        }
        if(material != null && inMaterial == null && !materialByName)
        {
          if(!(material is string))
          {
            try //We also resort to try with IConvertible
            {
              inMaterial = (Rhino.Display.DisplayMaterial) Convert.ChangeType(material, typeof(Rhino.Display.DisplayMaterial));
            }
            catch(InvalidCastException)
            {
            }
          }
        }
        if(inMaterial != null || materialByName)
        {
          string matName;

          if(!materialByName)
          {
            matName = string.Format("A:{0}-D:{1}-E:{2}-S:{3},{4}-T:{5}",
              Format(inMaterial.Ambient),
              Format(inMaterial.Diffuse),
              Format(inMaterial.Emission),
              Format(inMaterial.Specular),
              inMaterial.Shine.ToString(),
              inMaterial.Transparency.ToString()
              );
          }
          else
          {
            matName = (string) material;
          }

          int materialIndex = doc.Materials.Find(matName, true);
          if(materialIndex < 0 && !materialByName) //Material does not exist and we have its specs
          {
            materialIndex = doc.Materials.Add(); //Let's add it
            if(materialIndex > -1)
            {
              Print("Added new material at position " + materialIndex + " named \"" + matName + "\". ");
              Rhino.DocObjects.Material m = doc.Materials[materialIndex];
              m.Name = matName;
              m.AmbientColor = inMaterial.Ambient;
              m.DiffuseColor = inMaterial.Diffuse;
              m.EmissionColor = inMaterial.Emission;
              //m.ReflectionColor = no equivalent
              m.SpecularColor = inMaterial.Specular;
              m.Shine = inMaterial.Shine;
              m.Transparency = inMaterial.Transparency;
              //m.TransparentColor = no equivalent
              m.CommitChanges();

              att.MaterialSource = Rhino.DocObjects.ObjectMaterialSource.MaterialFromObject;
              att.MaterialIndex = materialIndex;
            }
            else
              Print("Material did not add. Try cleaning up your materials."); //This never happened to me.
          }
          else if(materialIndex < 0 && materialByName) //Material does not exist and we do not have its specs. We do nothing
          {
            Print("Warning: material name not found. I cannot set the source to this material name. Add a material with name: " + matName);
          }
          else
          {
            //If this material exists, we do not replace it!
            att.MaterialSource = Rhino.DocObjects.ObjectMaterialSource.MaterialFromObject;
            att.MaterialIndex = materialIndex;
          }
        }


        int wires = wiresEach.Count > 0 ? wiresEach[i % wiresEach.Count] : 0;
        //Set wire density
        if(wires == -1 || wires > 0)
        {
          att.WireDensity = wires;
        }

        Bake(obj, att, groupIndex);
      }
    }
    else
    {
      Print("Inactive");
    }
# ---------- bakeattributes: C# additional code ----------
  void Bake(object obj, Rhino.DocObjects.ObjectAttributes att, int groupIndex)
  {
    if(obj == null)
      return;

    Guid id;

    //Bake to the right type of object
    if(obj is GeometryBase)
    {
      GeometryBase geomObj = obj as GeometryBase;

      switch(geomObj.ObjectType)
      {
        case Rhino.DocObjects.ObjectType.Brep:
          id = doc.Objects.AddBrep(obj as Brep, att);
          break;
        case Rhino.DocObjects.ObjectType.Curve:
          id = doc.Objects.AddCurve(obj as Curve, att);
          break;
        case Rhino.DocObjects.ObjectType.Point:
          id = doc.Objects.AddPoint((obj as Rhino.Geometry.Point).Location, att);
          break;
        case Rhino.DocObjects.ObjectType.Surface:
          id = doc.Objects.AddSurface(obj as Surface, att);
          break;
        case Rhino.DocObjects.ObjectType.Mesh:
          id = doc.Objects.AddMesh(obj as Mesh, att);
          break;
        case (Rhino.DocObjects.ObjectType) 1073741824://Rhino.DocObjects.ObjectType.Extrusion:
          id = (Guid) typeof(Rhino.DocObjects.Tables.ObjectTable).InvokeMember("AddExtrusion", BindingFlags.Instance | BindingFlags.InvokeMethod, null, doc.Objects, new object[]{obj, att});
          break;
        case Rhino.DocObjects.ObjectType.PointSet:
          id = doc.Objects.AddPointCloud(obj as Rhino.Geometry.PointCloud, att); //This is a speculative entry
          break;
        default:
          Print("The script does not know how to handle this type of geometry: " + obj.GetType().FullName);
          return;
      }
    }
    else
    {
      Type objectType = obj.GetType();

      if(objectType == typeof(Arc))
      {
        id = doc.Objects.AddArc((Arc) obj, att);
      }
      else if(objectType == typeof(Box))
      {
        id = doc.Objects.AddBrep(((Box) obj).ToBrep(), att);
      }
      else if(objectType == typeof(Circle))
      {
        id = doc.Objects.AddCircle((Circle) obj, att);
      }
      else if(objectType == typeof(Ellipse))
      {
        id = doc.Objects.AddEllipse((Ellipse) obj, att);
      }
      else if(objectType == typeof(Polyline))
      {
        id = doc.Objects.AddPolyline((Polyline) obj, att);
      }
      else if(objectType == typeof(Sphere))
      {
        id = doc.Objects.AddSphere((Sphere) obj, att);
      }
      else if(objectType == typeof(Point3d))
      {
        id = doc.Objects.AddPoint((Point3d) obj, att);
      }
      else if(objectType == typeof(Line))
      {
        id = doc.Objects.AddLine((Line) obj, att);
      }
      else if(objectType == typeof(Vector3d))
      {
        Print("Impossible to bake vectors");
        return;
      }
      else if(obj is IEnumerable)
      {
        int newGroupIndex;
        if(groupIndex == -1)
          newGroupIndex = doc.Groups.Add();
        else
          newGroupIndex = groupIndex;
        foreach(object o in obj as IEnumerable)
        {
          Bake(o, att, newGroupIndex);
        }
        return;
      }
      else
      {
        Print("Unhandled type: " + objectType.FullName);
        return;
      }
    }

    if(groupIndex != -1)
    {
      doc.Groups.AddToGroup(groupIndex, id);
      Print("Added " + obj.GetType().Name + " to group number " + groupIndex);
    }
    else
      Print("Added " + obj.GetType().Name);
  }

  static string Format(Color c)
  {
    return (new System.Text.StringBuilder("A")).Append(c.A.ToString()).Append("R").Append(c.R.ToString()).Append("G")
      .Append(c.G.ToString()).Append("B").Append(c.B.ToString()).ToString();
  }
# ---------- end bakeattributes ----------

# ==== cluster Cluster
crv = ClusterInput()
crv_2 = Curve(crv)
end = EndPoints(Curve=crv_2)  # -> Start, End
pdecon = Deconstruct(Point=end.End)  # -> XComponent, YComponent, ZComponent
pdecon_2 = Deconstruct(Point=end.Start)  # -> XComponent, YComponent, ZComponent
P = ClusterInput()
smaller = SmallerThan(FirstNumber=pdecon_2.XComponent, SecondNumber=pdecon.XComponent)  # -> SmallerThan, OrEqualTo
sift = SiftPattern(List=crv_2, SiftPattern=smaller.SmallerThan)  # -> Output0, Output1
flip = FlipCurve(Curve=sift.Output0)  # -> Curve, Flag
combine = CombineData(Input0=flip.Curve, Input1=sift.Output1)  # -> Result, Index
pdecon_3 = Deconstruct(Point=P)  # -> XComponent, YComponent, ZComponent
end_2 = EndPoints(Curve=combine.Result)  # -> Start, End
tag = TextTag(Location=P, Text="Unroll Start")
pt = Point(end_2.Start)
pdecon_4 = Deconstruct(Point=pt)  # -> XComponent, YComponent, ZComponent
expression = Expression(x=pdecon_4.XComponent, x0=pdecon_3.XComponent, Expression="x-x0")
discretisation_length = ClusterInput()
neg = Negative(Value=expression)
control_line = ClusterInput()
ext = ExtendCurve(Curve=graft(control_line), Type=0, Start=neg, End=Slider(0, range=0..100))

# ----
# Divide curves at regular length intervals
divdist = DivideDistance(Curve=crv_2, Distance=discretisation_length)  # -> reverse(Points), Tangents, Parameters

end_3 = EndPoints(Curve=control_line)  # -> Start, End

# ----
# Calculate the length of each segment in XY plane
number_slider = Slider(1, range=0..1)
lng = ListLength(List=divdist.Points)
subtraction = Subtraction(A=lng, B=number_slider)
series = Series(Start=number_slider, Step=1, Count=subtraction)
pdecon_5 = Deconstruct(Point=divdist.Points)  # -> XComponent, YComponent, ZComponent
item = ListItem(List=divdist.Points, Index=series, Wrap=True)
pdecon_6 = Deconstruct(Point=item)  # -> XComponent, YComponent, ZComponent
expression_2 = Expression(
    x=pdecon_5.XComponent,
    y=pdecon_5.YComponent,
    x1=pdecon_6.XComponent,
    y1=pdecon_6.YComponent,
    Expression="((x-x1)^2+(y-y1)^2)^0.5")

tag_2 = TextTag(Location=end_3.Start, Text="Start of control line")

# ----
# Divide control line in sequence of the calculated length increments,
# and stop when length of control line exceeds length of input curve
dash = DashPattern(Curve=graft(ext), Pattern=expression_2)  # -> Dashes, Gaps
number_slider_2 = Slider(1, range=0..1)
end_4 = EndPoints(Curve=dash.Dashes)  # -> Start, End
lng_2 = ListLength(List=end_4.End)
series_2 = Series(Start=number_slider_2, Step=number_slider_2, Count=lng_2)
ins = InsertItems(List=end_4.Start, Item=end_4.End, Indices=series_2, Wrap=True)
dom = ConstructDomain(DomainStart=Slider(0, range=0..100), DomainEnd=subtraction)
subset = SubList(List=ins, Domain=dom, Wrap=True)  # -> List, Index
pdecon_7 = Deconstruct(Point=subset.List)  # -> XComponent, YComponent, ZComponent

pt_2 = ConstructPoint(XCoordinate=pdecon_7.XComponent, YCoordinate=pdecon_7.YComponent, ZCoordinate=pdecon_5.ZComponent)
pline = PolyLine(Vertices=pt_2, Closed=False)  # -> flatten(Polyline)

pl = ClusterOutput(pline)
