# Grasshopper definition UnRollCurve_V2.gh (Grasshopper 1.0.7)

crv = Curve([<curve referenced from the Rhino model> x6])
end = EndPoints(Curve=crv)  # -> Start, End
pdecon = Deconstruct(Point=end.End)  # -> XComponent, YComponent, ZComponent
pdecon_2 = Deconstruct(Point=end.Start)  # -> XComponent, YComponent, ZComponent
expression = Expression(
    x=pdecon_2.XComponent,
    y=pdecon_2.YComponent,
    x1=pdecon.XComponent,
    y1=pdecon.YComponent,
    Expression="if((x^2+y^2)>(x1^2+y1^2),1,0)")
number_slider = Slider(1, range=0..10)
dispatch = Dispatch(List=crv, DispatchPattern=expression)  # -> ListA, ListB
flip = FlipCurve(Curve=dispatch.ListA)  # -> Curve, Flag
crv_2 = Curve(<curve referenced from the Rhino model>)
divdist = DivideDistance(Curve=crv_2, Distance=number_slider)  # -> Points, Tangents, Parameters
divdist_2 = DivideDistance(Curve=[flip.Curve, dispatch.ListB], Distance=number_slider)  # -> Points, Tangents, Parameters
pdecon_3 = Deconstruct(Point=divdist.Points)  # -> XComponent, YComponent, ZComponent
pdecon_4 = Deconstruct(Point=divdist_2.Points)  # -> XComponent, YComponent, ZComponent
pt = ConstructPoint(XCoordinate=pdecon_3.XComponent, YCoordinate=pdecon_3.YComponent, ZCoordinate=pdecon_4.ZComponent)
pline = PolyLine(Vertices=pt, Closed=False)
