# Grasshopper definition WavyDefect.gh (Grasshopper 1.0.7)

path = FilePath("D:\Jiwoo Ahn\Desktop\PSM3857\Wavy_defects_pavilion.csv")
file = ReadFile(File=path, PerLineParse=True)
split = SplitList(List=file, Index=Slider(1, range=0..1))  # -> ListA, ListB
split_2 = StringSplit(String=split.ListB, Separators=",")
flip = FlipMatrix(Data=split_2)  # -> simplify(Data)
panel = Panel(split.ListA)
bang = ExplodeTree(Data=flip)  # -> Branch0, Branch1, Branch2, Branch3, Branch4, Branch5, Branch6, Branch7, Branch8
dip_direction = Panel(bang.Branch5)
addition = Addition(A=dip_direction, B=Slider(180, range=0..1000))
length = Panel(bang.Branch6)
expression = Expression(x=dip_direction, Expression="90-x")
expression_2 = Expression(x=addition, Expression="90-x")
pt = ConstructPoint(XCoordinate=bang.Branch1, YCoordinate=bang.Branch2, ZCoordinate=bang.Branch3)
rad = Radians(Degrees=expression)
rad_2 = Radians(Degrees=expression_2)
cos = Cosine(Value=rad)
sin = Sine(Value=rad)
cos_2 = Cosine(Value=rad_2)
sin_2 = Sine(Value=rad_2)
multiplication = Multiplication(A=length, B=cos)
multiplication_2 = Multiplication(A=length, B=sin)
rad_3 = Radians(Degrees=Slider(90, range=0..100))
multiplication_3 = Multiplication(A=length, B=sin_2)
multiplication_4 = Multiplication(A=length, B=cos_2)
division = Division(A=length, B=Slider(2, range=0..10))
neg = Negative(Value=rad_3)
vec = VectorXYZ(XComponent=multiplication_4, YComponent=multiplication_3, ZComponent=0)  # -> Vector, Length
vec_2 = VectorXYZ(XComponent=multiplication, YComponent=multiplication_2, ZComponent=0)  # -> Vector, Length
rotate = Rotate(Geometry=vec_2.Vector, Angle=rad_3, Plane=PlaneXY(0, 0, 0))  # -> Geometry, Transform
rotate_2 = Rotate(Geometry=vec_2.Vector, Angle=neg, Plane=PlaneXY(0, 0, 0))  # -> Geometry, Transform
line = LineSDL(Start=pt, Direction=vec.Vector, Length=division)
line_2 = LineSDL(Start=pt, Direction=rotate_2.Geometry, Length=division)
line_3 = LineSDL(Start=pt, Direction=rotate.Geometry, Length=division)
line_4 = LineSDL(Start=pt, Direction=vec_2.Vector, Length=division)
end = EndPoints(Curve=line_4)  # -> Start, End
end_2 = EndPoints(Curve=line)  # -> Start, End
ln = Line(StartPoint=end.End, EndPoint=end_2.End)
wavelength = Panel(bang.Branch7)
amplitude = Panel(bang.Branch8)
divdist = DivideDistance(Curve=ln, Distance=Slider(0.2, range=0..1))  # -> Points, Tangents, Parameters
expression_3 = Expression(x=wavelength, Expression="2*π/x")
pdecon = Deconstruct(Point=divdist.Points)  # -> XComponent, YComponent, ZComponent
expression_4 = Expression(x=pdecon.XComponent, a=amplitude, b=expression_3, c=pdecon.ZComponent, Expression="a*sin(b*x)+c")
amp = Amplitude(Vector=line_3, Amplitude=length)
pt_2 = ConstructPoint(XCoordinate=pdecon.XComponent, YCoordinate=pdecon.YComponent, ZCoordinate=expression_4)
dip_angle = Panel(bang.Branch4)
pline = PolyLine(Vertices=pt_2, Closed=False)  # -> flatten(Polyline)
rad_4 = Radians(Degrees=dip_angle)
redpline = Reduce(Polyline=pline, Tolerance=Slider(0.1, range=0..0.1))  # -> Polyline, Reduction
rot3d = Rotate3D(Geometry=redpline.Polyline, Angle=rad_4, Center=pt, Axis=line_3)  # -> Geometry, Transform
move = Move(Geometry=rot3d.Geometry, Motion=line_2)  # -> Geometry, Transform
extr = Extrude(Base=move.Geometry, Direction=amp)
area = Area(Geometry=extr)  # -> Area, Centroid
