# Grasshopper definition WavyDefect_2D.gh (Grasshopper 1.0.7)

crv = Curve([<curve referenced from the Rhino model> x2])
wavelength = Panel("5")
divdist = DivideDistance(Curve=crv, Distance=Slider(0.2, range=0..1))  # -> Points, Tangents, Parameters
amplitude = Panel("0.1")
expression = Expression(x=wavelength, Expression="2*π/x")
pdecon = Deconstruct(Point=divdist.Points)  # -> XComponent, YComponent, ZComponent
expression_2 = Expression(x=pdecon.XComponent, a=amplitude, b=expression, c=pdecon.YComponent, Expression="a*sin(b*x)+c")
pt = ConstructPoint(XCoordinate=pdecon.XComponent, YCoordinate=expression_2, ZCoordinate=pdecon.ZComponent)
pline = PolyLine(Vertices=pt, Closed=False)
