# Grasshopper definition WavyDefect_Triangualar_BoundBox.gh (Grasshopper 1.0.7)

path = FilePath("C:\Users\Jiwoo Ahn\Desktop\PSM3857\3DEC Run03\OJN.txt")
file = ReadFile(File=path, PerLineParse=True)
split = StringSplit(String=file, Separators="\t")
flip = FlipMatrix(Data=split)
bang = ExplodeTree(Data=flip)  # -> Branch0, Branch1, Branch2, Branch3, Branch4, Branch5, Branch6, Branch7, Branch8
dip_direction = Panel(bang.Branch5)
length = Panel(bang.Branch6)
pt = ConstructPoint(XCoordinate=bang.Branch1, YCoordinate=bang.Branch2, ZCoordinate=bang.Branch3)
addition = Addition(A=dip_direction, B=Slider(180, range=0..1000))
expression = Expression(x=dip_direction, Expression="90-x")
expression_2 = Expression(x=addition, Expression="90-x")
box = CenterBox(Base=PlaneXY(0, 0, 0), X=1, Y=1, Z=1)
rad = Radians(Degrees=expression)
rad_2 = Radians(Degrees=expression_2)
cos = Cosine(Value=rad)
sin = Sine(Value=rad)
cos_2 = Cosine(Value=rad_2)
sin_2 = Sine(Value=rad_2)
multiplication = Multiplication(A=length, B=cos)
multiplication_2 = Multiplication(A=length, B=sin)
multiplication_3 = Multiplication(A=length, B=sin_2)
multiplication_4 = Multiplication(A=length, B=cos_2)
division = Division(A=length, B=Slider(2, range=0..10))
vec = VectorXYZ(XComponent=multiplication, YComponent=multiplication_2, ZComponent=0)  # -> Vector, Length
vec_2 = VectorXYZ(XComponent=multiplication_4, YComponent=multiplication_3, ZComponent=0)  # -> Vector, Length
rad_3 = Radians(Degrees=Slider(90, range=0..100))
neg = Negative(Value=rad_3)
rotate = Rotate(Geometry=vec.Vector, Angle=rad_3, Plane=PlaneXY(0, 0, 0))  # -> Geometry, Transform
rotate_2 = Rotate(Geometry=vec.Vector, Angle=neg, Plane=PlaneXY(0, 0, 0))  # -> Geometry, Transform
wavelength = Panel(bang.Branch7)
amplitude = Panel(bang.Branch8)
line = LineSDL(Start=pt, Direction=rotate_2.Geometry, Length=division)
line_2 = LineSDL(Start=pt, Direction=rotate.Geometry, Length=division)
line_3 = LineSDL(Start=pt, Direction=vec.Vector, Length=division)
line_4 = LineSDL(Start=pt, Direction=vec_2.Vector, Length=division)
end = EndPoints(Curve=line_3)  # -> Start, End
end_2 = EndPoints(Curve=line_4)  # -> Start, End
expression_3 = Expression(x=wavelength, Expression="x/2")
ln = Line(StartPoint=end.End, EndPoint=end_2.End)
divdist = DivideDistance(Curve=ln, Distance=expression_3)  # -> Points, Tangents, Parameters
pdecon = Deconstruct(Point=divdist.Points)  # -> XComponent, YComponent, ZComponent
amp = Amplitude(Vector=line_2, Amplitude=length)
lng = ListLength(List=pdecon.ZComponent)  # -> graft(Length)
dip_angle = Panel(bang.Branch4)
series = Series(Start=-1, Step=2, Count=2)
repeat = RepeatData(Data=graft(amplitude), Length=lng)
repeat_2 = RepeatData(Data=series, Length=lng)
rad_4 = Radians(Degrees=dip_angle)
multiplication_5 = Multiplication(A=repeat_2, B=repeat)
addition_2 = Addition(A=pdecon.ZComponent, B=multiplication_5)
pt_2 = ConstructPoint(XCoordinate=pdecon.XComponent, YCoordinate=pdecon.YComponent, ZCoordinate=addition_2)
pline = PolyLine(Vertices=pt_2, Closed=False)  # -> flatten(Polyline)
rot3d = Rotate3D(Geometry=pline, Angle=rad_4, Center=pt, Axis=line_2)  # -> Geometry, Transform
end_3 = EndPoints(Curve=rot3d.Geometry)  # -> Start, End
pdecon_2 = Deconstruct(Point=end_3.Start)  # -> XComponent, YComponent, ZComponent
pdecon_3 = Deconstruct(Point=end_3.End)  # -> XComponent, YComponent, ZComponent
move = Move(Geometry=rot3d.Geometry, Motion=line)  # -> Geometry, Transform
expression_4 = Expression(x=pdecon_2.ZComponent, y=pdecon_3.ZComponent, Expression="Abs(x-y)/2")
expression_5 = Expression(x=length, Expression="x/2")
expression_6 = Expression(x=dip_direction, Expression="rad(90-x)")
box_2 = CenterBox(Base=pt, X=expression_5, Y=expression_5, Z=expression_4)
rotate_3 = Rotate(Geometry=box_2, Angle=expression_6, Plane=pt)  # -> Geometry, Transform
extr = Extrude(Base=move.Geometry, Direction=amp)
smesh = SimpleMesh(Brep=[rotate_3.Geometry, extr])
