# Grasshopper definition WavyDefect_Triangualr.gh (Grasshopper 1.0.7)

path = FilePath("C:\Users\Jiwoo Ahn\Desktop\PSM3857\Geology\OJN.txt")
file = ReadFile(File=path, PerLineParse=True)
split = StringSplit(String=file, Separators="\t")
flip = FlipMatrix(Data=split)
bang = ExplodeTree(Data=flip)  # -> Branch0, Branch1, Branch2, Branch3, Branch4, Branch5, Branch6, Branch7, Branch8
dip_direction = Panel(bang.Branch5)
length = Panel(bang.Branch6)
pt = ConstructPoint(XCoordinate=bang.Branch1, YCoordinate=bang.Branch2, ZCoordinate=bang.Branch3)
addition = Addition(A=dip_direction, B=Slider(180, range=0..1000))
expression = Expression(x=dip_direction, Expression="90-x")
expression_2 = Expression(x=addition, Expression="90-x")
rad = Radians(Degrees=expression)
rad_2 = Radians(Degrees=expression_2)
cos = Cosine(Value=rad)
sin = Sine(Value=rad)
cos_2 = Cosine(Value=rad_2)
rad_3 = Radians(Degrees=Slider(90, range=0..100))
sin_2 = Sine(Value=rad_2)
multiplication = Multiplication(A=length, B=cos)
multiplication_2 = Multiplication(A=length, B=sin)
multiplication_3 = Multiplication(A=length, B=sin_2)
multiplication_4 = Multiplication(A=length, B=cos_2)
neg = Negative(Value=rad_3)
division = Division(A=length, B=Slider(2, range=0..10))
vec = VectorXYZ(XComponent=multiplication, YComponent=multiplication_2, ZComponent=0)  # -> Vector, Length
vec_2 = VectorXYZ(XComponent=multiplication_4, YComponent=multiplication_3, ZComponent=0)  # -> Vector, Length
rotate = Rotate(Geometry=vec.Vector, Angle=rad_3, Plane=PlaneXY(0, 0, 0))  # -> Geometry, Transform
rotate_2 = Rotate(Geometry=vec.Vector, Angle=neg, Plane=PlaneXY(0, 0, 0))  # -> Geometry, Transform
wavelength = Panel(bang.Branch7)
amplitude = Panel(bang.Branch8)
line = LineSDL(Start=pt, Direction=rotate_2.Geometry, Length=division)
line_2 = LineSDL(Start=pt, Direction=rotate.Geometry, Length=division)
line_3 = LineSDL(Start=pt, Direction=vec.Vector, Length=division)
line_4 = LineSDL(Start=pt, Direction=vec_2.Vector, Length=division)
end = EndPoints(Curve=line_3)  # -> Start, End
end_2 = EndPoints(Curve=line_4)  # -> Start, End
expression_3 = Expression(x=wavelength, Expression="x/2")
end_3 = EndPoints(Curve=line_2)  # -> Start, End
end_4 = EndPoints(Curve=line)  # -> Start, End
ln = Line(StartPoint=end.End, EndPoint=end_2.End)
divdist = DivideDistance(Curve=ln, Distance=expression_3)  # -> Points, Tangents, Parameters
pdecon = Deconstruct(Point=divdist.Points)  # -> XComponent, YComponent, ZComponent
amp = Amplitude(Vector=line_2, Amplitude=length)
circle = CircleCNR(Center=[end_4.End, end_3.End], Normal=[line, line_2], Radius=Slider(10, range=0..10))
lng = ListLength(List=pdecon.ZComponent)  # -> graft(Length)
dip_angle = Panel(bang.Branch4)
series = Series(Start=-1, Step=2, Count=2)
repeat = RepeatData(Data=graft(amplitude), Length=lng)
repeat_2 = RepeatData(Data=series, Length=lng)
rad_4 = Radians(Degrees=dip_angle)
multiplication_5 = Multiplication(A=repeat_2, B=repeat)
addition_2 = Addition(A=pdecon.ZComponent, B=multiplication_5)
pt_2 = ConstructPoint(XCoordinate=pdecon.XComponent, YCoordinate=pdecon.YComponent, ZCoordinate=addition_2)
pline = PolyLine(Vertices=pt_2, Closed=False)  # -> flatten(Polyline)
number_slider = Slider(500, range=0..1000)
rot3d = Rotate3D(Geometry=pline, Angle=rad_4, Center=pt, Axis=line_2)  # -> Geometry, Transform
neg_2 = Negative(Value=number_slider)
dom = ConstructDomain(DomainStart=neg_2, DomainEnd=number_slider)
end_5 = EndPoints(Curve=rot3d.Geometry)  # -> Start, End
move = Move(Geometry=rot3d.Geometry, Motion=line)  # -> Geometry, Transform
extr = Extrude(Base=move.Geometry, Direction=amp)
planesrf = PlaneSurface(Plane=circle, XSize=dom, YSize=dom)
planesrf_2 = PlaneSurface(Plane=[end_5.Start, end_5.End], XSize=dom, YSize=dom)
mesh = MeshBrep(Settings={GridMaxCount=0, GridMinCount=16, JaggedSeams=False, MaxEdgeLength=0, MinEdgeLength=0.0001, MinTolerance=0, Refine=True, RefineAngle=0, RelativeTolerance=0.65, SimplePlanes=True, Tolerance=0})
