# Grasshopper definition colourbyslope.gh (Grasshopper 1.0.7)
# Copyright: Copyright © 2013 Robert McNeel & Associates

number_slider = Slider(25, range=0..100)
mesh_surface = MeshSurface(Surface=<geometry referenced from the Rhino model>, UCount=50, VCount=50, Overhang=True, Equalize=False)
mcomp = Decompose(Mesh=mesh_surface)  # -> Vertices, Faces, Colours, Normals
surface = Surface(<surface referenced from the Rhino model>)
vcomp = Decompose(Vector=mcomp.Vertices)  # -> XComponent, YComponent, ZComponent
panel = Panel(mcomp.Vertices)
divide_surface = DivideSurface(Surface=surface, UCount=number_slider, VCount=number_slider)  # -> Points, Normals, Parameters
deconstruct_vector = DeconstructVector(Vector=panel)  # -> XComponent, YComponent, ZComponent
surface_curvature = SurfaceCurvature(Surface=surface, Point=divide_surface.Points)  # -> Frame, Gaussian, Mean
panel_2 = Panel(deconstruct_vector.ZComponent)
bounds = Bounds(Numbers=panel_2)
panel_3 = Panel(bounds)
custom_preview = CustomPreview(
    Geometry=surface_curvature.Frame,
    Material={diffuse=RGB(221, 160, 221), emission=RGB(66, 48, 66), shine=0.5, specular=RGB(255, 255, 255), transparency=0})
deconstruct_domain = DeconstructDomain(Domain=panel_3)  # -> Start, End
gradient = Gradient(
    LowerLimit=deconstruct_domain.Start,
    UpperLimit=deconstruct_domain.End,
    Parameter=panel_2,
    stops=[0: RGB(234, 38, 0), 0.25: RGB(234, 126, 0), 0.5: RGB(254, 244, 84), 0.75: RGB(173, 203, 249), 1: RGB(75, 107, 169)])
mesh_colours = MeshColours(Mesh=mesh_surface, Colours=gradient)
