# Grasshopper definition springs.gh (Grasshopper 1.0.7)

crv = Curve(<curve referenced from the Rhino model>)
cp = ControlPoints(Curve=crv)  # -> Points, Weights, Knots
lng = ListLength(List=cp.Points)
subtraction = Subtraction(A=lng, B=1)
series = Series(Start=0, Step=1, Count=subtraction)
item = ListItem(List=cp.Points, Index=series, Wrap=True)
series_2 = Series(Start=1, Step=1, Count=subtraction)
item_2 = ListItem(List=cp.Points, Index=series_2, Wrap=True)
vec2pt = Vector2Pt(PointA=item, PointB=item_2, Unitize=False)  # -> Vector, Length
unit = UnitVector(Vector=vec2pt.Vector)
devec = DeconstructVector(Vector=unit)  # -> XComponent, YComponent, ZComponent
multiplication = Multiplication(A=devec.XComponent, B=-1)
vec = VectorXYZ(XComponent=devec.YComponent, YComponent=multiplication, ZComponent=0)  # -> Vector, Length
devec_2 = DeconstructVector(Vector=vec.Vector)  # -> XComponent, YComponent, ZComponent
pdecon = Deconstruct(Point=item_2)  # -> XComponent, YComponent, ZComponent
addition = Addition(A=devec_2.YComponent, B=pdecon.YComponent)
addition_2 = Addition(A=devec_2.XComponent, B=pdecon.XComponent)
pt = ConstructPoint(XCoordinate=addition_2, YCoordinate=addition, ZCoordinate=pdecon.ZComponent)
ln = Line(StartPoint=item, EndPoint=pt)
