# Grasshopper definition stick_log.gh (Grasshopper 1.0.7)

path = FilePath("C:\Users\Jiwoo Ahn\Desktop\CRR\bhs.csv")
file = ReadFile(File=path, PerLineParse=True)
split = StringSplit(String=file, Separators=",")
flip = FlipMatrix(Data=split)
bang = ExplodeTree(Data=flip)  # -> Branch0, Branch1, Branch2, Branch3, Branch4, Branch5, Branch6, Branch7
rl = Panel(bang.Branch3)
northing = Panel(bang.Branch2)
bh_id = Panel(bang.Branch0)
easting = Panel(bang.Branch1)
depth = Panel(bang.Branch4)
inclination = Panel(bang.Branch5)
azimuth = Panel(bang.Branch6)
pt = ConstructPoint(XCoordinate=easting, YCoordinate=northing, ZCoordinate=rl)
pdecon = Deconstruct(Point=pt)  # -> XComponent, YComponent, ZComponent
pdecon_2 = Deconstruct(Point=pt)  # -> XComponent, YComponent, ZComponent
addition = Addition(A=pdecon_2.ZComponent, B=Slider(2, range=0..10))
pt_2 = ConstructPoint(XCoordinate=pdecon_2.XComponent, YCoordinate=pdecon_2.YComponent, ZCoordinate=addition)
colour = ColourPicker(PickedColour=RGB(246, 0, 0))
tag = TextTag(Location=pt_2, Text=bh_id, Colour=colour)
cluster = Cluster(A=pdecon.XComponent, A_2=pdecon.YComponent, B=pdecon.ZComponent, depth=depth, plunge=inclination, azimuth=azimuth)
ln = Line(StartPoint=cluster, EndPoint=pt)
len = Length(Curve=ln)
cyl = Cylinder(Base=ln, Radius=Slider(0.5, range=0..1), Length=len)
cap = CapHoles(Brep=cyl)
preview = CustomPreview(
    Geometry=cap,
    Material={diffuse=RGB(221, 160, 221), emission=RGB(66, 48, 66), shine=0.5, specular=RGB(255, 255, 255), transparency=0})

# ==== cluster Cluster
A = ClusterInput()
A_2 = ClusterInput()
B = ClusterInput()
depth = ClusterInput()
plunge = ClusterInput()
azimuth = ClusterInput()
expression = Expression(plunge=plunge, depth=depth, Expression="cos(rad(plunge))*depth")
expression_2 = Expression(plunge=plunge, depth=depth, Expression="-sin(rad(plunge))*depth")
expression_3 = Expression(azimuth=azimuth, Expression="(-azimuth+90)")
expression_4 = Expression(x=expression_3, Expression="if(x<0,(x+360),x)")
addition = Addition(A=expression_2, B=B)
expression_5 = Expression(theta=expression_4, r=expression, Expression="r*cos(rad(theta))")
expression_6 = Expression(theta=expression_4, r=expression, Expression="r*sin(rad(theta))")
addition_2 = Addition(A=A, B=expression_5)
addition_3 = Addition(A=A_2, B=expression_6)
pt = ConstructPoint(XCoordinate=addition_2, YCoordinate=addition_3, ZCoordinate=addition)
pt_2 = ClusterOutput(pt)
